# Grasshopper definition NetworkGenerator_ToolpathAngle_v1_20240528.gh (Grasshopper 1.0.7)
# plug-ins: Shortest Walk in Gh, Kangaroo2 Components, LunchBox, Pufferfish, Wombat
# Hello

number_slider = Slider(1, range=0..10)
filament_inclination_degrees = Slider(-35, range=-90..90)
cull_index = CullIndex(Indices=number_slider, Wrap=True)
list_item = ListItem(Index=number_slider, Wrap=True)

# ---- group: Surface
xz_plane = XZPlane(Origin=Point(0, 0, 0))
plane_surface = PlaneSurface(Plane=xz_plane, XSize="0 To 50", YSize="0 To 50")

# ---- group: Points for the channel network to connect
populate_geometry = PopulateGeometry(Geometry=plane_surface, Count=Slider(10, range=0..100), Seed=1)

# ---- group: Surface
xz_plane_2 = XZPlane(Origin=Point(0, 0, 0))
plane_surface_2 = PlaneSurface(Plane=xz_plane_2, XSize="5 To 70", YSize="5 To 70")

xz_plane_3 = XZPlane(Origin=Point(0, 0, 0))
plane_surface_3 = PlaneSurface(Plane=xz_plane_3, XSize="2.5 to 28", YSize="2.5 to 28")

xz_plane_4 = XZPlane(Origin=Point(0, 0, 0))
plane_surface_4 = PlaneSurface(Plane=xz_plane_4, XSize="2.5 to 45.5", YSize="2.5 to 45.5")

# ---- group: Inlet
point = Point("0,0,0")

point_2 = Point("0,0,0")

point_3 = Point("0,0,0")

point_4 = Point("0,0,0")

# ----
layer_height = Slider(1, range=0..10)
nozzle_diameter = Slider(1.36, range=0..10)
overlap = Panel("0")
extrusion_multiplier = Panel("3.67")
division = Division(A=layer_height, B="2")
ghpython_script = GhPythonScript(d=nozzle_diameter, overlap=overlap, h=layer_height, EM=extrusion_multiplier)  # -> out, a, D, c, EC; inputs overlap: Int32
# ---------- ghpython_script: Python ----------
__author__ = "Wyss User"
__version__ = "2022.11.08"

import rhinoscriptsyntax as rs
import math

y = 1.20 #constant
a = round(d*y,2) * ((100-overlap)/100)
b = a / 2
c = str(-b) + " to " + str(b)
D = round(d*y,2)

u = 4*h * EM
v = math.pi * d * d
EC = u / v
# ---------- end ghpython_script ----------
effective_layer_width = Panel(ghpython_script.a)
theoretical_layer_width = Panel(ghpython_script.D)
extrusion_constant = Panel(ghpython_script.EC)
createdomain = GhPythonScript(x=layer_height)  # -> out, a
# ---------- createdomain: Python ----------
__author__ = "lt4840"
__version__ = "2024.01.15"

import rhinoscriptsyntax as rs

b = x/2
a = str(-b) + " to " + str(b)
# ---------- end createdomain ----------
division_2 = Division(A=theoretical_layer_width, B="2")

# ---- group: Points for the channel network to connect
points = Point([Point(-22.61982743, -35.03304205, 0), Point(44.81019461, 31.85386326, 0), Point(-33.06959428, 37.0906409, 0), Point(40.03181061, -30.03165407, 0), Point(-4.869608897, 9.881066131, 0), Point(9.227998613, 43.75009119, 0)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])

# ---- group: Inlet
point_5 = Point(Point(32.15096936, 0, 0))

point_6 = Point(Point(-0.02813920185, 50.00159006, 0))

# ---- group: Points for the channel network to connect
point_7 = Point([Point(48.45576304, 0, 21.31891953), Point(34.13935883, 0, 9.587421633), Point(59.98842199, 0, 52.76084342), Point(26.38463988, 0, 53.75503816), Point(24.19741146, 0, 32.65011922), Point(9.682168302, 0, 44.48445685), Point(75, 14.87939162, 38.11571721), Point(75, 0, 60.51556237), Point(50.24531357, 0, 75), Point(42.68943357, 0, 75), Point(17.03920936, 0, 75), Point(0, 0, 72.98899055), Point(0, 0, 48.48135448)])

point_8 = Point([Point(26.40264278, 0, 30.15081179), Point(87.68246236, 0, 47.90711283), Point(50.27721789, 0, 90.90017003)])

point_9 = Point([<point referenced from the Rhino model> x3])

point_10 = Point([<point referenced from the Rhino model> x12])

# ----
filament_inclination_degrees_2 = Integer(filament_inclination_degrees)

# ---- group: Surface
xz_plane_5 = XZPlane(Origin=Point(0, 0, 0))
plane_surface_5 = PlaneSurface(Plane=xz_plane_5, XSize="2.5 to 45.5", YSize="2.5 to 45.5")

# ----
xy_plane = XYPlane(Origin=Point(0, 0, 0))
xz_plane_6 = XZPlane(Origin=Point(0, 0, 0))

# ---- group: Surface
xz_plane_7 = XZPlane(Origin=Point(0, 0, 0))
plane_surface_6 = PlaneSurface(Plane=xz_plane_7, XSize="2.5 to 45.5", YSize="2.5 to 45.5")

# ---- group: Points for the channel network to connect
populate_geometry_2 = PopulateGeometry(Geometry=plane_surface_6, Count=Slider(100, range=0..200), Seed=1)

# ---- group: Volume
center_box = CenterBox(Base=PlaneXY(0, 0, 0), X="20", Y="20", Z="20")

# ----
inlet_point = Point("0,0,0")

# ---- group: Surface
# Channel network type: 2D and 3D Branching with Proximity 3D
xy_plane_2 = XYPlane(Origin=Point(0, 0, 0))
plane_surface_7 = PlaneSurface(Plane=xy_plane_2, XSize="-100 to 30", YSize="-20 to 20")

# ----
inlet_point_2 = Point("0,0,0")

entwine = Entwine(Branch00=point_5, Branch01=point_7, FlattenInputs=True)

entwine_2 = Entwine(Branch00=point, Branch01=populate_geometry, Branch02=plane_surface, FlattenInputs=True)

entwine_3 = Entwine(Branch00=point_6, Branch01=points, FlattenInputs=True)

inlet_point_3 = Point("-10,-10,-10")

# ----
# OLD
entwine_4 = Entwine(Branch00=point_3, Branch01=point_9, Branch02=plane_surface_3, FlattenInputs=True)

entwine_5 = Entwine(Branch00=point_2, Branch01=point_8, Branch02=plane_surface_2, FlattenInputs=True)

entwine_6 = Entwine(Branch00=point_4, Branch01=point_10, Branch02=plane_surface_4, FlattenInputs=True)

division_3 = Division(A=effective_layer_width, B="2")
negative = Negative(Value=theoretical_layer_width)
rotate = Rotate(Geometry=xy_plane, Angle=degrees(filament_inclination_degrees_2), Plane=xz_plane_6)  # -> Geometry, Transform

# ---- group: Points for the channel network to connect
point_11 = Point([Point(47.13913486, 0, 43.53222609), Point(47.23314773, 0, 26.51546674), Point(21.19158328, 0, 14.4050336), Point(29.82047246, 0, 19.257601), Point(38.73194855, 0, 21.22952445), Point(32.09932967, 0, 29.60175842), Point(37.65586441, 0, 37.27515354), Point(9.572380095, 0, 10.50304307), Point(12.49067435, 0, 24.75061622), Point(16.99714712, 0, 34.34126232), Point(10.93622433, 0, 48.39138834), Point(25.84193229, 0, 46.7286636)])

# ----
# Example 6: sample C (Fig. 6C)
# Channel network type: Unconnected
point_12 = Point([Point(-54.20041916, 0, 0), Point(-91.15083639, 0, 0), Point(-35.72521054, 6.5, 0), Point(-72.67562777, 6.5, 0), Point(-35.72521054, -6.5, 0), Point(-72.67562777, -6.5, 0), Point(-54.20041916, -13, 0), Point(-54.20041916, 13, 0), Point(-17.25000193, 0, 0), Point(-19.70041723, 0, 0), Point(-56.65083446, 0, 0), Point(-1.225208614, 6.5, 0), Point(-38.17562584, 6.5, 0), Point(-1.225208614, -6.5, 0), Point(-38.17562584, -6.5, 0), Point(-19.70041723, -13, 0), Point(-19.70041723, 13, 0), Point(17.25, 0, 0)])
keep_empty_for_2d_network = Panel("")
entwine_7 = Entwine(Branch01=point_12, Branch02=plane_surface_7, Branch03=keep_empty_for_2d_network, FlattenInputs=True)

negative_2 = Negative(Value=division_3)

# ----
# Example 1: 2D network (Fig. 5)
# Channel network type: 2D and 3D Branching with Proximity 3D
# Number of closest points = 3
# Channel radius: XX with Murray's Law
keep_empty_for_2d_network_2 = Panel("")
entwine_8 = Entwine(
    Branch00=inlet_point,
    Branch01=point_11,
    Branch02=plane_surface_5,
    Branch03=keep_empty_for_2d_network_2,
    FlattenInputs=True)

# ----
# Example 2: 2D network (more points)
keep_empty_for_2d_network_3 = Panel("")
entwine_9 = Entwine(
    Branch00=inlet_point_2,
    Branch01=populate_geometry_2,
    Branch02=plane_surface_6,
    Branch03=keep_empty_for_2d_network_3,
    FlattenInputs=True)

explode_tree = ExplodeTree(Data=entwine_6)  # -> Branch0, Branch1, Branch2

channel_radius = Slider(3, range=0..10)
layer_height_2 = Slider(1, range=0..1)
inlet_point_4 = Point(explode_tree.Branch0)
point_13 = Point(explode_tree.Branch1)
surface = Surface(explode_tree.Branch2)

# ----
# Settings
# Note 1: Murray's law can only be applied to branching networks, i.e.,:
# - 2D and 3D Branching with Proximity 3D
# - Dichotomous Branching
# Note 2: uses the defined channel radius for the smallest daughter branches.
channel_network_type = ValueList({"2D and 3D Branching with Proximity 3D": 0, "2D and 3D Interconnected (no intersecting curves)": 1, "Dichotomous branching": 2, "2D Voronoi": 3, "3D Voronoi": 4, "2D and 3D Unconnected": 5}, selected="2D and 3D Branching with Proximity 3D")
explode_tree_2 = ExplodeTree(Data=entwine_8)  # -> Branch0, Branch1, Branch2, Branch3
channel_inner_radius = Slider(1, range=0..10)
apply_murray_s_law = BooleanToggle(True)
nozzle_diameter_mm = Slider(1.36, range=0..10)
filament_height = Slider(1, range=0..3)
extrusion_multiplier_em = Panel("3.67")
overlap_2 = Slider(10, range=0..100)
toolpath_angle_beta_degrees = Slider(0, range=0..180)
surface_2 = Surface(explode_tree_2.Branch2)
box = Box(explode_tree_2.Branch3)
inlet_point_5 = Point(explode_tree_2.Branch0)
point_14 = Point(explode_tree_2.Branch1)
ghpython_script_2 = GhPythonScript(nozzleDiameter=nozzle_diameter_mm, overlap=overlap_2, filamentHeight=filament_height, EM=extrusion_multiplier_em)  # -> out, filamentOffset, filamentWidth, EC; inputs overlap: Int32
# ---------- ghpython_script_2: Python ----------
__author__ = "Wyss User"
__version__ = "2022.11.08"

import rhinoscriptsyntax as rs
import math

d = nozzleDiameter
h = filamentHeight

y = 1.20 #constant
a = round(d*y,2) * ((100-overlap)/100)
b = a / 2
D = round(d*y,2)

u = 4*h * EM
v = math.pi * d * d
EC = u / v

filamentWidth = D
filamentOffset = a
# ---------- end ghpython_script_2 ----------
effective_layer_width_2 = Panel(ghpython_script_2.filamentOffset)
filament_width = Number(ghpython_script_2.filamentWidth)
extrusion_constant_ec = Panel(ghpython_script_2.EC)
filament_width_2 = Panel(filament_width)

proximity_3d = Proximity3D(Points=point_13, Group=Slider(2, range=0..10))  # -> flatten(Links), Topology
closest_point = ClosestPoint(Point=inlet_point_4, Cloud=point_13)  # -> ClosestPoint, CPIndex, Distance
removeduplicatelines = RemoveDuplicateLines(Lines=proximity_3d.Links, Tolerance=0.01)
line = Line(StartPoint=inlet_point_4, EndPoint=closest_point.ClosestPoint)
line_2 = Line(StartPoint=inlet_point_4, EndPoint=point_13)
shortest_walk = ShortestWalk(Curves=[line, removeduplicatelines], WantedPath=line_2)  # -> flatten(ShortestWalk), Succession, Direction, Length

number_slider_2 = Slider(2, range=0..10)
closest_point_2 = ClosestPoint(Point=inlet_point_4, Cloud=point_13)  # -> ClosestPoint, CPIndex, Distance; disabled
cull_index_2 = CullIndex(List=point_13, Indices=closest_point_2.CPIndex, Wrap=True)
closest_points = ClosestPoints(Point=closest_point_2.ClosestPoint, Cloud=cull_index_2, Count=number_slider_2)  # -> ClosestPoint, CPIndex, Distance
cull_index_3 = CullIndex(List=cull_index_2, Indices=closest_points.CPIndex, Wrap=True)
closest_points_2 = ClosestPoints(Point=closest_points.ClosestPoint, Cloud=cull_index_3, Count=number_slider_2)  # -> ClosestPoint, CPIndex, Distance
cull_index_4 = CullIndex(List=cull_index_3, Indices=closest_points_2.CPIndex, Wrap=True)
closest_points_3 = ClosestPoints(Point=closest_points_2.ClosestPoint, Cloud=cull_index_4, Count=number_slider_2)  # -> ClosestPoint, CPIndex, Distance
line_3 = Line(StartPoint=simplify(graft(closest_points.ClosestPoint)), EndPoint=simplify(closest_points_2.ClosestPoint))  # -> flatten(Line)
line_4 = Line(StartPoint=simplify(graft(closest_points_2.ClosestPoint)), EndPoint=simplify(closest_points_3.ClosestPoint))  # -> flatten(Line)
line_5 = Line(StartPoint=inlet_point_4, EndPoint=closest_point_2.ClosestPoint)
line_6 = Line(StartPoint=closest_point_2.ClosestPoint, EndPoint=closest_points.ClosestPoint)
curve = Curve([line_5, line_6, line_3, line_4])

diagrid_structure = DiagridStructure(UDivisions=10, VDivisions=10, Type=True)  # -> StructureLines, StructureNodes
voronoi_3d = Voronoi3D()  # -> Cells, Boundary
voronoi = Voronoi(BruteForceOverride=False)

# ----
# Settings
number_of_closest_points = Slider(3, range=0..10)
number_of_closest_points_2 = Slider(6, range=0..10)
remove_perimeter_curves = BooleanToggle(True)
remove_boundary_curves = BooleanToggle(True)
vector_direction_of_channels = Panel("1,0,0")

# ---- group: Larger value reduces risk of points not being included
number_of_closest_points_3 = Slider(8, range=0..100)

# ---- group: Smaller value creates shorter paths
max_curve_length = Slider(7, range=0..100)

# ----
# Channel network types
ghpython_script_3 = GhPythonScript(x=channel_network_type)  # -> out, a
# ---------- ghpython_script_3: Python ----------
__author__ = "lt4840"
__version__ = "2024.04.15"

import rhinoscriptsyntax as rs

executeList = [False, False, False, False, False, False]
executeList[x] = True
a = executeList
# ---------- end ghpython_script_3 ----------
explode_tree_3 = ExplodeTree(Data=graft(ghpython_script_3.a))  # -> Branch0, Branch1, Branch2, Branch3, Branch4, Branch5
_2d_and_3d_branching_with_proximity_3d = _2DAnd3DBranchingWithProximity3D(inlet_point=inlet_point_5, point=point_14, group=number_of_closest_points, x=explode_tree_3.Branch0)
_2d_and_3d_interconnected_no_intersectin = _2DAnd3DInterconnectedNoIntersectingCurves_2(points=inlet_point_5, points_2=point_14, y=number_of_closest_points_2, x=explode_tree_3.Branch1)  # "2D and 3D Interconnected (no intersecting curves)"
dichotomous_branching = DichotomousBranching(inlet_point=inlet_point_5, point=point_14, number=max_curve_length, number_2=number_of_closest_points_3)
_3d_voronoi = _3DVoronoi(y=point_14, box=box, path=remove_boundary_curves, x=explode_tree_3.Branch4)
_2d_and_3d_unconnected = _2DAnd3DUnconnected(vector=vector_direction_of_channels, y=point_14, x=explode_tree_3.Branch5)
_2d_voronoi = _2DVoronoi(y=point_14, surface=surface_2, path=remove_perimeter_curves, x=explode_tree_3.Branch3)
entwine_10 = Entwine(
    Branch00=_2d_and_3d_branching_with_proximity_3d,
    Branch01=_2d_and_3d_interconnected_no_intersectin,
    Branch02=dichotomous_branching,
    Branch03=_2d_voronoi,
    Branch04=_3d_voronoi,
    Branch05=_2d_and_3d_unconnected,
    FlattenInputs=True)  # -> simplify(Result)
tree_branch = TreeBranch(Tree=entwine_10, Path=channel_network_type, MaintainPaths=True)
project_curves_if_surface_is_non_planar = ProjectCurvesIfSurfaceIsNonPlanar(network_curves_unique_lines=tree_branch, surface=surface_2)
network_curves_unique_lines = Curve(project_curves_if_surface_is_non_planar)

cube = Cube(Value=channel_radius)
division_4 = Division(A=cube, B="2")
division_5 = Division(A=division_4, B="2")
cube_root = CubeRoot(Value=division_4)
cube_root_2 = CubeRoot(Value=division_5)
panel_3 = Panel(cube)
panel_4 = Panel(cube_root)
panel_5 = Panel(cube_root_2)

# ---- group: Channel network geometry
explode = Explode(Curve=shortest_walk.ShortestWalk, Recursive=True)  # -> flatten(Segments), Vertices
removeduplicatelines_2 = RemoveDuplicateLines(Lines=explode.Segments, Tolerance=0.01)
multipipe = MultiPipe(
    Curves=removeduplicatelines_2,
    NodeSize=channel_radius,
    EndOffset=1,
    StrutSize=1,
    Segment=0,
    KinkAngle=0.6,
    CubeFit=0,
    Caps=0)
cap_holes = CapHoles(Brep=multipipe)

# ----
gene_pool = GenePool(Decimals=2, Maximum=3, Minimum=0, Value=[3, 3, 3, 3, 3, 3, 3, 3, 3, 3, 3, 3])
end_points = EndPoints(Curve=removeduplicatelines_2)  # -> Start, End; disabled
area = Area(Geometry=plane_surface_4)  # -> Area, Centroid
multipipe_2 = MultiPipe(
    Curves=removeduplicatelines_2,
    NodeSize=gene_pool,
    SizePoints=end_points.Start,
    EndOffset=1,
    StrutSize=1,
    Segment=0,
    KinkAngle=0.6,
    CubeFit=0,
    Caps=0)  # disabled
channel_radii = Panel("""3
2.38
2.38
1.89
2.38
2.38
1.89
1.89
1.89
1.89
1.89
1.89""")
addition = Addition(A="0.99", B="-0.005")
scale = Scale(Geometry=plane_surface_4, Center=area.Centroid, Factor="0.99")  # -> Geometry, Transform
number_slider_3 = Slider(500, range=0..500)
addition_2 = Addition(A="0.99", B="0.005")
scale_2 = Scale(Geometry=plane_surface_4, Center=area.Centroid, Factor=addition)  # -> Geometry, Transform
point_15 = Point(end_points.Start)  # disabled
scale_3 = Scale(Geometry=plane_surface_4, Center=area.Centroid, Factor=addition_2)  # -> Geometry, Transform
curve_2 = Curve(removeduplicatelines_2)
offset_surface = OffsetSurface(Surface=scale.Geometry, Distance="5", BothSides="-5", CreateSolid=True)
contour = Contour(Shape=scale.Geometry, Point="0,0,0", Direction=rotate.Geometry, Distance=layer_height)  # -> simplify(Contours)
extend_curve = ExtendCurve(Curve=contour, Type=0, Start="30", End="30")
offset_surface_2 = OffsetSurface(Surface=scale_2.Geometry, Distance="5", BothSides="-5", CreateSolid=True)
cluster = Cluster(curve=curve_2, radius=channel_radii, charge_strengths=number_slider_3)  # -> mesh, a
radius = Panel(cluster.a)
amplitude = Amplitude(Vector=rotate.Geometry, Amplitude="1")
brep = Brep(cap_holes)

offset_surface_3 = OffsetSurface(Surface=plane_surface_4, Distance=division_3, BothSides=negative_2, CreateSolid=True)
solid_union = SolidUnion(Breps=flatten([brep, offset_surface_3]))
brep_2 = Brep(brep)

addition_3 = Addition(A=channel_radii, B="1.20")

# ----
# Channel radii
apply_murray_s_law_branching_networks = ApplyMurraysLawBranchingNetworks(network_curves_unique_lines=network_curves_unique_lines, inlet_point=inlet_point_5, number=channel_inner_radius)
radii = Number(apply_murray_s_law_branching_networks)
entwine_11 = Entwine(Branch00=channel_inner_radius, Branch01=radii, FlattenInputs=True)
tree_branch_2 = TreeBranch(Tree=simplify(entwine_11), Path=apply_murray_s_law, MaintainPaths=True)

contour_2 = Contour(Shape=brep_2, Point="0,0,0", Direction=rotate.Geometry, Distance=layer_height)  # -> simplify(Contours)
move = Move(Geometry=simplify(contour_2), Motion=amplitude)  # -> simplify(Geometry), Transform
cluster_2 = Cluster(curve=curve_2, radius=addition_3, charge_strengths=number_slider_3)  # -> mesh, a
radius_2 = Panel(cluster_2.a)
mesh = Mesh(cluster.mesh)
mesh_reduce = MeshReduce(Mesh=mesh, TargetSize=Slider(1000, range=0..1000), Distort=True, Accuracy=5, NormalizeSize=False)

# ----
# Input
# Smaller value: greater chances of successful
# Sweep in "Generate filament geometry"
# Larger value: more precise toolpaths for the
# desired channel geometry
curve_3 = Curve(network_curves_unique_lines)
cluster_3 = Cluster_3(vector_a=network_curves_unique_lines)
filament_offset_from_overlap = Number(ghpython_script_2.filamentOffset)
precision = Slider(0.5, range=0..2)
channel_radii_2 = Number(tree_branch_2)
filament_width_3 = Number(filament_width)
filament_height_2 = Number(filament_height)
toolpath_angle_beta_degrees_2 = Number(toolpath_angle_beta_degrees)
surface_3 = Surface(surface_2)

panel_6 = Panel("30")
panel_7 = Panel("5")  # disabled
reduce_mesh = ReduceMesh(Mesh=cluster_2.mesh, FaceCount=20, Accuracy=1, FaceType=0, Distort=True, Normalize=False)  # -> Reduced, CountDifference
reduce_mesh_2 = ReduceMesh(Mesh=mesh, FaceCount=20, Accuracy=1, FaceType=0, Distort=True, Normalize=False)  # -> Reduced, CountDifference
offset_surface_4 = OffsetSurface(Surface=scale_3.Geometry, Distance="5", BothSides="-5", CreateSolid=True)
channel_radii_3 = Number(tree_branch_2)

# ----
# Geometry of channel inner cavity
# Note: the actual channel inner radius as
# measured by "Mesh network with Cocoon for
# toolpaths" may have a larger value if a
# branching geometry is present close to the
# curve.
# Note: generating the channel network
# geometry may take some time for larger
# networks. Set to "False" when changing the
# settings.
number_slider_4 = Slider(500, range=0..500)
execute = BooleanToggle(False)
curve_4 = Curve(network_curves_unique_lines)
desired_channel_inner_radii = Panel(channel_radii_3)
mesh_network_with_cocoon = Cluster(curve=curve_4, radius=desired_channel_inner_radii, charge_strengths=number_slider_4, execute=execute)  # -> mesh, flatten(a)
actual_channel_inner_radii = Panel(mesh_network_with_cocoon.a)
custom_preview = CustomPreview(Geometry=mesh_network_with_cocoon.mesh, Material=ColourSwatch(SwatchColor=RGB(204, 99, 0)))

# ----
# Note: the actual channel inner radius as
# measured by "Mesh network with Cocoon for
# toolpaths" may have a larger value if a
# branching geometry is present close to the
# curve.
# Generate toolpaths
# For 2D networks in the XZ plane only
# Note: generating the channel network
# geometry may take some time for larger
# networks. Set to "False" when changing the
# Settings.
cluster_4 = Cluster_2(A_2=filament_width_3, A=filament_height_2, angle_2=toolpath_angle_beta_degrees_2, angle=cluster_3)
execute_2 = BooleanToggle(False)
desired_channel_inner_radii_2 = Panel(channel_radii_2)
mesh_network_with_cocoon_for_toolpaths = MeshNetworkWithCocoonForToolpaths(curve=curve_3, A=desired_channel_inner_radii_2, charge_strengths=number_slider_4, B=cluster_4, execute=execute_2)  # -> mesh, flatten(a)
actual_channel_inner_radii_2 = Panel(mesh_network_with_cocoon_for_toolpaths.a)

panel_8 = Panel("-1")  # disabled
mesh_intersection = MeshIntersection(MeshesA=reduce_mesh.Reduced, MeshesB=offset_surface_4)
panel_9 = Panel("-1")  # disabled
mesh_intersection_2 = MeshIntersection(MeshesA=mesh, MeshesB=offset_surface_4)
negative_3 = Negative(Value=".815")
panel_10 = Panel(negative_3)
offset_surface_5 = OffsetSurface(Surface=plane_surface_4, Distance=".815", BothSides=panel_10, CreateSolid=True)
fit_curve_smooth = FitCurveSmooth(DeviationTolerance=0.001, AngleTolerance=1)
mesh_union = MeshUnion(Meshes=flatten([offset_surface_5, mesh_intersection]))
sort_list = SortList(Keys=mesh_network_with_cocoon_for_toolpaths.a)  # -> Keys, ValuesValuesA

contour_3 = Contour(Shape=mesh_union, Point="0,0,0", Direction=rotate.Geometry, Distance=layer_height)  # -> simplify(Contours)
trim_with_brep = TrimWithBrep(Curve=contour_3, Brep=offset_surface)  # -> simplify(Inside), Outside
curve_5 = Curve(trim_with_brep.Inside)

# ----
# Build in function that uses fillet radius 0 for line-like curves
panel_11 = Panel("1")
list_item_2 = ListItem(List=sort_list.Keys, Index="-1", Wrap=True)
mesh_difference = MeshDifference(MeshesA=mesh_union, MeshesB=reduce_mesh_2.Reduced)

# ---- group: Slightly smaller surface to ensure proper Mesh Union
area_2 = Area(Geometry=surface_3)  # -> Area, Centroid
scale_4 = Scale(Geometry=surface_3, Center=area_2.Centroid, Factor="0.99")  # -> Geometry, Transform

# ----
contour_4 = Contour(Shape=mesh_union, Point=Point(0, 0, 0), Direction=Vector(0, 0, 1))
multiplication = Multiplication(A=list_item_2, B="3")
negative_4 = Negative(Value=multiplication)

colour_swatch = ColourSwatch(SwatchColor=RGBA(0, 204, 180, 89))
custom_preview_2 = CustomPreview(Geometry=mesh_difference, Material=ColourSwatch(SwatchColor=RGBA(194, 194, 194, 89)))  # disabled
custom_preview_3 = CustomPreview(Geometry=reduce_mesh_2.Reduced, Material=ColourSwatch(SwatchColor=RGBA(204, 99, 0, 131)))  # disabled

brep_edges = BrepEdges(Brep=plane_surface_4)  # -> Naked, Interior, NonManifold
division_6 = Division(A=filament_offset_from_overlap, B="2")
subd_from_mesh = SubDFromMesh(Mesh=mesh_intersection, Creases=1, Corners=1, Interpolate=False)  # disabled
contour_5 = Contour(Shape=mesh_union, Point="0,0,0", Direction=rotate.Geometry, Distance=layer_height)  # -> simplify(Contours)
offset_surface_6 = OffsetSurface(Surface=scale_4.Geometry, Distance=multiplication, BothSides=negative_4, CreateSolid=True)
negative_5 = Negative(Value=division_6)
custom_preview_4 = CustomPreview(Geometry=brep_edges.Naked, Material=ColourSwatch(SwatchColor=RGB(0, 0, 0)))  # disabled
prune_tree = PruneTree(Tree=curve_5, Minimum="1", Maximum=0)
curve_6 = Curve(prune_tree)
curve_middle = CurveMiddle(Curve=curve_6)
deconstruct = Deconstruct(Point=curve_middle)  # -> XComponent, YComponent, ZComponent
sort_list_2 = SortList(Keys=deconstruct.YComponent, ValuesValuesA=curve_6)  # -> Keys, ValuesValuesA
list_item_3 = ListItem(List=sort_list_2.ValuesValuesA, Index="1", Wrap=True)
length = Length(Curve=list_item_3)
multiplication_2 = Multiplication(A="0.5", B=length)
round = Round(Number=multiplication_2)  # -> Nearest, Floor, Ceiling
divide_length = DivideLength(Curve=list_item_3, Length=panel_7)  # -> Points, Tangents, Parameters; disabled
addition_4 = Addition(A=round.Ceiling, B="1")
list_item_4 = ListItem(List=flatten(list_item_3), Index=panel_8, Wrap=True)  # disabled
divide_curve = DivideCurve(Curve=list_item_3, Count=addition_4, Kinks=False)  # -> Points, Tangents, Parameters
list_item_5 = ListItem(List=divide_curve.Points, Index=0, Wrap=True)  # disabled
panel_12 = Panel(divide_curve.Points)  # disabled
insert_items = InsertItems(List=divide_curve.Points, Item=list_item_5, Indices=panel_9, Wrap=True)  # disabled

# ---- group: Curve option 1
interpolate = Interpolate(Vertices=divide_curve.Points, Degree=3, Periodic=False, KnotStyle=1)  # -> simplify(Curve), Length, Domain

# ----
mesh_intersection_3 = MeshIntersection(MeshesA=mesh_network_with_cocoon_for_toolpaths.mesh, MeshesB=offset_surface_6)
offset_surface_7 = OffsetSurface(Surface=surface_3, Distance=division_6, BothSides=negative_5, CreateSolid=True)

# ---- group: Switch for beta positive and negative
panel_13 = Panel("1")
panel_14 = Panel("0")

# ----
mesh_union_2 = MeshUnion(Meshes=flatten([offset_surface_7, mesh_intersection_3]))

# ---- group: Notify and cancel mesh union if not successful
ghpython_script_4 = GhPythonScript(x=mesh_union_2)  # -> out, a; inputs x: list
# ---------- ghpython_script_4: Python ----------
__author__ = "lt4840"
__version__ = "2024.04.19"

import rhinoscriptsyntax as rs

if len(x)>1:
    a = ""
    print "Mesh Union did not succeed"
else:
    a = x
# ---------- end ghpython_script_4 ----------

# ----
error = Panel(ghpython_script_4.out)
negative_6 = Negative(Value="0.4")
number_slider_5 = Slider(39, range=0..100)

# ---- group: Generate toolpaths using Contour component
generate_toolpaths = GenerateToolpaths(
    shape=ghpython_script_4.a,
    toolpath_angle_beta_degrees=toolpath_angle_beta_degrees_2,
    filament_height=filament_height_2,
    brep=scale_4.Geometry,
    number=multiplication)  # -> geometry, inside
toolpaths = Curve(generate_toolpaths.inside)

# ----
number_slider_6 = Slider(30, range=0..100)
number_slider_7 = Slider(16, range=0..100)
number_slider_8 = Slider(26, range=0..100)

# ---- group: Select toolpaths of one side (lowest Y value)
select_toolpaths_on_one_side = SelectToolpathsOnOneSide(toolpathangle=toolpath_angle_beta_degrees_2, toolpaths=toolpaths)
toolpaths_of_one_side = Curve(select_toolpaths_on_one_side)

# ---- group: Rebuild toolpaths (reduce number of vertices to allow for fillet of curves)
rebuild_curves = RebuildCurves(toolpaths_of_one_side=toolpaths_of_one_side, A=precision)  # -> curve, points
rebuilt_toolpaths = Curve(rebuild_curves.curve)

# ---- group: Switch for positive and negative beta
panel_15 = Panel("1.5")

# ----
# Input
filament_width_4 = Number(filament_width)
rebuilt_toolpaths_2 = Curve(rebuilt_toolpaths)
toolpath_angle_beta_degrees_3 = Number(toolpath_angle_beta_degrees)
filament_height_3 = Number(filament_height)
toolpath_points = Point(rebuild_curves.points)

xz_plane_8 = XZPlane(Origin="0,0,0")
number_slider_9 = Slider(44, range=0..100)
unit_z = UnitZ(Factor="-3.8")
colour_swatch___original = ColourSwatch(SwatchColor=RGBA(255, 255, 255, 120))
colour_swatch___new = ColourSwatch(SwatchColor=RGBA(255, 255, 255, 30))
panel_17 = Panel("""0
-1""")
density_g_cm3 = Panel("2.2")
division_7 = Division(A=density_g_cm3, B="1000")
panel_18 = Panel("0.125")
version_20240328 = Panel("0.00003")
version_20240328_2 = Panel("0.00001")
gradient = Gradient(LowerLimit="0", UpperLimit=version_20240328, stops=[0: RGB(255, 255, 255), 0.887: RGB(220, 0, 40)])
gradient_2 = Gradient(LowerLimit="0", UpperLimit=version_20240328, stops=[0: RGB(244, 164, 96), 0.887: RGB(220, 0, 40)])

# ----
# Example 3: 3D network
number_slider_10 = Slider(10, range=0..100)
populate_geometry_3 = PopulateGeometry(Geometry=center_box, Count=number_slider_10, Seed=1)
keep_empty_for_3d_network = Panel("")

# ---- group: Points for the channel network to connect
point_16 = Point(populate_geometry_3)

# ----
entwine_12 = Entwine(Branch00=inlet_point_3, Branch01=point_16, Branch02=keep_empty_for_3d_network, Branch03=center_box, FlattenInputs=True)

# ----
# Example 3: 3D network on a non-planar surface
number_slider_11 = Slider(15, range=0..100)
curve_7 = Curve([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])
# Example 5: sample B (Fig. 6B)
loft = Loft(Curves=curve_7, Options={Adjust=False, Closed=False, LoftEnds=0, LoftSimp=0, LoftType=1, Rebuild=10, Refit=0.01})
end_points_2 = EndPoints(Curve=curve_7)  # -> Start, End
populate_geometry_4 = PopulateGeometry(Geometry=loft, Count=number_slider_11, Seed=2)
list_item_6 = ListItem(List=end_points_2.Start, Index=0, Wrap=True)
inlet_point_6 = Point(list_item_6)
# Example 4: sample A (Fig. 6A)
# Channel network type: Dichotomous branching
# Channel radius: XX with Murray's Law
keep_empty_for_2d_network_4 = Panel("")

# ---- group: Points for the channel network to connect
point_17 = Point(populate_geometry_4)

# ----
entwine_13 = Entwine(Branch00=inlet_point_6, Branch01=point_17, Branch02=loft, Branch03=keep_empty_for_2d_network_4, FlattenInputs=True)

number_slider_12 = Slider(0, range=0..100)  # disabled
tree_statistics = TreeStatistics(Tree=contour)  # -> Paths, Length, Count
panel_19 = Panel("""1
1
1
1
1
1""")
tree_branch_3 = TreeBranch(Tree=contour, Path=number_slider_12, MaintainPaths=True)  # disabled
panel_20 = Panel("""0
0
0
0
0
0""")
list_length = ListLength(List=tree_statistics.Paths)
flatten_tree = FlattenTree(Tree=contour, Path="{0}")
list_length_2 = ListLength(List=flatten_tree)

# ---- group: switch for beta positive and negative
contour_6 = Contour(Shape=mesh_intersection_2, Point="0,0,0", Direction=rotate.Geometry, Distance=layer_height)  # -> simplify(Contours)

# ----
list_item_7 = ListItem(List=contour_6, Index=0, Wrap=True)
list_length_3 = ListLength(List=contour_6)
area_3 = Area(Geometry=list_item_7)  # -> Area, flatten(Centroid)
tree_statistics_2 = TreeStatistics(Tree=contour_6)  # -> Paths, Length, Count
curve_closest_point = CurveClosestPoint(Point=area_3.Centroid, Curve=contour)  # -> Point, Parameter, Distance
list_length_4 = ListLength(List=curve_closest_point.Distance)
list_length_5 = ListLength(List=tree_statistics_2.Paths)
series = Series(Start=0, Step=1, Count=list_length_4)
sort_list_3 = SortList(Keys=curve_closest_point.Distance, ValuesValuesA=series)  # -> Keys, ValuesValuesA
list_item_8 = ListItem(List=sort_list_3.ValuesValuesA, Index=0, Wrap=True)  # -> flatten(Item)
list_length_6 = ListLength(List=list_item_8)
series_2 = Series(Start=0, Step=1, Count=list_length_6)
smaller_than = SmallerThan(FirstNumber=list_item_8, SecondNumber="1")  # -> SmallerThan, OrEqualTo
dispatch = Dispatch(List=series_2, DispatchPattern=smaller_than.SmallerThan)  # -> ListA, ListB
list_item_9 = ListItem(List=dispatch.ListB, Index=0, Wrap=True)
subtraction = Subtraction(A=list_item_9, B="1")
subtraction_2 = Subtraction(A=list_length, B=list_length_5, C=subtraction)
series_3 = Series(Start="0", Step="0", Count=subtraction_2)
series_4 = Series(Start="0", Step="0", Count=subtraction)
entwine_14 = Entwine(Branch00=series_4, Branch01=contour_6, Branch02=series_3, FlattenInputs=True)  # -> flatten(Result)
series_5 = Series(Start="1", Step="0", Count=subtraction)
series_6 = Series(Start="1", Step="0", Count=subtraction_2)
entwine_15 = Entwine(Branch00=series_5, Branch01=list_length_3, Branch02=series_6, FlattenInputs=True)  # -> flatten(Result)
number = Number(entwine_15)
partition_list = PartitionList(List=entwine_14, Size=number)  # -> simplify(Chunks)
tree_branch_4 = TreeBranch(Tree=partition_list, Path=number_slider_12, MaintainPaths=True)  # disabled
series_7 = Series(Start="0", Step="1", Count=subtraction)
addition_5 = Addition(A=subtraction, B=list_length_5)
series_8 = Series(Start=addition_5, Step="1", Count=subtraction_2)
list_item_10 = ListItem(List=flatten_tree, Index=series_7, Wrap=True)  # -> simplify(graft(Item))
list_item_11 = ListItem(List=flatten_tree, Index=series_8, Wrap=True)
tree_branch_5 = TreeBranch(Tree=contour, Path=series_8, MaintainPaths=True)
tree_branch_6 = TreeBranch(Tree=contour, Path=series_7, MaintainPaths=True)

duplicate_data = DuplicateData(Data="False", Number=subtraction, Order=True)
duplicate_data_2 = DuplicateData(Data="True", Number=list_length_5, Order=True)
duplicate_data_3 = DuplicateData(Data="False", Number=subtraction_2, Order=True)

# ---- group: switch for beta positive and negative (continued)
curve_8 = Curve(partition_list)

# ----
entwine_16 = Entwine(Branch00=duplicate_data, Branch01=duplicate_data_2, Branch02=duplicate_data_3, FlattenInputs=True)  # -> flatten(Result)
curve_9 = Curve(contour_6)
divide_curve_2 = DivideCurve(Curve=curve_9, Count="30", Kinks=False)  # -> Points, Tangents, Parameters
graft_tree = GraftTree(Tree=entwine_16, IncludeEmptyLists=True, IncludeNullItems=True)  # -> simplify(Tree)
list_item_12 = ListItem(List=divide_curve_2.Points, Index=0, Wrap=True)
insert_items_2 = InsertItems(List=divide_curve_2.Points, Item=list_item_12, Indices="-1", Wrap=True)
interpolate_2 = Interpolate(Vertices=insert_items_2, Degree=3, Periodic=False, KnotStyle=1)  # -> simplify(Curve), Length, Domain
trim_tree = TrimTree(Tree=interpolate_2.Curve, Depth=1)
curve_curve = CurveCurve(CurveA=contour, CurveB=trim_tree)  # -> Points, ParamsA, simplify(ParamsB)
trim_tree_2 = TrimTree(Tree=curve_curve.Points, Depth=1)
removeduplicatepts = RemoveDuplicatePts(Points=trim_tree_2, Tolerance=0.01)  # -> simplify(UniquePoints)
curve_closest_point_2 = CurveClosestPoint(Point=removeduplicatepts, Curve=contour)  # -> Point, Parameter, Distance
curve_curve_2 = CurveCurve(CurveA=extend_curve, CurveB=trim_tree)  # -> Points, ParamsA, simplify(ParamsB)
shatter = Shatter(Curve=interpolate_2.Curve, Parameters=curve_curve_2.ParamsB)  # -> simplify(Segments)
curve_middle_2 = CurveMiddle(Curve=shatter)
shatter_2 = Shatter(Curve=contour, Parameters=curve_closest_point_2.Parameter)
deconstruct_2 = Deconstruct(Point=curve_middle_2)  # -> XComponent, YComponent, ZComponent
curve_middle_3 = CurveMiddle(Curve=shatter_2)
sort_list_4 = SortList(Keys=deconstruct_2.YComponent, ValuesValuesA=shatter)  # -> Keys, ValuesValuesA
point_in_curves = PointInCurves(Point=simplify(curve_middle_3), Curves=trim_tree)  # -> Relationship, Index, Point
equality = Equality(FirstNumber=point_in_curves.Relationship, SecondNumber="0")  # -> Equality, Inequality
list_item_13 = ListItem(List=sort_list_4.ValuesValuesA, Index=panel_11, Wrap=True)  # -> simplify(Item)
dispatch_2 = Dispatch(List=shatter_2, DispatchPattern=equality.Equality)  # -> ListA, ListB
trim_tree_3 = TrimTree(Tree=list_item_13, Depth=1)
curve_10 = Curve(simplify(dispatch_2.ListA))
curve_11 = Curve([curve_10, tree_branch_6, tree_branch_5])
trim_with_brep_2 = TrimWithBrep(Curve=trim_tree_3, Brep=offset_surface_2)  # -> simplify(Inside), Outside
trim_tree_4 = TrimTree(Tree=trim_with_brep_2.Inside, Depth=1)

# ---- group: Switch for beta positive and negative
curve_12 = Curve([curve_11, trim_tree_4])
curve_13 = Curve([curve_10, trim_tree_4])

# ----
join_curves = JoinCurves(Curves=curve_13, Preserve=False)  # -> simplify(Curves)
fillet = Fillet(Curve=join_curves, Radius=panel_13)
divide_curve_3 = DivideCurve(Curve=fillet, Count=addition_4, Kinks=False)  # -> simplify(Points), Tangents, Parameters
prune_tree_2 = PruneTree(Tree=divide_curve_3.Points, Minimum="1", Maximum=0)  # -> simplify(Tree)

# ---- group: Curve option 2
interpolate_3 = Interpolate(Vertices=prune_tree_2, Degree=3, Periodic=False, KnotStyle=1)  # -> simplify(Curve), Length, Domain
curve_14 = Curve(fillet)

# ----
curve_15 = Curve(interpolate_3.Curve)
tree_statistics_3 = TreeStatistics(Tree=divide_curve_3.Points)  # -> Paths, Length, Count
panel_21 = Panel(tree_statistics_3.Paths)
curve_16 = Curve(curve_15)
tree_statistics_4 = TreeStatistics(Tree=curve_16)  # -> Paths, Length, Count
cull_index_5 = CullIndex(List=tree_statistics_4.Paths, Indices="0", Wrap=True)
tree_branch_7 = TreeBranch(Tree=curve_16, Path=cull_index_5, MaintainPaths=True)  # -> simplify(Branch)

tree_statistics_5 = TreeStatistics(Tree=contour_2)  # -> Paths, Length, Count
cull_index_6 = CullIndex(List=tree_statistics_5.Paths, Indices="0", Wrap=True)
tree_branch_8 = TreeBranch(Tree=contour_2, Path=cull_index_6, MaintainPaths=True)  # -> simplify(Branch)

cull_index_7 = CullIndex(List=tree_statistics_5.Paths, Indices="-1", Wrap=True)
tree_branch_9 = TreeBranch(Tree=move.Geometry, Path=cull_index_7, MaintainPaths=True)  # -> simplify(Branch)

match_tree = MatchTree(Tree=tree_branch_8, Guide=tree_branch_9)

trim_with_brep_3 = TrimWithBrep(Curve=match_tree, Brep=offset_surface)  # -> simplify(Inside), Outside
trim_with_brep_4 = TrimWithBrep(Curve=tree_branch_9, Brep=offset_surface)  # -> simplify(Inside), Outside
curve_17 = Curve(match_tree)
curve_18 = Curve(tree_branch_9)

# ---- group: Ensure curve offset results in an offset outside of the original curve
offset_curve = OffsetCurve(Curve=curve_17, Plane=rotate.Geometry, Distance=theoretical_layer_width, BothSides=0, Kinks=0, CapType=1)  # -> simplify(Offset)
length_2 = Length(Curve=offset_curve)
sort_list_5 = SortList(Keys=length_2, ValuesValuesA=offset_curve)  # -> Keys, ValuesValuesA
list_item_14 = ListItem(List=sort_list_5.ValuesValuesA, Index="-1", Wrap=True)  # -> simplify(Item)

# ----
offset_curve_2 = OffsetCurve(Curve=curve_17, Distance=division_2, Corners=1)  # disabled
fillet_2 = Fillet(Curve=curve_17, Radius="0.5")
toolpaths_2 = Curve(offset_curve_2)  # disabled

multiplication_3 = Multiplication(A=layer_height, B="2")
unit_z_2 = UnitZ(Factor=multiplication_3)
boundary_surfaces = BoundarySurfaces(Edges=curve_18)
extrude = Extrude(Base=boundary_surfaces, Direction=unit_z_2)  # -> simplify(Extrusion)

# ----
# To fix: too many points on pipe so fillet doesn't work
tree_statistics_6 = TreeStatistics(Tree=extrude)  # -> Paths, Length, Count
tree_branch_10 = TreeBranch(Tree=extrude, Path=tree_statistics_6.Paths, MaintainPaths=True)

graft_tree_2 = GraftTree(Tree=simplify(curve_17), IncludeEmptyLists=True, IncludeNullItems=True)
amplitude_2 = Amplitude(Vector=rotate.Geometry, Amplitude=layer_height)
boundary_surfaces_2 = BoundarySurfaces(Edges=[graft_tree_2, list_item_14])
extrude_2 = Extrude(Base=boundary_surfaces_2, Direction=amplitude_2)  # -> simplify(Extrusion)

trim_tree_5 = TrimTree(Tree=extrude_2, Depth=1)
tree_statistics_7 = TreeStatistics(Tree=trim_tree_5)  # -> Paths, Length, Count
tree_branch_11 = TreeBranch(Tree=trim_tree_5, Path=tree_statistics_6.Paths, MaintainPaths=True)
solid_intersection = SolidIntersection(BrepsA=graft(tree_branch_10), BrepsB=graft(tree_branch_11))
list_length_7 = ListLength(List=trim_tree_5)  # -> simplify(Length)
tree_branch_12 = TreeBranch(Tree=trim_tree_5, Path=[number_slider_7, number_slider_8], MaintainPaths=True)
tree_branch_13 = TreeBranch(Tree=extrude, Path=[number_slider_7, number_slider_8], MaintainPaths=True)
solid_intersection_2 = SolidIntersection(BrepsA=graft(tree_branch_12), BrepsB=graft(tree_branch_13))
custom_preview_5 = CustomPreview(
    Geometry=extrude_2,
    Material={diffuse=RGB(221, 160, 221), emission=RGB(66, 48, 66), shine=0.5, specular=RGB(255, 255, 255), transparency=0})  # disabled
duplicate_data_4 = DuplicateData(Number=list_length_7, Order=True)

fillet_3 = Fillet(Curve=curve_15, Radius="0")

panel_22 = Panel(fillet_3)
offset_curve_3 = OffsetCurve(Curve=fillet_3, Plane=rotate.Geometry, Distance="0.4", BothSides=negative_6, Kinks=0, CapType=0)  # -> simplify(Offset)
curve_19 = Curve(fillet_3)

explode_2 = Explode(Curve=curve_19, Recursive=True)  # -> Segments, Vertices
curve_middle_4 = CurveMiddle(Curve=explode_2.Segments)
point_18 = Point([curve_middle_4, explode_2.Vertices])
removeduplicatepts_2 = RemoveDuplicatePts(Points=point_18, Tolerance="0.4")
point_19 = Point(removeduplicatepts_2)
list_item_15 = ListItem(List=curve_19, Index=0, Wrap=True)
curve_closest_point_3 = CurveClosestPoint(Point=point_19, Curve=curve_19)  # -> Point, Parameter, Distance
curve_closest_point_4 = CurveClosestPoint(Point=point_19, Curve=list_item_15)  # -> Point, Parameter, Distance
evaluate_curve = EvaluateCurve(Curve=curve_19, Parameter=curve_closest_point_3.Parameter)  # -> Point, Tangent, Angle
line_7 = Line(StartPoint=curve_closest_point_3.Point, EndPoint=curve_closest_point_4.Point)
line_sdl = LineSDL(Start=curve_closest_point_3.Point, Direction="0,0,1", Length=1)
line_line = LineLine(LineA=line_7, LineB=line_sdl)

perp_frames = PerpFrames(Curve=curve_19, Count=addition_4, Align=True)  # -> Frames, Parameters
perp_frame = PerpFrame(Curve=curve_19, Parameter=curve_closest_point_3.Parameter)
plane_option_1 = Plane(simplify(perp_frames.Frames))
plane_option_2 = Plane(perp_frame)
plane = Plane(plane_option_1)
amplitude_3 = Amplitude(Vector=rotate.Geometry, Amplitude="0.5")

negative_7 = Negative(Value="0.4")
offset_curve_4 = OffsetCurve(Curve=fillet_3, Plane=rotate.Geometry, Distance="0.4", BothSides=negative_7, Kinks=0, CapType=0)  # -> simplify(Offset)
xz_plane_9 = XZPlane(Origin="0,-0.815,0")
unit_y = UnitY(Factor="-0.06")
unit_z_3 = UnitZ(Factor="3")

panel_23 = Panel(offset_curve_4)
tree_branch_14 = TreeBranch(Tree=offset_curve_4, Path="39;0", MaintainPaths=True)
prune_tree_3 = PruneTree(Tree=offset_curve_4, Minimum="1", Maximum=0)
curve_20 = Curve(prune_tree_3)
subtraction_3 = Subtraction(A="0.815", B="0.4")
negative_8 = Negative(Value=subtraction_3)

fillet_4 = Fillet(Curve=curve_20, Radius=panel_15)
list_item_16 = ListItem(List=fillet_4, Index="1", Wrap=True)

curve_middle_5 = CurveMiddle(Curve=fillet_4)
list_item_17 = ListItem(List=fillet_4, Index=Slider(20, range=0..100), Wrap=True)
deconstruct_3 = Deconstruct(Point=curve_middle_5)  # -> XComponent, YComponent, ZComponent
sort_list_6 = SortList(Keys=deconstruct_3.YComponent, ValuesValuesA=fillet_4)  # -> Keys, ValuesValuesA
list_item_18 = ListItem(List=sort_list_6.ValuesValuesA, Index="0", Wrap=True)
list_item_19 = ListItem(List=fillet_4, Index=0, Wrap=True)  # -> Item, Item1

list_item_20 = ListItem(List=fillet_4, Index=0, Wrap=True)  # -> Item, Item1
rectangle = Rectangle(Plane=plane, XSize="-0.815 to 0.815", YSize="-0.5 to 0.5", Radius=0)  # -> Rectangle, Length
rectangle_2 = Rectangle(Plane=plane, XSize="-0.82 to 0.82", YSize="-0.51 to 0.51", Radius=0)  # -> Rectangle, Length
fillet_5 = Fillet(Curve=rectangle.Rectangle, Radius="0.4")
fillet_6 = Fillet(Curve=rectangle_2.Rectangle, Radius="0.4")
sweep2 = Sweep2(Rail1=list_item_20.Item, Rail2=list_item_20.Item1, Sections=fillet_5, SameHeight=False)  # -> simplify(Brep)
sweep2_2 = Sweep2(Rail1=list_item_20.Item, Rail2=list_item_20.Item1, Sections=fillet_6, SameHeight=False)  # -> simplify(Brep)
cap_holes_2 = CapHoles(Brep=sweep2_2)
cap_holes_3 = CapHoles(Brep=sweep2)

loft_2 = Loft(Curves=fillet_4, Options={Adjust=False, Closed=False, LoftEnds=0, LoftSimp=0, LoftType=0, Rebuild=10, Refit=0.01})
closed = Closed(Curve=fillet_4)  # -> Closed, Periodic
panel_25 = Panel(closed.Closed)
flatten_tree_2 = FlattenTree(Tree=sweep2_2, Path="{0}")
flatten_tree_3 = FlattenTree(Tree=sweep2, Path="{0}")
panel_26 = Panel(sweep2_2)
tree_statistics_8 = TreeStatistics(Tree=cap_holes_2)  # -> Paths, Length, Count
cull_index_8 = CullIndex(List=tree_statistics_8.Paths, Indices="0", Wrap=True)
tree_branch_15 = TreeBranch(Tree=cap_holes_2, Path=cull_index_8, MaintainPaths=True)

# ----
# Generate filament geometry
curve_closest_point_5 = CurveClosestPoint(Point=toolpath_points, Curve=rebuilt_toolpaths_2)  # -> Point, Parameter, Distance
ghpython_script_5 = GhPythonScript(x=filament_width_4)  # -> out, neg, pos
# ---------- ghpython_script_5: Python ----------
__author__ = "lt4840"
__version__ = "2024.04.16"

import rhinoscriptsyntax as rs

neg = x/-2
pos = x/2
# ---------- end ghpython_script_5 ----------
ghpython_script_6 = GhPythonScript(x=filament_height_3)  # -> out, neg, pos; same code as ghpython_script_5
construct_domain = ConstructDomain(DomainStart=ghpython_script_5.neg, DomainEnd=ghpython_script_5.pos)
construct_domain_2 = ConstructDomain(DomainStart=ghpython_script_6.neg, DomainEnd=ghpython_script_6.pos)
perp_frame_2 = PerpFrame(Curve=rebuilt_toolpaths_2, Parameter=curve_closest_point_5.Parameter)

# ---- group: Make sure plane orientations are correct if toolpath angle is 90 or 180
cluster_5 = Cluster_5(toolpath_angle_beta_degrees=toolpath_angle_beta_degrees_3, plane=perp_frame_2)

# ---- group: Filament profile
filament_width_5 = Panel(construct_domain)
filament_height_4 = Panel(construct_domain_2)
rectangle_3 = Rectangle(Plane=cluster_5, XSize=filament_width_5, YSize=filament_height_4, Radius=0)  # -> Rectangle, Length
fillet_7 = Fillet(Curve=rectangle_3.Rectangle, Radius="0.4")

# ----
move_2 = Move(Geometry=list_item_18, Motion=unit_y)  # -> Geometry, Transform
mirror = Mirror(Geometry=move_2.Geometry, Plane=xz_plane_8)  # -> Geometry, Transform
end_points_3 = EndPoints(Curve=mirror.Geometry)  # -> Start, End
line_sdl_2 = LineSDL(Start=end_points_3.End, Direction="0,1,0", Length="10")
line_sdl_3 = LineSDL(Start=end_points_3.Start, Direction="0,1,0", Length="10")
join_curves_2 = JoinCurves(Curves=[mirror.Geometry, line_sdl_3, line_sdl_2], Preserve=False)  # -> simplify(Curves)
close_curve = CloseCurve(Curve=join_curves_2, CloseType=0, Bulge=0.5, Tolerance=0)  # -> Closed, ResultBoolean
trim_with_region = TrimWithRegion(Curve=move_2.Geometry, Region=close_curve.Closed)  # -> Inside, Outside
curve_21 = Curve(trim_with_region.Inside)
mirror_2 = Mirror(Geometry=curve_21, Plane=xz_plane_8)  # -> Geometry, Transform; disabled
join_curves_3 = JoinCurves(Curves=[curve_21, mirror_2.Geometry], Preserve=False)  # -> simplify(Curves); disabled
close_curve_2 = CloseCurve(Curve=join_curves_3, CloseType=0, Bulge=0.5, Tolerance=0)  # -> Closed, ResultBoolean; disabled

end_points_4 = EndPoints(Curve=curve_21)  # -> Start, End
line_sdl_4 = LineSDL(Start=end_points_4.Start, Direction="0,-1,0", Length="10")
line_sdl_5 = LineSDL(Start=end_points_4.End, Direction="0,-1,0", Length="10")
join_curves_4 = JoinCurves(Curves=[line_sdl_4, line_sdl_5, curve_21], Preserve=False)  # -> simplify(Curves)
dispatch_3 = Dispatch(List=join_curves_4, DispatchPattern=graft_tree)  # -> ListA, ListB

# ---- group: Switch for positive and negative beta
curve_22 = Curve(join_curves_4)
curve_23 = Curve(dispatch_3.ListA)

# ----
offset_curve_5 = OffsetCurve(Curve=curve_23, Plane=rotate.Geometry, Distance=negative_8, BothSides=subtraction_3, Kinks=0, CapType=0)  # -> simplify(Offset)
length_3 = Length(Curve=offset_curve_5)
sort_list_7 = SortList(Keys=length_3, ValuesValuesA=offset_curve_5)  # -> Keys, ValuesValuesA
list_item_21 = ListItem(List=sort_list_7.ValuesValuesA, Index=0, Wrap=True)  # -> simplify(Item)
trim_tree_6 = TrimTree(Tree=list_item_21, Depth=1)
close_curve_3 = CloseCurve(Curve=trim_tree_6, CloseType=0, Bulge=0.5, Tolerance=0)  # -> Closed, ResultBoolean
fillet_8 = Fillet(Curve=close_curve_3.Closed, Radius="1")

sweep1 = Sweep1(Rail=rebuilt_toolpaths_2, Sections=fillet_7, Miter=1)

cap_holes_4 = CapHoles(Brep=sweep1)

filament_geometry = Brep(simplify(cap_holes_4))

# ----
# Input
# Lower value: more accurate overhang
# geometries and volume calculation.
# Higher value: exclude small overhangs
# that are artifacts of model imperfection.
dimensions = Dimensions(Surface=surface_3)  # -> UDimension, VDimension
precision_2 = Slider(0.02, range=0..0.1)
sufficient_to_cover_widest_channel = Number(multiplication)
toolpath_angle_beta_degrees_4 = Number(toolpath_angle_beta_degrees)
filament_geometry_2 = Brep(simplify(filament_geometry))
rebuilt_toolpaths_3 = Curve(rebuilt_toolpaths)
filament_height_5 = Number(filament_height)
toolpath_plane = Plane(generate_toolpaths.geometry)
filament_width_6 = Number(filament_width)
sample_height = Number(dimensions.VDimension)

filament_geometry_3 = Brep(simplify(filament_geometry_2))

boundary_surfaces_3 = BoundarySurfaces(Edges=fillet_8)
mirror_3 = Mirror(Geometry=cap_holes_3, Plane=xz_plane_9)  # -> Geometry, Transform

extrude_3 = Extrude(Base=boundary_surfaces_3, Direction=unit_z_3)

cull_index_9 = CullIndex(List=cap_holes_2, Indices="0", Wrap=True)  # -> simplify(graft(List)); disabled
brep_3 = Brep([mirror_3.Geometry, cap_holes_3])

addition_6 = Addition(A=filament_width_6, B=precision_2)
ghpython_script_7 = GhPythonScript(x=addition_6)  # -> out, neg, pos; same code as ghpython_script_5
offset_curve_6 = OffsetCurve(
    Curve=rebuilt_toolpaths_3,
    Plane=toolpath_plane,
    Distance=ghpython_script_7.pos,
    BothSides=ghpython_script_7.neg,
    Kinks=0,
    CapType=0)  # -> simplify(Offset)
end_points_5 = EndPoints(Curve=offset_curve_6)  # -> Start, End
deconstruct_4 = Deconstruct(Point=end_points_5.Start)  # -> XComponent, YComponent, ZComponent
sort_list_8 = SortList(Keys=deconstruct_4.YComponent, ValuesValuesA=offset_curve_6)  # -> Keys, reverse(ValuesValuesA)
list_item_22 = ListItem(List=sort_list_8.ValuesValuesA, Index=0, Wrap=True)
sufficient_length = Number(sufficient_to_cover_widest_channel)
unit_z_4 = UnitZ(Factor=sample_height)

curve_24 = Curve(list_item_22)

end_points_6 = EndPoints(Curve=curve_24)  # -> Start, End
line_sdl_6 = LineSDL(Start=end_points_6.Start, Direction="0,1,0", Length=sufficient_length)
line_sdl_7 = LineSDL(Start=end_points_6.End, Direction="0,1,0", Length=sufficient_length)
join_curves_5 = JoinCurves(Curves=[line_sdl_6, line_sdl_7, curve_24], Preserve=False)
close_curve_4 = CloseCurve(Curve=join_curves_5, CloseType=0, Bulge=0.5, Tolerance=0)  # -> Closed, ResultBoolean
boundary_surfaces_4 = BoundarySurfaces(Edges=close_curve_4.Closed)
extrude_4 = Extrude(Base=boundary_surfaces_4, Direction=unit_z_4)  # -> simplify(Extrusion)
geometry_of_channel_cavity = Brep(extrude_4)

# ----
# Model overhangs
# Note: in this version, overhangs are not modeled correctly for more vertical toolpaths (e.g., approaching 90 degrees)
ghpython_script_8 = GhPythonScript(filamentHeight=filament_height_5, toolpathAngle=toolpath_angle_beta_degrees_4)  # -> out, a
# ---------- ghpython_script_8: Python ----------
__author__ = "lt4840"
__version__ = "2024.04.16"

import rhinoscriptsyntax as rs

neg = filamentHeight/-2
pos = filamentHeight/2
if toolpathAngle > 90:
    a = neg
else:
    a = pos
# ---------- end ghpython_script_8 ----------
amplitude_4 = Amplitude(Vector=toolpath_plane, Amplitude=ghpython_script_8.a)
move_3 = Move(Geometry=geometry_of_channel_cavity, Motion=amplitude_4)  # -> Geometry, Transform
filament_geometry_4 = Brep(simplify(filament_geometry_2))
tree_statistics_9 = TreeStatistics(Tree=filament_geometry_4)  # -> Paths, Length, Count
tree_statistics_10 = TreeStatistics(Tree=move_3.Geometry)  # -> Paths, Length, Count
cull_index_10 = CullIndex(List=tree_statistics_9.Paths, Indices="0", Wrap=True)
cull_index_11 = CullIndex(List=tree_statistics_10.Paths, Indices="-1", Wrap=True)
tree_branch_16 = TreeBranch(Tree=filament_geometry_4, Path=cull_index_10, MaintainPaths=True)
tree_branch_17 = TreeBranch(Tree=move_3.Geometry, Path=cull_index_11, MaintainPaths=True)
match_tree_2 = MatchTree(Tree=tree_branch_16, Guide=tree_branch_17)

# ----
# python script looks a bit messy: to clean up
max_movement = Slider(-0.01, range=-0.02..0)
toolpath_angle_beta_degrees_5 = Number(toolpath_angle_beta_degrees_4)
error_message = Panel("Overhang volume could not be generated")
cluster_6 = Cluster_6(angle=toolpath_angle_beta_degrees_5, A=max_movement, geometry=tree_branch_17)
tolerance = Panel("0.99")
ghpython_script_9 = GhPythonScript(filamentBrep=match_tree_2, unsupportedVolumeBrep=simplify(cluster_6), tolerance=tolerance, errorMessage=error_message)  # -> out, overhangBrep, overhangVolume, error, a; inputs filamentBrep: Brep, unsupportedVolumeBrep: list of Brep
# ---------- ghpython_script_9: Python ----------
__author__ = "lt4840"
__version__ = "2024.04.23"

import rhinoscriptsyntax as rs
import Rhino.Geometry as rg
import Rhino

tol = Rhino.RhinoDoc.ActiveDoc.ModelAbsoluteTolerance


overhangBrepList = []
volumeOverhangList = []
success = False

if (unsupportedVolumeBrep[0] is None) or (filamentBrep is None) or (solidUnionError=="Solid union could not be generated"): 
    error = errorMessage
else:
    volumeFilament = filamentBrep.GetVolume(tol,tol)
    volumeUnsupported = unsupportedVolumeBrep[0].GetVolume(tol,tol)
    volumeFilamentTol = volumeFilament * tolerance
    volumeUnsupportedTol = volumeUnsupported * tolerance
    for i in range(len(unsupportedVolumeBrep)):
        item = unsupportedVolumeBrep[i]
        overhangBrep = rg.Brep.CreateBooleanIntersection(filamentBrep,item,tol,True) #https://developer.rhino3d.com/api/rhinocommon/rhino.geometry.brep/createbooleanintersection?version=8.x
        print overhangBrep
        if overhangBrep is not None and len(overhangBrep)>0:
            for j in range(len(overhangBrep)):
                volumeOverhang = overhangBrep[j].GetVolume(tol,tol)
                if volumeOverhang < volumeUnsupportedTol or volumeOverhang <= volumeFilamentTol:
                    overhangBrepList.append(overhangBrep[j])
                    volumeOverhangList.append(volumeOverhang)
                    success = True
        if success:
            break
# ---------- end ghpython_script_9 ----------
overhang_geometry = Brep(ghpython_script_9.overhangBrep)
error_message_2 = Panel(ghpython_script_9.error)
filament_volume_overhang_mm3 = Number(ghpython_script_9.overhangVolume)

match_tree_3 = MatchTree(Tree=overhang_geometry, Guide=match_tree_2)

# ----
# Input
# Lower value: more precise span length.
# Higher value: faster computation
exclude_overhangs_smaller_than_mm3 = Slider(0.1, range=0.01..0.1)
span_length_precision = Slider(0.03, range=0.01..0.1)
material_density_g_cm3 = Panel("2.2")
overhang_geometry_2 = Brep(simplify(match_tree_3))
rebuilt_toolpaths_4 = Curve(rebuilt_toolpaths)

# ---- group: Add temporary item to ensure empty lists are not removed in the cluster
list_length_8 = ListLength(List=overhang_geometry_2)
center_box_2 = CenterBox(Base=PlaneXY(0, 0, 0), X=1, Y=1, Z=1)
insert_items_3 = InsertItems(List=overhang_geometry_2, Item=center_box_2, Indices=list_length_8, Wrap=False)  # -> simplify(List)

# ----
# Calculate moment M
obtain_span_curves_span_length_overhang = ObtainSpanCurvesSpanLengthOverhangVolume(
    rebuilt_toolpaths=rebuilt_toolpaths_4,
    list=insert_items_3,
    B=span_length_precision,
    second_number=exclude_overhangs_smaller_than_mm3)  # -> list_b_2, list_b, length_2, curve_2; "Obtain span curves, span length, overhang volume"
overhang_volume = Number(obtain_span_curves_span_length_overhang.list_b)
span_curves = Curve(obtain_span_curves_span_length_overhang.curve_2)
span_length = Number(obtain_span_curves_span_length_overhang.length_2)
calculate_m = CalculateM(overhang_volume_mm3=overhang_volume, span_length_mm=span_length, A=material_density_g_cm3)  # -> arithmetic_mean, number_2, result
number_2 = Number(calculate_m.arithmetic_mean)
number_3 = Number(calculate_m.number_2)
m_avg_nmm = Panel(number_2)
m_max_nmm = Panel(number_3)

span_curves_2 = Curve(span_curves)
overhang_geometry_excluding_extremely_sm = Brep(obtain_span_curves_span_length_overhang.list_b_2)  # "Overhang geometry (excluding extremely small overhangs)"

# ----
# Find optimal toolpath angle beta
toolpath_angle_beta = Number(toolpath_angle_beta_degrees)
m_avg = Number(number_2)
m_max = Number(number_3)
ghpython_script_10 = GhPythonScript(Mavg=m_avg, Mmax=m_max)  # -> out, a
# ---------- ghpython_script_10: Python ----------
__author__ = "lt4840"
__version__ = "2024.04.18"

import rhinoscriptsyntax as rs

if Mavg == 0.125 or Mmax == 0.125:
    a = "Moment could not be obtained"
# ---------- end ghpython_script_10 ----------
error_2 = Text(ghpython_script_10.a)
file_name = Panel("sample_20240418.txt")
concatenate = Concatenate(Fragment_B=toolpath_angle_beta, E=";", A=m_avg, F=";", B=m_max, G=";", I=error_2)
folder = Panel("C:\Users\lt4840\OneDrive - Princeton University\Desktop\")
data_recorder = DataRecorder(concatenate, DataLimit=-10, RecordData=False)
panel_27 = Panel(data_recorder)
write_to_text_file = BooleanToggle(False)
concatenate_2 = Concatenate(FragmentA=folder, FragmentB=file_name)
write_to_text_file_2 = WriteToTextFile(Run=write_to_text_file, TextToWrite=flatten(data_recorder), FilePath=concatenate_2, Append=False, NewOnly=False)
panel_28 = Panel(write_to_text_file_2)

move_4 = Move(Geometry=extrude_3, Motion=amplitude_3)  # -> Geometry, Transform

tree_statistics_11 = TreeStatistics(Tree=move_4.Geometry)  # -> Paths, Length, Count
cull_index_12 = CullIndex(List=tree_statistics_11.Paths, Indices="-1", Wrap=True)
tree_branch_18 = TreeBranch(Tree=move_4.Geometry, Path=cull_index_12, MaintainPaths=True)
match_tree_4 = MatchTree(Tree=tree_branch_15, Guide=tree_branch_18)

list_length_9 = ListLength(List=tree_branch_18)

duplicate_data_5 = DuplicateData(Data=match_tree_4, Number=list_length_9, Order=True)  # -> simplify(Data)
solid_intersection_3 = SolidIntersection(BrepsA=graft(duplicate_data_5), BrepsB=graft(tree_branch_18))
mirror_4 = Mirror(Geometry=solid_intersection_3, Plane=xz_plane_9)  # -> Geometry, Transform
brep_4 = Brep([solid_intersection_3, mirror_4.Geometry])

trim_tree_7 = TrimTree(Tree=solid_intersection_3, Depth=1)  # -> simplify(Tree)
tree_branch_19 = TreeBranch(Tree=simplify(trim_tree_7), Path=number_slider_9, MaintainPaths=True)  # disabled
tree_branch_20 = TreeBranch(Tree=tree_branch_18, Path=number_slider_9, MaintainPaths=True)  # disabled
tree_branch_21 = TreeBranch(Tree=match_tree_4, Path=number_slider_9, MaintainPaths=True)  # disabled

move_5 = Move(Geometry=brep_3, Motion=unit_z)  # -> Geometry, Transform
brep_5 = Brep(move_5.Geometry)

custom_preview_6 = CustomPreview(Geometry=brep_5, Material=colour_swatch___new)  # disabled

# ---- group: switch for beta positve or negative
trim_tree_8 = TrimTree(Tree=solid_intersection_3, Depth=1)

# ----
tree_statistics_12 = TreeStatistics(Tree=trim_tree_8)  # -> Paths, Length, Count
cull_index_13 = CullIndex(List=tree_statistics_12.Paths, Indices="-1", Wrap=True)

# ---- group: switch for beta positve or negative (continued)
tree_branch_22 = TreeBranch(Tree=trim_tree_8, Path=cull_index_13, MaintainPaths=True)  # -> simplify(Branch)

# ----
brep_6 = Brep(tree_branch_22)
list_length_10 = ListLength(List=brep_6)
match_tree_5 = MatchTree(Tree=tree_branch_7, Guide=brep_6)
duplicate_data_6 = DuplicateData(Data=match_tree_5, Number=list_length_10, Order=True)  # -> simplify(Data)
graft_tree_3 = GraftTree(Tree=brep_6, IncludeEmptyLists=True, IncludeNullItems=True)
graft_tree_4 = GraftTree(Tree=duplicate_data_6, IncludeEmptyLists=True, IncludeNullItems=True)
populate_geometry_5 = PopulateGeometry(Geometry=graft_tree_3, Count=Slider(50, range=0..100), Seed=1)  # -> simplify(Population)
curve_closest_point_6 = CurveClosestPoint(Point=populate_geometry_5, Curve=graft_tree_4)  # -> Point, Parameter, Distance
sort_along_curve = SortAlongCurve(Points=curve_closest_point_6.Point, Curve=graft_tree_4)  # -> simplify(Points), Indices
list_item_23 = ListItem(List=sort_along_curve.Points, Index=panel_17, Wrap=True)
curve_closest_point_7 = CurveClosestPoint(Point=list_item_23, Curve=graft_tree_4)  # -> Point, Parameter, Distance
volume = Volume(Geometry=graft_tree_3)  # -> Volume, Centroid
shatter_3 = Shatter(Curve=graft_tree_4, Parameters=curve_closest_point_7.Parameter)  # -> simplify(Segments)
curve_middle_6 = CurveMiddle(Curve=shatter_3)
closest_point_3 = ClosestPoint(Point=volume.Centroid, Cloud=curve_middle_6)  # -> ClosestPoint, CPIndex, Distance
list_item_24 = ListItem(List=shatter_3, Index=closest_point_3.CPIndex, Wrap=True)

tree_statistics_13 = TreeStatistics(Tree=graft_tree_3)  # -> Paths, Length, Count
list_item_25 = ListItem(List=tree_statistics_13.Paths, Index=Slider(51, range=0..100), Wrap=True)
panel_29 = Panel(list_item_25)
tree_branch_23 = TreeBranch(Tree=graft_tree_3, Path=list_item_25, MaintainPaths=True)
tree_branch_24 = TreeBranch(Tree=list_item_24, Path=list_item_25, MaintainPaths=True)

length_4 = Length(Curve=list_item_24)

density_g_mm3 = Panel(division_7)
gravitational_acceleration_m_s2 = Panel("9.81")
overhang_volume_mm3 = Number(volume.Volume)
span_length_mm = Number(length_4)

# ---- group: Remove empty branches
list_length_11 = ListLength(List=overhang_volume_mm3)
list_length_12 = ListLength(List=overhang_volume_mm3)
smaller_than_2 = SmallerThan(FirstNumber=list_length_12, SecondNumber="1")  # -> SmallerThan, OrEqualTo
smaller_than_3 = SmallerThan(FirstNumber=list_length_11, SecondNumber="1")  # -> SmallerThan, OrEqualTo
tree_statistics_14 = TreeStatistics(Tree=overhang_volume_mm3)  # -> flatten(Paths), Length, Count
gate_or = GateOr(A=smaller_than_2.SmallerThan, B=smaller_than_3.SmallerThan)  # -> flatten(Result)
dispatch_4 = Dispatch(List=tree_statistics_14.Paths, DispatchPattern=gate_or)  # -> ListA, ListB
tree_branch_25 = TreeBranch(Tree=overhang_volume_mm3, Path=dispatch_4.ListB, MaintainPaths=True)
tree_branch_26 = TreeBranch(Tree=span_length_mm, Path=dispatch_4.ListB, MaintainPaths=True)

# ----
multiplication_4 = Multiplication(A=tree_branch_25, B=density_g_mm3)
total_weight_g = Panel(multiplication_4)
division_8 = Division(A=multiplication_4, B="1000")
tree_branch_27 = TreeBranch(Tree=graft_tree_3, Path=dispatch_4.ListB, MaintainPaths=True)
mirror_5 = Mirror(Geometry=tree_branch_27, Plane=xz_plane_9)  # -> Geometry, Transform
multiplication_5 = Multiplication(A=division_8, B=gravitational_acceleration_m_s2)
total_weight_kg = Panel(division_8)
brep_7 = Brep([tree_branch_27, mirror_5.Geometry])

move_6 = Move(Geometry=brep_7, Motion=unit_z)  # -> Geometry, Transform

division_9 = Division(A=multiplication_5, B=tree_branch_26)
N = Panel(multiplication_5)
square = Square(Value=tree_branch_26)
w_n_mm = Panel(division_9)
multiplication_6 = Multiplication(A=panel_18, B=division_9, C=square)
average = Average(Input=flatten(multiplication_6))
m_nmm = Panel(multiplication_6)
sort_list_9 = SortList(Keys=flatten(multiplication_6))  # -> Keys, ValuesValuesA
list_item_26 = ListItem(List=sort_list_9.Keys, Index="-1", Wrap=True)
# f-60: M_avg = , M_max =
# f-50: M_avg = 0.0000070, M_max = 0.000134 (all filaments modeled, looks good)
# f-47: M_avg = 0.0000220, M_max = 0.000146 (all filaments modeled, looks good)
# f-45: didn't model
# f-42: didn't model
# f-41: didn't model
# f-40: M_avg = 0.0000054, M_max = 0.000039 (all filaments modeled, looks good)
# f-37: M_avg = 0.0000054, M_max = 0.000053 (all filaments modeled, looks good)
# f-35: M_avg = 0.0000057, M_max = 0.000041 (all filaments modeled, looks good)
# f-30: M_avg = 0.0000061, M_max = 0.000053 (all filaments modeled, looks good)
# f0  : M_avg = 0.0000019, M_max = 0.000209 (all filaments modeled, looks good)
# f25 : didn't model
# f26 : M_avg = 0.000067,  M_max = 0.001553 (all filaments modeled, looks good)
# f28 : M_avg = 0.000061,  M_max = 0.00123 (all filaments modeled, looks good)
# f30 : M_avg = 0.000069,  M_max = 0.001056 (one filament missing)
# f35 : results incorrect
# f40 : M_avg = 0.000057,  M_max = 0.000712 (one filament missing)
# f45 : M_avg = 0.000061,  M_max = 0.00065 (all filaments modeled, looks good, BAKED)
# f50 : M_avg = 0.000065,  M_max = 0.000449 (all filaments modeled, looks good)
m_avg_nmm_2 = Panel(average)
m_max_nmm_2 = Panel(list_item_26)
gradient_3 = Gradient(
    LowerLimit="0",
    UpperLimit=version_20240328,
    Parameter=multiplication_6,
    stops=[0: RGB(0, 128, 0), 0.499: RGB(255, 255, 0), 1: RGB(255, 0, 0)])
gradient_4 = Gradient(
    LowerLimit="0",
    UpperLimit=version_20240328_2,
    Parameter=multiplication_6,
    stops=[0: RGB(0, 128, 0), 0.499: RGB(255, 255, 0), 1: RGB(255, 0, 0)])
custom_preview_7 = CustomPreview(Geometry=move_6.Geometry, Material=gradient_3)  # disabled

# ----
# Visualize filament, overhang, span curves
overhang_geometry_3 = Brep(simplify(overhang_geometry_excluding_extremely_sm))
toolpath_angle_beta_degrees_6 = Number(toolpath_angle_beta_degrees)
filament_geometry_5 = Brep(simplify(filament_geometry_3))
span_curves_3 = Curve(span_curves_2)
text_location = Panel("-15,-15,27")
xz_plane_10 = XZPlane(Origin=Point(0, 0, 0))
concatenate_3 = Concatenate(Fragment_A="Toolpath angle: ", Fragment_B=toolpath_angle_beta_degrees_6, A=" degrees")
gradient_5 = Gradient(
    LowerLimit="0",
    UpperLimit=Slider(3e-05, range=0..0.0001),
    Parameter=calculate_m.result,
    stops=[0: RGB(0, 128, 0), 0.499: RGB(255, 255, 0), 1: RGB(255, 0, 0)])
mirror_6 = Mirror(Geometry=filament_geometry_5, Plane=xz_plane_10)  # -> Geometry, Transform
mirror_7 = Mirror(Geometry=span_curves_3, Plane=xz_plane_10)  # -> Geometry, Transform
xz_plane_11 = XZPlane(Origin=text_location)
custom_preview_8 = CustomPreview(Geometry=[filament_geometry_5, mirror_6.Geometry], Material=ColourSwatch(SwatchColor=RGBA(255, 255, 255, 20)))
text_tag_3d = TextTag3D(Location=xz_plane_11, Text=concatenate_3, Size=1, Colour=ColourSwatch(SwatchColor=RGB(0, 0, 0)), Justification=1)
custom_preview_9 = CustomPreview(Geometry=[span_curves_3, mirror_7.Geometry], Material=ColourSwatch(SwatchColor=RGB(0, 0, 0)))

# ---- group: Ensure the data tree paths for Overhang geometry and M values are the same
prune_tree_4 = PruneTree(Tree=overhang_geometry_3, Minimum="1", Maximum=0)

# ----
overhang_geometry_4 = Brep(simplify(prune_tree_4))
mirror_8 = Mirror(Geometry=overhang_geometry_4, Plane=xz_plane_10)  # -> Geometry, Transform
custom_preview_10 = CustomPreview(Geometry=[mirror_8.Geometry, overhang_geometry_4], Material=gradient_5)

# ----
# x-axis: toolpath angle, beta
# y-axis: M_avg
# x-axis: toolpath angle, beta
# y-axis: M_max
file_name_2 = Panel("sample_20240418.txt")
concatenate_4 = Concatenate(FragmentA=folder, FragmentB=file_name_2)
read_file = ReadFile(File=concatenate_4, PerLineParse=True)
text_split = TextSplit(Text=read_file, Separators=";")  # -> simplify(Result)
index_m_max = Panel("2")
index_toolpath_angle_beta = Panel("0")
index_m_avg = Panel("1")

# ---- group: Remove erroneous results
index_error = Panel("3")
list_item_27 = ListItem(List=text_split, Index=index_error, Wrap=True)  # -> flatten(Item)
ghpython_script_11 = GhPythonScript(x=list_item_27)  # -> out, branches; inputs x: list
# ---------- ghpython_script_11: Python ----------
__author__ = "lt4840"
__version__ = "2024.04.18"

import rhinoscriptsyntax as rs

branches = []

for i in range(len(x)):
    print i
    print "x[i] is", x[i]
    if x[i] == "":
        print "hello"
        branches.append(i)
# ---------- end ghpython_script_11 ----------
tree_branch_28 = TreeBranch(Tree=text_split, Path=ghpython_script_11.branches, MaintainPaths=True)

# ----
list_item_28 = ListItem(List=tree_branch_28, Index=index_m_avg, Wrap=True)  # -> flatten(Item)
list_item_29 = ListItem(List=tree_branch_28, Index=index_toolpath_angle_beta, Wrap=True)  # -> flatten(Item)
list_item_30 = ListItem(List=tree_branch_28, Index=index_m_max, Wrap=True)  # -> flatten(Item)
sort_list_10 = SortList(Keys=list_item_28, ValuesValuesA=list_item_29)  # -> Keys, ValuesValuesA
sort_list_11 = SortList(Keys=list_item_30, ValuesValuesA=list_item_29)  # -> Keys, ValuesValuesA
list_item_31 = ListItem(List=sort_list_10.ValuesValuesA, Index=0, Wrap=True)
list_item_32 = ListItem(List=sort_list_11.ValuesValuesA, Index=0, Wrap=True)
quick_graph = QuickGraph(list_item_28, SortOrder=0)
toolpath_angle_beta_with_smallest_m_avg = Panel(list_item_31)
toolpath_angle_beta_with_smallest_m_max = Panel(list_item_32)
quick_graph_2 = QuickGraph(list_item_30, SortOrder=0)

# ----
# Complete toolpaths for printing
rebuilt_toolpaths_5 = Curve(rebuilt_toolpaths)
mirror_9 = Mirror(Geometry=rebuilt_toolpaths_5, Plane=xz_plane_10)  # -> Geometry, Transform
flip_curve = FlipCurve(Curve=rebuilt_toolpaths_5)  # -> Curve, Flag
toolpath_fillet_radius = Slider(0.7, range=0..2)
connect_curves = ConnectCurves(Curves=[mirror_9.Geometry, flip_curve.Curve], Continuity=0, Close=False, Bulge=1)
fillet_9 = Fillet(Curve=connect_curves, Radius=toolpath_fillet_radius)  # -> flatten(Curve)
null_item = NullItem(Item=fillet_9)  # -> NullFlags, InvalidFlags, Description
dispatch_5 = Dispatch(List=fillet_9, DispatchPattern=null_item.NullFlags)  # -> ListA, ListB

# ---- group: Move onto built plate (z = 0)
end_points_7 = EndPoints(Curve=dispatch_5.ListB)  # -> Start, End
list_item_33 = ListItem(List=end_points_7.Start, Index=0, Wrap=True)
deconstruct_5 = Deconstruct(Point=list_item_33)  # -> XComponent, YComponent, ZComponent
negative_9 = Negative(Value=deconstruct_5.ZComponent)
unit_z_5 = UnitZ(Factor=negative_9)
move_7 = Move(Geometry=dispatch_5.ListB, Motion=unit_z_5)  # -> Geometry, Transform

# ----
custom_preview_11 = CustomPreview(Geometry=move_7.Geometry, Material=ColourSwatch(SwatchColor=RGB(0, 0, 0)))

# ----
# Input
area_4 = Area(Geometry=surface_2)  # -> Area, Centroid
project = Project(Geometry=area_4.Centroid, Plane=PlaneXY(0, 0, 0))  # -> Geometry, Transform
move_nozzle_out_of_the_way_before_move_t = Panel("0,30,0")  # "Move nozzle out of the way before move to origin"
angle_tolerance_curves = Slider(0.05, range=0..1)
model_on_bed_angle = Slider(0, range=-360..360)
print_coarseness = Slider(0.3, range=0..1)
skirt_radius_1 = Slider(45, range=0..100)
skirt_radius_2 = Slider(25, range=0..100)
filament_offset_from_overlap_2 = Number(ghpython_script_2.filamentOffset)
filament_curves_start_at_z_0 = Curve(move_7.Geometry)
extrusion_constant_2 = Number(ghpython_script_2.EC)
high_speed = Panel(" F2000")
nozzle_diameter_2 = Number(nozzle_diameter_mm)
speed = Panel("750")
model_center = Point(project.Geometry)
overlap_3 = Number(overlap_2)

# ----
# Generate Gcode
cluster_7 = Cluster_4(
    number_3=print_coarseness,
    integer=speed,
    text=high_speed,
    fragment_b=nozzle_diameter_2,
    fragment_b_2=overlap_3,
    number=extrusion_constant_2,
    number_2=model_on_bed_angle,
    tolerance_angle=angle_tolerance_curves,
    model_center=model_center,
    geometry=filament_curves_start_at_z_0,
    A=filament_offset_from_overlap_2,
    radius_1=skirt_radius_1,
    radius_2=skirt_radius_2,
    motion=move_nozzle_out_of_the_way_before_move_t)  # -> result, curves, rectangle

filament_path = Curve(cluster_7.curves)
print_bed = Curve(cluster_7.rectangle)
gcode = Text(cluster_7.result)

# ----
# Note: move slider to visualize
# nozzle position during print
number_slider_13 = Slider(0.2503, range=0..1)
evaluate_length = EvaluateLength(Curve=filament_path, Length=number_slider_13, Normalized=True)  # -> Point, Tangent, Parameter
custom_preview_12 = CustomPreview(Geometry=evaluate_length.Point, Material=ColourSwatch(SwatchColor=RGB(0, 0, 0)))

mm3_ml_conversion_factor = Panel("0.001")
length_5 = Length(Curve=filament_path)
multiplication_7 = Multiplication(A=channel_inner_radius, B=filament_width, C=length_5, D=mm3_ml_conversion_factor)
cement_volume_ml = Panel(multiplication_7)

complete_gcode = Panel(gcode)

# ==== cluster Cluster
curve = ClusterInput()
radius = ClusterInput()
charge_strengths = ClusterInput()
execute = ClusterInput()
curve_2 = Curve(curve)
curve_charge = CurveCharge(Curve=curve, Radius=radius, ChargeStrengths=charge_strengths)
curve_middle = CurveMiddle(Curve=curve_2)
curve_closest_point = CurveClosestPoint(Point=curve_middle, Curve=curve_2)  # -> Point, Parameter, Distance
cocoon = Cocoon(Charges=curve_charge, Iso=Slider(0.15, range=0..10), CellSize=Slider(0.4, range=0..10), Execute=execute, Simple=False)  # -> Mesh, RefinementData
perp_frame = PerpFrame(Curve=curve_2, Parameter=curve_closest_point.Parameter)
quicksmooth = QuickSmooth(Mesh=cocoon.Mesh, Step=0.5, Iterations=Slider(10, range=0..10))
mesh_plane = MeshPlane(Mesh=quicksmooth, Plane=perp_frame)
mesh = ClusterOutput(quicksmooth)
area = Area(Geometry=mesh_plane)  # -> Area, Centroid
distance = Distance(PointA=simplify(area.Centroid), PointB=simplify(graft(curve_middle)))
sort_list = SortList(Keys=distance, ValuesValuesA=mesh_plane)  # -> Keys, ValuesValuesA
list_item = ListItem(List=sort_list.ValuesValuesA, Index=0, Wrap=True)
area_2 = Area(Geometry=list_item)  # -> Area, Centroid
pi = Pi(Factor=1)
division = Division(A=area_2.Area, B=pi)
square_root = SquareRoot(Value=division)
list_length = ListLength(List=quicksmooth)
ghpython_script = GhPythonScript(x=list_length, y=square_root)  # -> out, a
# ---------- ghpython_script: Python ----------
__author__ = "lt4840"
__version__ = "2024.04.12"

import rhinoscriptsyntax as rs

if x>0:
    a = y
else:
    a = []
# ---------- end ghpython_script ----------
a = ClusterOutput(ghpython_script.a)

# ==== cluster _2DAnd3DBranchingWithProximity3D
x = ClusterInput()
group = ClusterInput()
inlet_point = ClusterInput()
point = ClusterInput()
inlet_point_2 = Point(inlet_point)
point_2 = Point(point)
ghpython_script = GhPythonScript(x=x, y=group)  # -> out, a
# ---------- ghpython_script: Python ----------
__author__ = "lt4840"
__version__ = "2024.04.15"

import rhinoscriptsyntax as rs

if x:
    a = y
else:
    a = ""
# ---------- end ghpython_script ----------
proximity_3d = Proximity3D(Points=point_2, Group=group)  # -> flatten(Links), Topology
closest_point = ClosestPoint(Point=inlet_point_2, Cloud=point_2)  # -> ClosestPoint, CPIndex, Distance
_2d_and_3d_interconnected_no_intersectin = _2DAnd3DInterconnectedNoIntersectingCurves(points_2=point_2, group=ghpython_script.a)  # "2D and 3D Interconnected (no intersecting curves)"
removeduplicatelines = RemoveDuplicateLines(Lines=proximity_3d.Links, Tolerance=0.01)
line = Line(StartPoint=inlet_point_2, EndPoint=closest_point.ClosestPoint)
line_2 = Line(StartPoint=inlet_point_2, EndPoint=point_2)
shortest_walk = ShortestWalk(Curves=flatten([_2d_and_3d_interconnected_no_intersectin, line]), WantedPath=line_2)  # -> flatten(ShortestWalk), Succession, Direction, Length
explode = Explode(Curve=shortest_walk.ShortestWalk, Recursive=True)  # -> flatten(Segments), Vertices
removeduplicatelines_2 = RemoveDuplicateLines(Lines=explode.Segments, Tolerance=0.01)
unique_lines = ClusterOutput(removeduplicatelines_2)

# ==== cluster _2DVoronoi
x = ClusterInput()
surface = ClusterInput()
y = ClusterInput()
ghpython_script = GhPythonScript(x=x, y=y)  # -> out, a; same code as ghpython_script
surface_2 = Surface(surface)
voronoi = Voronoi(Points=ghpython_script.a, Boundary=surface_2, BruteForceOverride=False)
explode = Explode(Curve=voronoi, Recursive=True)  # -> flatten(Segments), Vertices
removeduplicatelines = RemoveDuplicateLines(Lines=explode.Segments, Tolerance=0.01)
brep_edges = BrepEdges(Brep=surface_2)  # -> Naked, Interior, NonManifold
curve_middle = CurveMiddle(Curve=removeduplicatelines)
join_curves = JoinCurves(Curves=brep_edges.Naked, Preserve=False)
curve_closest_point = CurveClosestPoint(Point=curve_middle, Curve=join_curves)  # -> Point, Parameter, Distance
tolerance = Panel("0.001")
smaller_than = SmallerThan(FirstNumber=curve_closest_point.Distance, SecondNumber=tolerance)  # -> SmallerThan, OrEqualTo
dispatch = Dispatch(List=removeduplicatelines, DispatchPattern=smaller_than.SmallerThan)  # -> ListA, ListB
entwine = Entwine(Branch00=removeduplicatelines, Branch01=dispatch.ListB, FlattenInputs=True)  # -> simplify(Result)
path = ClusterInput()
tree_branch = TreeBranch(Tree=entwine, Path=path, MaintainPaths=True)
branch = ClusterOutput(tree_branch)

# ==== cluster _3DVoronoi
box = ClusterInput()
x = ClusterInput()
y = ClusterInput()
box_2 = Box(box)
ghpython_script = GhPythonScript(x=x, y=y)  # -> out, flatten(a)
# ---------- ghpython_script: Python ----------
__author__ = "lt4840"
__version__ = "2024.04.15"

import rhinoscriptsyntax as rs

if x:
    a = y
else:
    a = []
# ---------- end ghpython_script ----------
voronoi_3d = Voronoi3D(Points=ghpython_script.a, Box=box_2)  # -> Cells, Boundary
brep_edges = BrepEdges(Brep=voronoi_3d.Cells)  # -> Naked, flatten(Interior), NonManifold
removeduplicatelines = RemoveDuplicateLines(Lines=brep_edges.Interior, Tolerance=0.01)
curve_middle = CurveMiddle(Curve=removeduplicatelines)
tolerance = Panel("0.001")
brep_closest_point = BrepClosestPoint(Point=curve_middle, Brep=box_2)  # -> Point, Normal, Distance
smaller_than = SmallerThan(FirstNumber=brep_closest_point.Distance, SecondNumber=tolerance)  # -> SmallerThan, OrEqualTo
dispatch = Dispatch(List=removeduplicatelines, DispatchPattern=smaller_than.SmallerThan)  # -> ListA, ListB
entwine = Entwine(Branch00=removeduplicatelines, Branch01=dispatch.ListB, FlattenInputs=True)  # -> simplify(Result)
path = ClusterInput()
tree_branch = TreeBranch(Tree=entwine, Path=path, MaintainPaths=True)
branch = ClusterOutput(tree_branch)

# ==== cluster _2DAnd3DInterconnectedNoIntersectingCurves_2
x = ClusterInput()
points = ClusterInput()
points_2 = ClusterInput()
y = ClusterInput()
ghpython_script = GhPythonScript(x=x, y=y)  # -> out, a; same code as ghpython_script
proximity_3d = Proximity3D(Points=flatten([points_2, points]), Group=ghpython_script.a)  # -> flatten(Links), Topology
removeduplicatelines = RemoveDuplicateLines(Lines=proximity_3d.Links, Tolerance=0.01)
cross_reference = CrossReference(ListListA=removeduplicatelines, ListListB=removeduplicatelines, CrossMode=5)  # -> ListListA, ListListB
curve_curve = CurveCurve(CurveA=cross_reference.ListListA, CurveB=cross_reference.ListListB)  # -> Points, ParamsA, ParamsB
graft_tree = GraftTree(Tree=removeduplicatelines, IncludeEmptyLists=True, IncludeNullItems=True)
equality = Equality(FirstNumber=curve_curve.ParamsA, SecondNumber="0")  # -> Equality, Inequality
equality_2 = Equality(FirstNumber=curve_curve.ParamsA, SecondNumber="1")  # -> Equality, Inequality
gate_or = GateOr(A=equality.Equality, B=equality_2.Equality)
dispatch = Dispatch(List=curve_curve.Points, DispatchPattern=gate_or)  # -> ListA, ListB
tolerance = Panel("0.001")
flatten_tree = FlattenTree(Tree=dispatch.ListB, Path="{0}")
curve_closest_point = CurveClosestPoint(Point=flatten_tree, Curve=graft_tree)  # -> Point, Parameter, Distance
smaller_than = SmallerThan(FirstNumber=curve_closest_point.Distance, SecondNumber=tolerance)  # -> SmallerThan, OrEqualTo
mass_addition = MassAddition(Input=smaller_than.SmallerThan)  # -> Result, PartialResults
dispatch_2 = Dispatch(List=graft_tree, DispatchPattern=mass_addition.Result)  # -> ListA, ListB

# ----
# Group curves by shared intersection point and only keep the shortest curve in that group.
curve = Curve(flatten(dispatch_2.ListA))
curve_closest_point_2 = CurveClosestPoint(Point=graft(flatten_tree), Curve=curve)  # -> Point, Parameter, Distance
tolerance_2 = Panel("0.001")
list_length = ListLength(List=curve)
smaller_than_2 = SmallerThan(FirstNumber=curve_closest_point_2.Distance, SecondNumber=tolerance_2)  # -> SmallerThan, OrEqualTo
series = Series(Start=0, Step=1, Count=list_length)
dispatch_3 = Dispatch(List=curve, DispatchPattern=smaller_than_2.SmallerThan)  # -> ListA, ListB
dispatch_4 = Dispatch(List=series, DispatchPattern=smaller_than_2.SmallerThan)  # -> ListA, ListB
length = Length(Curve=dispatch_3.ListA)
sort_list = SortList(Keys=length, ValuesValuesA=dispatch_4.ListA)  # -> Keys, ValuesValuesA
cull_index = CullIndex(List=sort_list.ValuesValuesA, Indices="0", Wrap=True)  # -> flatten(List)
sort_list_2 = SortList(Keys=cull_index)  # -> Keys, ValuesValuesA
delete_consecutive = DeleteConsecutive(Set=sort_list_2.Keys, Wrap=False)  # -> Set, Count
cull_index_2 = CullIndex(List=series, Indices=delete_consecutive.Set, Wrap=True)
list_item = ListItem(List=curve, Index=cull_index_2, Wrap=True)
curve_2 = Curve(flatten(list_item))

curve_3 = Curve(flatten(dispatch_2.ListB))
curve_4 = Curve([curve_2, curve_3])
curve_5 = ClusterOutput(curve_4)

# ==== cluster ApplyMurraysLawBranchingNetworks
network_curves_unique_lines = ClusterInput()
number = ClusterInput()
network_curves_unique_lines_2 = Curve(network_curves_unique_lines)
number_2 = Number(number)
end_points = EndPoints(Curve=network_curves_unique_lines_2)  # -> Start, End
list_length = ListLength(List=network_curves_unique_lines_2)
point = Point([end_points.Start, end_points.End])
series = Series(Start=0, Step=1, Count=list_length)
removeduplicatepts = RemoveDuplicatePts(Points=point, Tolerance=0.01)
member_index = MemberIndex(Set=point, Member=removeduplicatepts)  # -> Index, Count
equality = Equality(FirstNumber=member_index.Count, SecondNumber="1")  # -> Equality, Inequality
inlet_point = ClusterInput()
inlet_point_2 = Point(inlet_point)
dispatch = Dispatch(List=removeduplicatepts, DispatchPattern=equality.Equality)  # -> ListA, ListB
member_index_2 = MemberIndex(Set=removeduplicatepts, Member=inlet_point_2)  # -> Index, Count
member_index_3 = MemberIndex(Set=dispatch.ListA, Member=inlet_point_2)  # -> Index, Count
cull_index = CullIndex(List=dispatch.ListA, Indices=member_index_3.Index, Wrap=True)
cull_index_2 = CullIndex(List=removeduplicatepts, Indices=member_index_2.Index, Wrap=True)
end_points_of_network = Point(cull_index)
line = Line(StartPoint=cull_index_2, EndPoint=inlet_point_2)
line_2 = Line(StartPoint=end_points_of_network, EndPoint=inlet_point_2)
shortest_walk = ShortestWalk(Curves=network_curves_unique_lines_2, WantedPath=line)  # -> ShortestWalk, Succession, Direction, Length
text = Text(flatten(shortest_walk.Succession))
text_2 = Text(series)
member_index_4 = MemberIndex(Set=text, Member=graft(text_2))  # -> Index, flatten(Count)
sort_list = SortList(Keys=member_index_4.Count, ValuesCurves=network_curves_unique_lines_2)  # -> Walks, ValuesCurves
shortest_walk_2 = ShortestWalk(Curves=sort_list.ValuesCurves, WantedPath=line_2)  # -> ShortestWalk, simplify(Succession), Direction, Length
curves_sorted = Panel(sort_list.ValuesCurves)
walks_sorted = Panel(sort_list.Walks)
end_points_2 = EndPoints(Curve=sort_list.ValuesCurves)  # -> Start, End
entwine = Entwine(Branch00=end_points_2.Start, Branch01=end_points_2.End, FlattenInputs=True)
flip_matrix = FlipMatrix(Data=entwine)  # -> simplify(Data)

# ---- group: Node closest to the network end points
list_length_2 = ListLength(List=sort_list.Walks)
series_2 = Series(Start=0, Step=1, Count=list_length_2)
ghpython_script = GhPythonScript(x=shortest_walk_2.Succession, y=series_2)  # -> out, a; inputs x: tree, y: list
# ---------- ghpython_script: Python ----------
__author__ = "lt4840"
__version__ = "2024.04.12"

import rhinoscriptsyntax as rs

a = []

for i in range(len(y)):
    curveIndex = int(y[i])
    print curveIndex
    for i in range(x.BranchCount):
        branchList = x.Branch(i)
        branchPath = x.Path(i)
        if curveIndex in branchList:
            b = str(branchPath)
            c = b.replace("{","").replace("}","")
            d = int(c)
            a.append(d)
            break
# ---------- end ghpython_script ----------
list_item = ListItem(List=shortest_walk_2.ShortestWalk, Index=ghpython_script.a, Wrap=True)
sort_along_curve = SortAlongCurve(Points=flip_matrix, Curve=simplify(graft(list_item)))  # -> Points, Indices
list_item_2 = ListItem(List=sort_along_curve.Points, Index="0", Wrap=True)  # -> flatten(Item)

# ----
curves_node_points_sorted = Panel(list_item_2)
cube = Cube(Value=number_2)
ghpython_script_2 = GhPythonScript(nodePerCurve=list_item_2, allNodes=flip_matrix, walkCount=sort_list.Walks)  # -> out, radiusCount; inputs nodePerCurve: list of Point3d, allNodes: tree of Point3d, walkCount: list
# ---------- ghpython_script_2: Python ----------
__author__ = "lt4840"
__version__ = "2024.04.12"

import rhinoscriptsyntax as rs
import ghpythonlib.treehelpers as th

#x = th.tree_to_list(walkCount)

radiusCount = []
for i in range(len(walkCount)):
    b = walkCount[i]
    if b==1:
        radiusCount.append(b)
    else:
        radiusCount.append("")

#while there are empty ("") items in the list, go through the list:
while "" in radiusCount:
    for i in range(len(walkCount)):
        r = radiusCount[i]
        if r == "": #if empty, obtain node and find branches with the same node
            node = nodePerCurve[i]
            branches = []
            radiusCountFori = 0
            for j in range(allNodes.BranchCount):
                branchList = allNodes.Branch(j)
                branchPath = allNodes.Path(j)
                b = str(branchPath)
                c = b.replace("{","").replace("}","")
                d = int(c)
                if d != i:
                    if node in branchList:
                        if radiusCount[d] != "":
                            radiusCountFori = radiusCountFori + radiusCount[d]
                        else: # if one of the branches doesnt have a value (i.e., is "") then skip and return back to this node later through the while loop.
                            print "empty"
                            radiusCount[i] = ""
                            continue
                radiusCount[i] = radiusCountFori


#for i in range(len(y)):
#    curveIndex = int(y[i])
#    print curveIndex
#    for i in range(x.BranchCount):
#        branchList = x.Branch(i)
#        branchPath = x.Path(i)
#        if curveIndex in branchList:
#            b = str(branchPath)
#            c = b.replace("{","").replace("}","")
#            d = int(c)
#            a.append(d)
#            break
# ---------- end ghpython_script_2 ----------
node_points_for_each_curve_sorted = Panel(flip_matrix)
multiplication = Multiplication(A=ghpython_script_2.radiusCount, B=cube)
cube_root = CubeRoot(Value=multiplication)

# ---- group: Put in same order as input curve list
curve_middle = CurveMiddle(Curve=network_curves_unique_lines_2)
curve_middle_2 = CurveMiddle(Curve=sort_list.ValuesCurves)
member_index_5 = MemberIndex(Set=curve_middle_2, Member=curve_middle)  # -> flatten(Index), Count
list_item_3 = ListItem(List=cube_root, Index=member_index_5.Index, Wrap=True)

# ----
radiuscount_for_each_node_point = Panel(ghpython_script_2.radiusCount)
radii = Panel(cube_root)
radii_2 = Number(list_item_3)
radii_3 = ClusterOutput(radii_2)

# ==== cluster _2DAnd3DUnconnected
x = ClusterInput()
vector = ClusterInput()
y = ClusterInput()
very_large_value_to_ensure_all_points_ar = Panel("1000")  # "Very large value to ensure all points are included"
vector_2 = Vector(vector)
ghpython_script = GhPythonScript(x=x, y=y)  # -> out, a; same code as ghpython_script
point = Point(ghpython_script.a)
list_item = ListItem(List=point, Index=0, Wrap=True)
line_sdl = LineSDL(Start=list_item, Direction=vector_2, Length=very_large_value_to_ensure_all_points_ar)
extend_curve = ExtendCurve(Curve=line_sdl, Type=0, Start=very_large_value_to_ensure_all_points_ar, End=very_large_value_to_ensure_all_points_ar)
curve_closest_point = CurveClosestPoint(Point=point, Curve=extend_curve)  # -> simplify(Point), Parameter, simplify(Distance)
end_points = EndPoints(Curve=extend_curve)  # -> Start, End
distance = Distance(PointA=end_points.Start, PointB=curve_closest_point.Point)
sort_list = SortList(Keys=distance, ValuesValuesA=point)  # -> Keys, ValuesValuesA
line_sdl_2 = LineSDL(Start=sort_list.ValuesValuesA, Direction=vector_2, Length=very_large_value_to_ensure_all_points_ar)  # -> graft(Line)
curve_closest_point_2 = CurveClosestPoint(Point=sort_list.ValuesValuesA, Curve=line_sdl_2)  # -> simplify(Point), Parameter, simplify(Distance)
tolerance = Panel("0.001")
point_sorted_along_vector = Point(sort_list.ValuesValuesA)
smaller_than = SmallerThan(FirstNumber=curve_closest_point_2.Distance, SecondNumber=tolerance)  # -> SmallerThan, OrEqualTo
dispatch = Dispatch(List=curve_closest_point_2.Point, DispatchPattern=smaller_than.SmallerThan)  # -> ListA, ListB
sort_along_curve = SortAlongCurve(Points=dispatch.ListA, Curve=simplify(line_sdl_2))  # -> simplify(Points), Indices
list_item_2 = ListItem(List=sort_along_curve.Points, Index="1", Wrap=True)  # -> flatten(Item)
ghpython_script_2 = GhPythonScript(startPt=point_sorted_along_vector, endPt=list_item_2)  # -> out, a; inputs startPt: list of Point3d, endPt: list of Point3d
# ---------- ghpython_script_2: Python ----------
__author__ = "lt4840"
__version__ = "2024.04.15"

import rhinoscriptsyntax as rs

usedPt = []
lines = []
tolerance = 0.001
for i in range(len(startPt)):
    pt1 = startPt[i]
    pt2 = endPt[i]
    distance = 10000000000000000000000000
    for item in usedPt:
        d = pt1.DistanceTo(item)
        if d < distance:
            distance = d
        d = pt2.DistanceTo(item)
        if d < distance:
            distance = d
    if distance > tolerance:
#    If-statement below produced some erroneous results: sometimes it did not recognize a point in the list even if it was present. Replaced by if-statement above. 
#    if (pt1 not in usedPt) and (pt2 not in usedPt) and (pt1 != pt2):
        line = rs.AddLine(pt1,pt2)
        lines.append(line)
        usedPt.append(pt1)
        usedPt.append(pt2)
a = lines
# ---------- end ghpython_script_2 ----------
a = ClusterOutput(ghpython_script_2.a)

# ==== cluster MeshNetworkWithCocoonForToolpaths
B = ClusterInput()
curve = ClusterInput()
A = ClusterInput()
charge_strengths = ClusterInput()
execute = ClusterInput()
addition = Addition(A=graft(A), B=graft(B))  # -> flatten(Result)
curve_2 = Curve(curve)
curve_charge = CurveCharge(Curve=curve, Radius=addition, ChargeStrengths=charge_strengths)
number_slider = Slider(0.15, range=0..10)
number_slider_2 = Slider(0.4, range=0..10)
curve_middle = CurveMiddle(Curve=curve_2)
curve_closest_point = CurveClosestPoint(Point=curve_middle, Curve=curve_2)  # -> Point, Parameter, Distance
cocoon = Cocoon(Charges=curve_charge, Iso=number_slider, CellSize=number_slider_2, Execute=execute, Simple=False)  # -> Mesh, RefinementData
perp_frame = PerpFrame(Curve=curve_2, Parameter=curve_closest_point.Parameter)
pi = Pi(Factor=1)

# ---- group: Adjust cell size slightly if Cocoon fails
list_length = ListLength(List=cocoon.Mesh)
equality = Equality(FirstNumber=list_length, SecondNumber="0")  # -> Equality, Inequality
addition_2 = Addition(A=number_slider_2, B="0.01")
cocoon_2 = Cocoon(Charges=curve_charge, Iso=number_slider, CellSize=addition_2, Execute=equality.Equality, Simple=False)  # -> Mesh, RefinementData

list_length_2 = ListLength(List=cocoon_2.Mesh)
equality_2 = Equality(FirstNumber=list_length_2, SecondNumber="0")  # -> Equality, Inequality
addition_3 = Addition(A=addition_2, B="0.01")
cocoon_3 = Cocoon(Charges=curve_charge, Iso=number_slider, CellSize=addition_3, Execute=equality_2.Equality, Simple=False)  # -> Mesh, RefinementData

entwine = Entwine(Branch00=cocoon.Mesh, Branch01=flatten([cocoon_2.Mesh, cocoon_3.Mesh]), FlattenInputs=True)  # -> simplify(Result)
tree_item = TreeItem(Tree=entwine, Path=equality.Equality, Index=0, Wrap=True)

# ----
quicksmooth = QuickSmooth(Mesh=tree_item, Step=0.5, Iterations=Slider(10, range=0..10))
mesh_plane = MeshPlane(Mesh=quicksmooth, Plane=perp_frame)  # -> simplify(Curves)
mesh = ClusterOutput(quicksmooth)
area = Area(Geometry=mesh_plane)  # -> Area, Centroid
distance = Distance(PointA=simplify(area.Centroid), PointB=simplify(graft(curve_middle)))
sort_list = SortList(Keys=distance, ValuesValuesA=simplify(mesh_plane))  # -> Keys, ValuesValuesA
list_item = ListItem(List=sort_list.ValuesValuesA, Index=0, Wrap=True)
area_2 = Area(Geometry=list_item)  # -> Area, Centroid
division = Division(A=area_2.Area, B=pi)
square_root = SquareRoot(Value=division)
subtraction = Subtraction(A=simplify(square_root), B=simplify(graft(B)))
list_length_3 = ListLength(List=quicksmooth)
ghpython_script = GhPythonScript(x=list_length_3, y=subtraction)  # -> out, a; same code as ghpython_script
a = ClusterOutput(ghpython_script.a)

# ==== cluster Cluster_2
A = ClusterInput()
A_2 = ClusterInput()
panel = Panel("""-2
2""")
panel_2 = Panel("""-2
2""")
division = Division(A=A, B=panel)
division_2 = Division(A=A_2, B=panel_2)
list_item = ListItem(List=division, Index=0, Wrap=True)  # -> Item, Item1
list_item_2 = ListItem(List=division_2, Index=0, Wrap=True)  # -> Item, Item1
construct_domain = ConstructDomain(DomainStart=list_item.Item, DomainEnd=list_item.Item1)
construct_domain_2 = ConstructDomain(DomainStart=list_item_2.Item, DomainEnd=list_item_2.Item1)
xy_plane = XYPlane(Origin=Point(0, 0, 0))
angle = ClusterInput()
rectangle = Rectangle(Plane=PlaneXY(0, 0, 0), XSize=construct_domain_2, YSize=construct_domain, Radius=0)  # -> Rectangle, Length
rotate = Rotate(Geometry=xy_plane, Angle=degrees(angle), Plane=PlaneXY(0, 0, 0))  # -> Geometry, Transform
angle_2 = ClusterInput()
rotate_2 = Rotate(Geometry=rectangle.Rectangle, Angle=degrees(angle_2), Plane=PlaneXY(0, 0, 0))  # -> Geometry, Transform
bounding_rectangle = BoundingRectangle(Geometry=rotate_2.Geometry, Plane=graft(rotate.Geometry), Axis=0, Slide=0, Union=True)  # -> Bounding, DimensionX, flatten(DimensionY)
division_3 = Division(A=bounding_rectangle.DimensionY, B="2")
distance_between_filament_center_and_cha = Number(division_3)  # "Distance between filament center and channel perimeter"
distance_between_filament_center_and_cha_2 = ClusterOutput(distance_between_filament_center_and_cha)  # "Distance between filament center and channel perimeter"

# ==== cluster Cluster_3
unit_x = UnitX(Factor=1)
line_sdl = LineSDL(Start="0,0,0", Direction=unit_x, Length=1)
vector_a = ClusterInput()
angle = Angle(VectorA=vector_a, VectorB=line_sdl)  # -> Angle, Reflex
degrees = Degrees(Radians=angle.Angle)
degrees_2 = ClusterOutput(degrees)

# ==== cluster CalculateM
A = ClusterInput()
division = Division(A=A, B="1000")
overhang_volume_mm3 = ClusterInput()
span_length_mm = ClusterInput()

density_g_mm3 = Panel(division)
gravitational_acceleration_m_s2 = Panel("9.81")
overhang_volume_mm3_2 = Number(overhang_volume_mm3)
span_length_mm_2 = Number(span_length_mm)

# ---- group: Remove empty branches
list_length = ListLength(List=overhang_volume_mm3_2)
list_length_2 = ListLength(List=overhang_volume_mm3_2)
smaller_than = SmallerThan(FirstNumber=list_length, SecondNumber="1")  # -> SmallerThan, OrEqualTo
smaller_than_2 = SmallerThan(FirstNumber=list_length_2, SecondNumber="1")  # -> SmallerThan, OrEqualTo
tree_statistics = TreeStatistics(Tree=overhang_volume_mm3_2)  # -> flatten(Paths), Length, Count
gate_or = GateOr(A=smaller_than.SmallerThan, B=smaller_than_2.SmallerThan)  # -> flatten(Result)
dispatch = Dispatch(List=tree_statistics.Paths, DispatchPattern=gate_or)  # -> ListA, ListB
tree_branch = TreeBranch(Tree=overhang_volume_mm3_2, Path=dispatch.ListB, MaintainPaths=True)
tree_branch_2 = TreeBranch(Tree=span_length_mm_2, Path=dispatch.ListB, MaintainPaths=True)

# ----
multiplication = Multiplication(A=tree_branch, B=density_g_mm3)
total_weight_g = Panel(multiplication)
division_2 = Division(A=multiplication, B="1000")
multiplication_2 = Multiplication(A=division_2, B=gravitational_acceleration_m_s2)
total_weight_kg = Panel(division_2)
division_3 = Division(A=multiplication_2, B=tree_branch_2)
N = Panel(multiplication_2)
square = Square(Value=tree_branch_2)
panel = Panel("0.125")
w_n_mm = Panel(division_3)
multiplication_3 = Multiplication(A=panel, B=division_3, C=square)
average = Average(Input=flatten(multiplication_3))
m_nmm = Panel(multiplication_3)
sort_list = SortList(Keys=flatten(multiplication_3))  # -> Keys, ValuesValuesA
list_item = ListItem(List=sort_list.Keys, Index="-1", Wrap=True)
arithmetic_mean = ClusterOutput(average)
number = Number(list_item)
number_2 = ClusterOutput(number)
result = ClusterOutput(multiplication_3)

# ==== cluster ObtainSpanCurvesSpanLengthOverhangVolume
second_number = ClusterInput()
list = ClusterInput()
rebuilt_toolpaths = ClusterInput()

# ---- group: Remove empty item from list
cull_index = CullIndex(List=list, Indices="-1", Wrap=True)

# ----
rebuilt_toolpaths_2 = Curve(rebuilt_toolpaths)
overhang_geometry = Brep(simplify(cull_index))
tree_statistics = TreeStatistics(Tree=rebuilt_toolpaths_2)  # -> Paths, Length, Count
cull_index_2 = CullIndex(List=tree_statistics.Paths, Indices="0", Wrap=True)
area = Area(Geometry=overhang_geometry)  # -> Area, Centroid
tree_branch = TreeBranch(Tree=rebuilt_toolpaths_2, Path=cull_index_2, MaintainPaths=True)
B = ClusterInput()
graft_tree = GraftTree(Tree=overhang_geometry, IncludeEmptyLists=True, IncludeNullItems=True)
division = Division(A=area.Area, B=B)
list_length = ListLength(List=overhang_geometry)
match_tree = MatchTree(Tree=tree_branch, Guide=overhang_geometry)
populate_geometry = PopulateGeometry(Geometry=graft_tree, Count=graft(division), Seed=1)  # -> simplify(Population)
duplicate_data = DuplicateData(Data=match_tree, Number=list_length, Order=True)  # -> simplify(Data)
graft_tree_2 = GraftTree(Tree=duplicate_data, IncludeEmptyLists=True, IncludeNullItems=True)
list_length_2 = ListLength(List=populate_geometry)
smaller_than = SmallerThan(FirstNumber=list_length_2, SecondNumber="2")  # -> SmallerThan, OrEqualTo
dispatch = Dispatch(List=graft_tree, DispatchPattern=smaller_than.SmallerThan)  # -> ListA, ListB
dispatch_2 = Dispatch(List=graft_tree_2, DispatchPattern=smaller_than.SmallerThan)  # -> ListA, ListB
dispatch_3 = Dispatch(List=populate_geometry, DispatchPattern=smaller_than.SmallerThan)  # -> ListA, ListB
curve_closest_point = CurveClosestPoint(Point=dispatch_3.ListB, Curve=dispatch_2.ListB)  # -> Point, Parameter, Distance
sort_along_curve = SortAlongCurve(Points=curve_closest_point.Point, Curve=dispatch_2.ListB)  # -> simplify(Points), Indices
panel = Panel("""0
-1""")
list_item = ListItem(List=sort_along_curve.Indices, Index=panel, Wrap=True)
list_item_2 = ListItem(List=curve_closest_point.Parameter, Index=list_item, Wrap=True)
shatter = Shatter(Curve=dispatch_2.ListB, Parameters=list_item_2)  # -> simplify(Segments)

# ---- group: Select correct segments
volume = Volume(Geometry=graft_tree)  # -> Volume, Centroid
curve_middle = CurveMiddle(Curve=shatter)
closest_point = ClosestPoint(Point=volume.Centroid, Cloud=curve_middle)  # -> ClosestPoint, CPIndex, Distance
list_item_3 = ListItem(List=shatter, Index=closest_point.CPIndex, Wrap=True)

# ----
dispatch_4 = Dispatch(List=volume.Volume, DispatchPattern=smaller_than.SmallerThan)  # -> ListA, ListB
dispatch_5 = Dispatch(List=list_item_3, DispatchPattern=smaller_than.SmallerThan)  # -> ListA, ListB

# ---- group: Remove smallest overhangs
smaller_than_2 = SmallerThan(FirstNumber=dispatch_4.ListB, SecondNumber=second_number)  # -> SmallerThan, OrEqualTo
dispatch_6 = Dispatch(List=dispatch.ListB, DispatchPattern=smaller_than_2.SmallerThan)  # -> ListA, ListB
dispatch_7 = Dispatch(List=dispatch_4.ListB, DispatchPattern=smaller_than_2.SmallerThan)  # -> ListA, ListB
dispatch_8 = Dispatch(List=dispatch_5.ListB, DispatchPattern=smaller_than_2.SmallerThan)  # -> ListA, ListB

# ----
curve = Curve(dispatch_8.ListB)
length = Length(Curve=curve)
list_b = ClusterOutput(dispatch_7.ListB)
list_b_2 = ClusterOutput(dispatch_6.ListB)
length_2 = ClusterOutput(length)
curve_2 = ClusterOutput(curve)

# ==== cluster RebuildCurves
toolpaths_of_one_side = ClusterInput()
toolpaths_of_one_side_2 = Curve(toolpaths_of_one_side)
length = Length(Curve=toolpaths_of_one_side_2)
A = ClusterInput()
multiplication = Multiplication(A=A, B=length)
round = Round(Number=multiplication)  # -> Nearest, Floor, Ceiling
addition = Addition(A=round.Ceiling, B="1")
divide_curve = DivideCurve(Curve=toolpaths_of_one_side_2, Count=addition, Kinks=False)  # -> Points, Tangents, Parameters
interpolate = Interpolate(Vertices=divide_curve.Points, Degree=3, Periodic=False, KnotStyle=1)  # -> simplify(Curve), Length, Domain
curve = ClusterOutput(interpolate.Curve)
points = ClusterOutput(divide_curve.Points)

# ==== cluster SelectToolpathsOnOneSide
toolpaths = ClusterInput()
toolpaths_2 = Curve(toolpaths)
curve_middle = CurveMiddle(Curve=toolpaths_2)
deconstruct = Deconstruct(Point=curve_middle)  # -> XComponent, YComponent, ZComponent
sort_list = SortList(Keys=deconstruct.YComponent, ValuesValuesA=toolpaths_2)  # -> Keys, ValuesValuesA
list_item = ListItem(List=sort_list.ValuesValuesA, Index=0, Wrap=True)
toolpathangle = ClusterInput()

# ---- group: Reverse list if toolpath angle > 90
flatten_tree = FlattenTree(Tree=list_item, Path="{0}")
reverse_list = ReverseList(List=flatten_tree)
ghpython_script = GhPythonScript(x=flatten(flatten_tree), y=reverse_list, toolpathAngle=toolpathangle)  # -> out, simplify(graft(a))
# ---------- ghpython_script: Python ----------
__author__ = "lt4840"
__version__ = "2024.04.16"

import rhinoscriptsyntax as rs

if toolpathAngle > 90:
    a = y
else:
    a = x
# ---------- end ghpython_script ----------

# ----
a = ClusterOutput(ghpython_script.a)

# ==== cluster ProjectCurvesIfSurfaceIsNonPlanar
network_curves_unique_lines = ClusterInput()
surface = ClusterInput()
network_curves_unique_lines_2 = Curve(network_curves_unique_lines)
surface_2 = Surface(surface)
is_planar = IsPlanar(Surface=surface_2, Interior=True)  # -> Planar, Plane
project = Project(Curve=network_curves_unique_lines_2, Brep=surface_2, Direction=is_planar.Plane)  # -> flatten(Curve)
ghpython_script = GhPythonScript(x=is_planar.Planar)  # -> out, a
# ---------- ghpython_script: Python ----------
__author__ = "lt4840"
__version__ = "2024.04.15"

import rhinoscriptsyntax as rs

if x: # if surface is planar
    a = True
elif x==False: # if surface is non-planar
    a = False
else: #if no surface
    a = True
# ---------- end ghpython_script ----------
entwine = Entwine(Branch00=project, Branch01=network_curves_unique_lines_2, FlattenInputs=True)  # -> simplify(Result)
tree_branch = TreeBranch(Tree=entwine, Path=ghpython_script.a, MaintainPaths=True)
branch = ClusterOutput(tree_branch)

# ==== cluster GenerateToolpaths
toolpath_angle_beta_degrees = ClusterInput()
filament_height = ClusterInput()
brep = ClusterInput()
toolpath_angle_beta_degrees_2 = Number(toolpath_angle_beta_degrees)
brep_2 = Brep(brep)
filament_height_2 = Number(filament_height)
area = Area(Geometry=brep_2)  # -> Area, Centroid
xy_plane = XYPlane(Origin=Point(0, 0, 0))
xz_plane = XZPlane(Origin=Point(0, 0, 0))
number = ClusterInput()
number_2 = Number(number)
rotate = Rotate(Geometry=xy_plane, Angle=degrees(toolpath_angle_beta_degrees_2), Plane=xz_plane)  # -> Geometry, Transform
scale = Scale(Geometry=brep_2, Center=area.Centroid, Factor="0.99")  # -> Geometry, Transform
negative = Negative(Value=number_2)
shape = ClusterInput()
contour = Contour(Shape=shape, Point=Point(0, 0, 0), Direction=rotate.Geometry, Distance=filament_height_2)  # -> simplify(Contours)
offset_surface = OffsetSurface(Surface=scale.Geometry, Distance=number_2, BothSides=negative, CreateSolid=True)
trim_with_brep = TrimWithBrep(Curve=contour, Brep=offset_surface)  # -> simplify(Inside), Outside
geometry = ClusterOutput(rotate.Geometry)
inside = ClusterOutput(trim_with_brep.Inside)

# ==== cluster Cluster_4
A = ClusterInput()
integer = ClusterInput()
number = ClusterInput()
number_2 = ClusterInput()
number_3 = ClusterInput()
text = ClusterInput()
fragment_b = ClusterInput()
fragment_b_2 = ClusterInput()
tolerance_angle = ClusterInput()
model_center = ClusterInput()
geometry = ClusterInput()
radius_1 = ClusterInput()
radius_2 = ClusterInput()
motion = ClusterInput()
list_item = ListItem(List=geometry, Index=0, Wrap=True)
division = Division(A=A, B="2")
end_points = EndPoints(Curve=list_item)  # -> Start, End
deconstruct = Deconstruct(Point=end_points.Start)  # -> XComponent, YComponent, ZComponent

# ---- group: Build plate
point = Point("0,50,1")
rectangle_2pt = Rectangle2Pt(Plane="0,50,1", PointA=point, PointB="216,204,1", Radius=0)  # -> Rectangle, Length
rectangle_2pt_2 = Rectangle2Pt(Plane=PlaneXY(0, 0, 0), PointA=point, PointB="216,266,0", Radius=0)  # -> Rectangle, Length
area = Area(Geometry=rectangle_2pt.Rectangle)  # -> Area, Centroid

# ----
model_center_2 = Point(model_center)
number_4 = Number(division)

# ----
# Skirt Model
panel = Panel("1")
unit_z = UnitZ(Factor=deconstruct.ZComponent)
move = Move(Geometry=model_center_2, Motion=unit_z)  # -> Geometry, Transform
ellipse = Ellipse(Plane=model_center_2, Radius1=radius_1, Radius2=radius_2)  # -> Ellipse, Focus1, Focus2
offset_curve = OffsetCurve(Curve=ellipse.Ellipse, Distance=number_4, Plane=PlaneXY(0, 0, 0), BothSides=True, Kinks=0, CapType=1)
length = Length(Curve=offset_curve)
sort_list = SortList(Keys=length, ValuesValuesA=offset_curve)  # -> reverse(Keys), reverse(ValuesValuesA)

number_5 = Number(number_2)

# ----
# Position print on bed
rotate = Rotate(Geometry=geometry, Angle=degrees(number_5), Plane=model_center_2)  # -> Geometry, Transform
rotate_2 = Rotate(Geometry=sort_list.ValuesValuesA, Angle=degrees(number_5), Plane=model_center_2)  # -> Geometry, Transform
move_2pt = Move2Pt(Geometry=rotate.Geometry, PointA=model_center_2, PointB=area.Centroid)  # -> Moved, Vector, Transform
move_2pt_2 = Move2Pt(Geometry=rotate_2.Geometry, PointA=model_center_2, PointB=area.Centroid)  # -> Moved, Vector, Transform

list_item_2 = ListItem(List=move_2pt_2.Moved, Index="-1", Wrap=True)
number_6 = Number(number_3)
number_7 = Number(number)
integer_2 = Integer(integer)
concatenate = Concatenate(FragmentA=" F", FragmentB=integer_2)
text_2 = Text(text)
round_to_decimal_place = RoundToDecimalPlace(NumberX=number_7, DecimalPlace="2", RoundType=0)  # -> Rounded, Difference

# ----
# End GCode
deconstruct_vector = DeconstructVector(Vector=motion)  # -> XComponent, YComponent, ZComponent
panel_2 = Panel("""G28 X0 Y0 ; move X/Y to min endstops so the head is out of the way
M84 ; disable motors
G90 ; absolute positioning
; -- end of END GCODE --""")
panel_3 = Panel("""; -- END GCODE --
G91 ; relative positioning
G1 E-1 F300 ; retract the filament a bit before lifting the nozzle to release some of the pressure""")
concatenate_2 = Concatenate(
    Fragment_A="G1 Z+5 E-5 X",
    Fragment_B=deconstruct_vector.XComponent,
    A=" Y",
    B=deconstruct_vector.YComponent,
    C=" F9000 ; move Z up a bit and retract filament even more")
merge = Merge(Data1=panel_3, Data2=concatenate_2, Data3=panel_2)

concatenate_3 = Concatenate(FragmentA="; extrusion constant ", FragmentB=round_to_decimal_place.Rounded)

# ----
# Start GCode
panel_4 = Panel("""G90
M82
M106 S0
M104 S0 T0
M107 ; start with the fan off
M302 ; allow cold extrusion
G28 ; home axis
G92 E0.0000 ; reset extruder
M117 Printing... ; Put printing msg on LCD screen
; -- end of START GCODE --""")
panel_5 = Panel("""; -- START GCODE --
; Settings Summary""")
concatenate_4 = Concatenate(FragmentA="; overlap (%)  ", FragmentB=fragment_b_2)
concatenate_5 = Concatenate(FragmentA="; nozzle diameter (mm) ", FragmentB=fragment_b)
merge_2 = Merge(Data1=panel_5, Data2=concatenate_4, Data3=concatenate_5, Data4=concatenate_3, Data5=panel_4)

rectangle = ClusterOutput(rectangle_2pt.Rectangle)

explode = Explode(Curve=move_2pt.Moved, Recursive=True)  # -> simplify(graft(Segments)), Vertices
curve_to_polyline = CurveToPolyline(Curve=explode.Segments, ToleranceDistance=0, ToleranceAngle=number_6)  # -> Polyline, Segments
trim_tree = TrimTree(Tree=curve_to_polyline.Polyline, Depth=1)
join_curves = JoinCurves(Curves=trim_tree, Preserve=False)  # -> simplify(Curves)
explode_2 = Explode(Curve=join_curves, Recursive=False)  # -> simplify(Segments), simplify(Vertices)
length_2 = Length(Curve=explode_2.Segments)  # -> simplify(Length)

list_item_3 = ListItem(List=explode.Vertices, Index=0, Wrap=True)
end_points_2 = EndPoints(Curve=join_curves)  # -> Start, End

# ----
# Skirt GCode
list_item_4 = ListItem(List=flatten(explode_2.Vertices), Index=0, Wrap=True)
panel_6 = Panel("G92 E0.0000 ; reset extruder")
skirt = Panel("""; -- start of SKIRT GCODE --
T1
; feature skirt
G1 Z1.000 F2000""")

curve_closest_point = CurveClosestPoint(Point=list_item_4, Curve=list_item_2)  # -> Point, Parameter, Distance
vector_2pt = Vector2Pt(PointA=list_item_4, PointB=curve_closest_point.Point, Unitize=False)  # -> Vector, Length

line_sdl = LineSDL(Start=list_item_4, Direction=vector_2pt.Vector, Length="200")
curve_curve = CurveCurve(CurveA=line_sdl, CurveB=move_2pt_2.Moved)  # -> Points, ParamsA, flatten(ParamsB)
seam = Seam(Curve=move_2pt_2.Moved, Seam=curve_curve.ParamsB)
curve_to_polyline_2 = CurveToPolyline(Curve=seam, ToleranceDistance=number_6, ToleranceAngle=tolerance_angle, MinEdge=number_4)  # -> Polyline, Segments
explode_3 = Explode(Curve=curve_to_polyline_2.Polyline, Recursive=True)  # -> Segments, Vertices
cull_index = CullIndex(List=explode_3.Segments, Indices="-1", Wrap=True)
cull_index_2 = CullIndex(List=explode_3.Vertices, Indices="-1", Wrap=True)
length_3 = Length(Curve=cull_index)  # -> simplify(Length)
insert_items = InsertItems(List=length_3, Item="0", Indices="0", Wrap=True)
mass_addition = MassAddition(Input=insert_items)  # -> Result, PartialResults

multiplication = Multiplication(A=mass_addition.PartialResults, B=number_7)

# ----
# Path Visualization
merge_3 = Merge(Data1=flatten(cull_index_2), Data2=flatten(explode_2.Vertices))
polyline = PolyLine(Vertices=flatten(merge_3), Closed=False)
end_points_3 = EndPoints(Curve=polyline)  # -> Start, End
move_2 = Move(Geometry=end_points_3.End, Motion=motion)  # -> Geometry, Transform
printer_not_model_origin = Panel("0,216,0")
polyline_2 = PolyLine(Vertices=[end_points_3.End, move_2.Geometry, printer_not_model_origin], Closed=False)
join_curves_2 = JoinCurves(Curves=[polyline, polyline_2], Preserve=False)

curves = ClusterOutput(join_curves_2)

insert_items_2 = InsertItems(List=length_2, Item="0", Indices="0", Wrap=True)
mass_addition_2 = MassAddition(Input=insert_items_2)  # -> Result, PartialResults

multiplication_2 = Multiplication(A=mass_addition_2.PartialResults, B=number_7)

ghpython_script = GhPythonScript(f=integer_2, e=multiplication_2, Vertices=explode_2.Vertices)  # -> out, a; inputs Vertices: Point3d
# ---------- ghpython_script: Python ----------
__author__ = "Wyss User"
__version__ = "2022.11.19"

import rhinoscriptsyntax as rs

x = Vertices.X
y = Vertices.Y
z = Vertices.Z
a = "G1 F" + str(f) + " X" + str(round(x,2)) + " Y" + str(round(y,2)) + " Z" + str(round(z,2)) + " E" + str(round(e,2))
# ---------- end ghpython_script ----------

ghpython_script_2 = GhPythonScript(f=integer_2, e=multiplication, Vertices=cull_index_2)  # -> out, a; inputs Vertices: Point3d; same code as ghpython_script
list_item_5 = ListItem(List=ghpython_script_2.a, Index=0, Wrap=True)
replace_text = ReplaceText(Text=list_item_5, Find=concatenate, Replace=text_2, RecursiveReplace=False)

replace_text_2 = ReplaceText(Text=replace_text, Find=" E0.0", RecursiveReplace=False)

replace_items = ReplaceItems(List=simplify(ghpython_script_2.a), Item=simplify(replace_text_2), Indices="0", Wrap=False)
insert_items_3 = InsertItems(List=replace_items, Item=panel_6, Indices="1", Wrap=True)  # -> flatten(List)
merge_4 = Merge(Data1=skirt, Data2=insert_items_3, Data3="; -- end of SKIRT GCODE --")

# ----
# Print GCode
list_item_6 = ListItem(List=ghpython_script.a, Index=0, Wrap=True)
replace_text_3 = ReplaceText(Text=list_item_6, Find=concatenate, Replace=text_2, RecursiveReplace=False)

replace_text_4 = ReplaceText(Text=replace_text_3, Find=" E0.0", RecursiveReplace=False)

replace_items_2 = ReplaceItems(List=simplify(ghpython_script.a), Item=simplify(replace_text_4), Indices="0", Wrap=False)
insert_items_4 = InsertItems(List=replace_items_2, Item=panel_6, Indices="1", Wrap=True)  # -> flatten(List)

merge_5 = Merge(Data1=merge_2, Data2=merge_4, Data3=insert_items_4, Data4=merge)
result = ClusterOutput(merge_5)

# ==== cluster Cluster_5
plane = ClusterInput()
toolpath_angle_beta_degrees = ClusterInput()
plane_2 = Plane(plane)
toolpath_angle_beta_degrees_2 = Number(toolpath_angle_beta_degrees)
deconstruct_plane = DeconstructPlane(Plane=plane_2)  # -> Origin, XAxis, YAxis, ZAxis
construct_plane = ConstructPlane(Origin=plane_2, XAxis="1,0,0", YAxis="0,0,1")
construct_plane_2 = ConstructPlane(Origin=plane_2, XAxis="0,1,0", YAxis="1,0,0")
adjust_plane = AdjustPlane(Plane=construct_plane, Normal=deconstruct_plane.ZAxis)
adjust_plane_2 = AdjustPlane(Plane=construct_plane_2, Normal=deconstruct_plane.ZAxis)
ghpython_script = GhPythonScript(x=toolpath_angle_beta_degrees_2, planeOriginal=plane_2, planeNinety=adjust_plane_2, planeOneEighty=adjust_plane)  # -> out, a; inputs planeOriginal: tree, planeNinety: tree, planeOneEighty: tree
# ---------- ghpython_script: Python ----------
__author__ = "lt4840"
__version__ = "2024.04.30"

import rhinoscriptsyntax as rs

if x == 90:
    a = planeNinety
elif x == 180:
    a = planeOneEighty
else:
    a = planeOriginal
# ---------- end ghpython_script ----------
a = ClusterOutput(ghpython_script.a)

# ==== cluster Cluster_6
angle = ClusterInput()
xy_plane = XYPlane(Origin=Point(0, 0, 0))
xz_plane = XZPlane(Origin=Point(0, 0, 0))
A = ClusterInput()
rotate = Rotate(Geometry=xy_plane, Angle=degrees(angle), Plane=xz_plane)  # -> Geometry, Transform
division = Division(A=A, B="-0.001")
addition = Addition(A=division, B="1")
series = Series(Start=0, Step="-0.001", Count=addition)
deconstruct_plane = DeconstructPlane(Plane=rotate.Geometry)  # -> Origin, XAxis, YAxis, ZAxis
amplitude = Amplitude(Vector=deconstruct_plane.ZAxis, Amplitude=series)
geometry = ClusterInput()
move = Move(Geometry=geometry, Motion=amplitude)  # -> Geometry, Transform
geometry_2 = ClusterOutput(move.Geometry)

# ==== cluster DichotomousBranching
number = ClusterInput()
number_2 = ClusterInput()
inlet_point = ClusterInput()
point = ClusterInput()
number_3 = Number(number_2)
number_4 = Number(number)
inlet_point_2 = Point(inlet_point)
point_2 = Point(point)
panel = Panel(number_3)
closest_point = ClosestPoint(Point=inlet_point_2, Cloud=point_2)  # -> ClosestPoint, CPIndex, Distance
line = Line(StartPoint=inlet_point_2, EndPoint=closest_point.ClosestPoint)
cluster = Cluster_7(point=point_2, point_2=closest_point.ClosestPoint, count=panel, max_length=number_4, curve=line)  # -> branch, point_12, point_9
curve = Curve(flatten([line, cluster.branch]))
cluster_2 = Cluster_7(point=cluster.point_12, point_2=cluster.point_9, count=panel, max_length=number_4, curve=curve)  # -> branch, point_12, point_9
curve_2 = Curve(flatten([curve, cluster_2.branch]))
cluster_3 = Cluster_7(point=cluster_2.point_12, point_2=cluster_2.point_9, count=panel, max_length=number_4, curve=curve_2)  # -> branch, point_12, point_9
curve_3 = Curve(flatten([curve_2, cluster_3.branch]))
cluster_4 = Cluster_7(point=cluster_3.point_12, point_2=cluster_3.point_9, count=panel, max_length=number_4, curve=curve_3)  # -> branch, point_12, point_9
curve_4 = Curve(flatten([cluster_4.branch, curve_3]))
cluster_5 = Cluster_7(point=cluster_4.point_12, point_2=cluster_4.point_9, count=panel, max_length=number_4, curve=curve_4)  # -> branch, point_12, point_9
curve_5 = Curve(flatten([cluster_5.branch, curve_4]))
cluster_6 = Cluster_7(point=cluster_5.point_12, point_2=cluster_5.point_9, count=panel, max_length=number_4, curve=curve_5)  # -> branch, point_12, point_9
curve_6 = Curve(flatten([cluster_6.branch, curve_5]))
cluster_7 = Cluster_7(point=cluster_6.point_12, point_2=cluster_6.point_9, count=panel, max_length=number_4, curve=curve_6)  # -> branch, point_12, point_9
curve_7 = Curve(flatten([cluster_7.branch, curve_6]))
cluster_8 = Cluster_7(point=cluster_7.point_12, point_2=cluster_7.point_9, count=panel, max_length=number_4, curve=curve_7)  # -> branch, point_12, point_9
curve_8 = Curve(flatten([cluster_8.branch, curve_7]))
cluster_9 = Cluster_7(point=cluster_8.point_12, point_2=cluster_8.point_9, count=panel, max_length=number_4, curve=curve_8)  # -> branch, point_12, point_9
curve_9 = Curve(flatten([cluster_9.branch, curve_8]))
cluster_10 = Cluster_7(point=cluster_9.point_12, point_2=cluster_9.point_9, count=panel, max_length=number_4, curve=curve_9)  # -> branch, point_12, point_9
curve_10 = Curve(flatten([cluster_10.branch, curve_9]))
cluster_11 = Cluster_7(point=cluster_10.point_12, point_2=cluster_10.point_9, count=panel, max_length=number_4, curve=curve_10)  # -> branch, point_12, point_9
curve_11 = Curve(flatten([curve_10, cluster_11.branch]))
cluster_12 = Cluster_7(point=cluster_11.point_12, point_2=cluster_11.point_9, count=panel, max_length=number_4, curve=curve_11)  # -> branch, point_12, point_9
curve_12 = Curve(flatten([curve_11, cluster_12.branch]))
cluster_13 = Cluster_7(point=cluster_12.point_12, point_2=cluster_12.point_9, count=panel, max_length=number_4, curve=curve_12)  # -> branch, point_12, point_9
curve_13 = Curve(flatten([cluster_13.branch, curve_12]))
cluster_14 = Cluster_7(point=cluster_13.point_12, point_2=cluster_13.point_9, count=panel, max_length=number_4, curve=curve_13)  # -> branch, point_12, point_9
curve_14 = Curve(flatten([cluster_14.branch, curve_13]))
cluster_15 = Cluster_7(point=cluster_14.point_12, point_2=cluster_14.point_9, count=panel, max_length=number_4, curve=curve_14)  # -> branch, point_12, point_9
curve_15 = Curve(flatten([cluster_15.branch, curve_14]))
cluster_16 = Cluster_7(point=cluster_15.point_12, point_2=cluster_15.point_9, count=panel, max_length=number_4, curve=curve_15)  # -> branch, point_12, point_9
curve_16 = Curve(flatten([cluster_16.branch, curve_15]))
cluster_17 = Cluster_7(point=cluster_16.point_12, point_2=cluster_16.point_9, count=panel, max_length=number_4, curve=curve_16)  # -> branch, point_12, point_9
curve_17 = Curve(flatten([cluster_17.branch, curve_16]))
cluster_18 = Cluster_7(point=cluster_17.point_12, point_2=cluster_17.point_9, count=panel, max_length=number_4, curve=curve_17)  # -> branch, point_12, point_9
curve_18 = Curve(flatten([cluster_18.branch, curve_17]))
cluster_19 = Cluster_7(point=cluster_18.point_12, point_2=cluster_18.point_9, count=panel, max_length=number_4, curve=curve_18)  # -> branch, point_12, point_9
curve_19 = Curve(flatten([cluster_19.branch, curve_18]))
cluster_20 = Cluster_7(point=cluster_19.point_12, point_2=cluster_19.point_9, count=panel, max_length=number_4, curve=curve_19)  # -> branch, point_12, point_9
curve_20 = Curve(flatten([curve_19, cluster_20.branch]))
cluster_21 = Cluster_7(point=cluster_20.point_12, point_2=cluster_20.point_9, count=panel, max_length=number_4, curve=curve_20)  # -> branch, point_12, point_9
curve_21 = Curve(flatten([curve_20, cluster_21.branch]))
cluster_22 = Cluster_7(point=cluster_21.point_12, point_2=cluster_21.point_9, count=panel, max_length=number_4, curve=curve_21)  # -> branch, point_12, point_9
curve_22 = Curve(flatten([cluster_22.branch, curve_21]))
cluster_23 = Cluster_7(point=cluster_22.point_12, point_2=cluster_22.point_9, count=panel, max_length=number_4, curve=curve_22)  # -> branch, point_12, point_9
curve_23 = Curve(flatten([cluster_23.branch, curve_22]))
cluster_24 = Cluster_7(point=cluster_23.point_12, point_2=cluster_23.point_9, count=panel, max_length=number_4, curve=curve_23)  # -> branch, point_12, point_9
curve_24 = Curve(flatten([cluster_24.branch, curve_23]))
cluster_25 = Cluster_7(point=cluster_24.point_12, point_2=cluster_24.point_9, count=panel, max_length=number_4, curve=curve_24)  # -> branch, point_12, point_9
curve_25 = Curve(flatten([cluster_25.branch, curve_24]))
cluster_26 = Cluster_7(point=cluster_25.point_12, point_2=cluster_25.point_9, count=panel, max_length=number_4, curve=curve_25)  # -> branch, point_12, point_9
curve_26 = Curve(flatten([cluster_26.branch, curve_25]))
cluster_27 = Cluster_7(point=cluster_26.point_12, point_2=cluster_26.point_9, count=panel, max_length=number_4, curve=curve_26)  # -> branch, point_12, point_9
curve_27 = Curve(flatten([cluster_27.branch, curve_26]))
cluster_28 = Cluster_7(point=cluster_27.point_12, point_2=cluster_27.point_9, count=panel, max_length=number_4, curve=curve_27)  # -> branch, point_12, point_9
curve_28 = Curve(flatten([cluster_28.branch, curve_27]))
cluster_29 = Cluster_7(point=cluster_28.point_12, point_2=cluster_28.point_9, count=panel, max_length=number_4, curve=curve_28)  # -> branch, point_12, point_9
curve_29 = Curve(flatten([curve_28, cluster_29.branch]))
cluster_30 = Cluster_7(point=cluster_29.point_12, point_2=cluster_29.point_9, count=panel, max_length=number_4, curve=curve_29)  # -> branch, point_12, point_9
curve_30 = Curve(flatten([curve_29, cluster_30.branch]))
cluster_31 = Cluster_7(point=cluster_30.point_12, point_2=cluster_30.point_9, count=panel, max_length=number_4, curve=curve_30)  # -> branch, point_12, point_9
curve_31 = Curve(flatten([cluster_31.branch, curve_30]))
cluster_32 = Cluster_7(point=cluster_31.point_12, point_2=cluster_31.point_9, count=panel, max_length=number_4, curve=curve_31)  # -> branch, point_12, point_9
curve_32 = Curve(flatten([cluster_32.branch, curve_31]))
cluster_33 = Cluster_7(point=cluster_32.point_12, point_2=cluster_32.point_9, count=panel, max_length=number_4, curve=curve_32)  # -> branch, point_12, point_9
curve_33 = Curve(flatten([cluster_33.branch, curve_32]))
cluster_34 = Cluster_7(point=cluster_33.point_12, point_2=cluster_33.point_9, count=panel, max_length=number_4, curve=curve_33)  # -> branch, point_12, point_9
curve_34 = Curve(flatten([cluster_34.branch, curve_33]))
cluster_35 = Cluster_7(point=cluster_34.point_12, point_2=cluster_34.point_9, count=panel, max_length=number_4, curve=curve_34)  # -> branch, point_12, point_9
curve_35 = Curve(flatten([cluster_35.branch, curve_34]))
cluster_36 = Cluster_7(point=cluster_35.point_12, point_2=cluster_35.point_9, count=panel, max_length=number_4, curve=curve_35)  # -> branch, point_12, point_9
curve_36 = Curve(flatten([cluster_36.branch, curve_35]))
cluster_37 = Cluster_7(point=cluster_36.point_12, point_2=cluster_36.point_9, count=panel, max_length=number_4, curve=curve_36)  # -> branch, point_12, point_9
curve_37 = Curve(flatten([cluster_37.branch, curve_36, line]))
curve_38 = ClusterOutput(curve_37)

# ==== cluster _2DAnd3DInterconnectedNoIntersectingCurves
points = ClusterInput()
points_2 = ClusterInput()
group = ClusterInput()
proximity_3d = Proximity3D(Points=flatten([points_2, points]), Group=group)  # -> flatten(Links), Topology
removeduplicatelines = RemoveDuplicateLines(Lines=proximity_3d.Links, Tolerance=0.01)
cross_reference = CrossReference(ListListA=removeduplicatelines, ListListB=removeduplicatelines, CrossMode=5)  # -> ListListA, ListListB
curve_curve = CurveCurve(CurveA=cross_reference.ListListA, CurveB=cross_reference.ListListB)  # -> Points, ParamsA, ParamsB
graft_tree = GraftTree(Tree=removeduplicatelines, IncludeEmptyLists=True, IncludeNullItems=True)
equality = Equality(FirstNumber=curve_curve.ParamsA, SecondNumber="0")  # -> Equality, Inequality
equality_2 = Equality(FirstNumber=curve_curve.ParamsA, SecondNumber="1")  # -> Equality, Inequality
gate_or = GateOr(A=equality.Equality, B=equality_2.Equality)
dispatch = Dispatch(List=curve_curve.Points, DispatchPattern=gate_or)  # -> ListA, ListB
tolerance = Panel("0.001")
flatten_tree = FlattenTree(Tree=dispatch.ListB, Path="{0}")
curve_closest_point = CurveClosestPoint(Point=flatten_tree, Curve=graft_tree)  # -> Point, Parameter, Distance
smaller_than = SmallerThan(FirstNumber=curve_closest_point.Distance, SecondNumber=tolerance)  # -> SmallerThan, OrEqualTo
mass_addition = MassAddition(Input=smaller_than.SmallerThan)  # -> Result, PartialResults
dispatch_2 = Dispatch(List=graft_tree, DispatchPattern=mass_addition.Result)  # -> ListA, ListB

# ----
# Group curves by shared intersection point and only keep the shortest curve in that group.
curve = Curve(flatten(dispatch_2.ListA))
curve_closest_point_2 = CurveClosestPoint(Point=graft(flatten_tree), Curve=curve)  # -> Point, Parameter, Distance
tolerance_2 = Panel("0.001")
list_length = ListLength(List=curve)
smaller_than_2 = SmallerThan(FirstNumber=curve_closest_point_2.Distance, SecondNumber=tolerance_2)  # -> SmallerThan, OrEqualTo
series = Series(Start=0, Step=1, Count=list_length)
dispatch_3 = Dispatch(List=curve, DispatchPattern=smaller_than_2.SmallerThan)  # -> ListA, ListB
dispatch_4 = Dispatch(List=series, DispatchPattern=smaller_than_2.SmallerThan)  # -> ListA, ListB
length = Length(Curve=dispatch_3.ListA)
sort_list = SortList(Keys=length, ValuesValuesA=dispatch_4.ListA)  # -> Keys, ValuesValuesA
cull_index = CullIndex(List=sort_list.ValuesValuesA, Indices="0", Wrap=True)  # -> flatten(List)
sort_list_2 = SortList(Keys=cull_index)  # -> Keys, ValuesValuesA
delete_consecutive = DeleteConsecutive(Set=sort_list_2.Keys, Wrap=False)  # -> Set, Count
cull_index_2 = CullIndex(List=series, Indices=delete_consecutive.Set, Wrap=True)
list_item = ListItem(List=curve, Index=cull_index_2, Wrap=True)
curve_2 = Curve(flatten(list_item))

curve_3 = Curve(flatten(dispatch_2.ListB))
curve_4 = Curve([curve_2, curve_3])
curve_5 = ClusterOutput(curve_4)

# ==== cluster Cluster_7
count = ClusterInput()
point = ClusterInput()
point_2 = ClusterInput()
curve = ClusterInput()

# ----
# original
point_3 = Point(point_2)
curve_2 = Curve(curve)

pipe = Pipe(Curve=curve_2, Radius=Slider(0.1, range=0..0.1), Caps=0)
point_4 = Point(point)
closest_points = ClosestPoints(Point=simplify(point_3), Cloud=point_4, Count=count)  # -> ClosestPoint, simplify(CPIndex), simplify(Distance)
max_length = ClusterInput()
point_5 = Point(closest_points.ClosestPoint)
cluster_v_3 = ClusterV3(integer=closest_points.CPIndex, fragment_b=closest_points.Distance, y=max_length)
list_item = ListItem(List=point_4, Index=cluster_v_3, Wrap=True)
tolerance = Panel("0.001")
line = Line(StartPoint=simplify(graft(point_3)), EndPoint=simplify(list_item))  # -> flatten(Line)
curve_curve = CurveCurve(CurveA=simplify(graft(curve_2)), CurveB=line)  # -> Points, ParamsA, ParamsB
equality = Equality(FirstNumber=curve_curve.ParamsB, SecondNumber="0")  # -> Equality, Inequality
equality_2 = Equality(FirstNumber=curve_curve.ParamsB, SecondNumber="1")  # -> Equality, Inequality
gate_or = GateOr(A=equality.Equality, B=equality_2.Equality)
dispatch = Dispatch(List=curve_curve.Points, DispatchPattern=gate_or)  # -> ListA, ListB
point_6 = Point(dispatch.ListB)
flatten_tree = FlattenTree(Tree=point_6, Path="{0}")
curve_closest_point = CurveClosestPoint(Point=graft(flatten_tree), Curve=line)  # -> Point, Parameter, Distance
smaller_than = SmallerThan(FirstNumber=curve_closest_point.Distance, SecondNumber=tolerance)  # -> SmallerThan, OrEqualTo
flip_matrix = FlipMatrix(Data=smaller_than.SmallerThan)
mass_addition = MassAddition(Input=flip_matrix)  # -> flatten(Result), PartialResults
list_length = ListLength(List=flatten_tree)
equality_3 = Equality(FirstNumber=list_length, SecondNumber="0")  # -> Equality, Inequality
panel = Panel(smaller_than.SmallerThan)
dispatch_2 = Dispatch(List=line, DispatchPattern=mass_addition.Result)  # -> ListA, ListB
dispatch_3 = Dispatch(List=flatten(list_item), DispatchPattern=smaller_than.SmallerThan)  # -> ListA, ListB
dispatch_4 = Dispatch(List=flatten(cluster_v_3), DispatchPattern=smaller_than.SmallerThan)  # -> ListA, ListB
entwine = Entwine(Branch00=dispatch_3.ListB, Branch01=list_item, FlattenInputs=True)  # -> simplify(Result)
entwine_2 = Entwine(Branch00=dispatch_4.ListB, Branch01=cluster_v_3, FlattenInputs=True)  # -> simplify(Result)
ghpython_script = GhPythonScript(x=equality_3.Equality, y=dispatch_2.ListB, z=line)  # -> out, a
# ---------- ghpython_script: Python ----------
__author__ = "lt4840"
__version__ = "2024.04.15"

import rhinoscriptsyntax as rs

if x:
    a = z
else:
    a = y
# ---------- end ghpython_script ----------
panel_2 = Panel(mass_addition.Result)
tree_branch = TreeBranch(Tree=entwine, Path=equality_3.Equality, MaintainPaths=True)
tree_branch_2 = TreeBranch(Tree=entwine_2, Path=equality_3.Equality, MaintainPaths=True)

# ----
# Curves drawn in this iteration that may or may not intersect with one another
curve_3 = Curve(flatten(ghpython_script.a))

# ----
# Curves intersecting with curves drawn in previous iteration - to be removed
curve_4 = Curve(flatten(dispatch_2.ListA))

cross_reference = CrossReference(ListListA=curve_3, ListListB=curve_3, CrossMode=5)  # -> ListListA, ListListB
curve_curve_2 = CurveCurve(CurveA=cross_reference.ListListA, CurveB=cross_reference.ListListB)  # -> Points, ParamsA, ParamsB
point_7 = Point(point_4)
equality_4 = Equality(FirstNumber=curve_curve_2.ParamsB, SecondNumber="0")  # -> Equality, Inequality
equality_5 = Equality(FirstNumber=curve_curve_2.ParamsB, SecondNumber="1")  # -> Equality, Inequality
gate_or_2 = GateOr(A=equality_4.Equality, B=equality_5.Equality)
dispatch_5 = Dispatch(List=curve_curve_2.Points, DispatchPattern=gate_or_2)  # -> ListA, ListB
tolerance_2 = Panel("0.001")
flatten_tree_2 = FlattenTree(Tree=dispatch_5.ListB, Path="{0}")
curve_closest_point_2 = CurveClosestPoint(Point=graft(flatten_tree_2), Curve=curve_3)  # -> Point, Parameter, Distance
smaller_than_2 = SmallerThan(FirstNumber=curve_closest_point_2.Distance, SecondNumber=tolerance_2)  # -> SmallerThan, OrEqualTo
panel_3 = Panel(smaller_than_2.SmallerThan)
flip_matrix_2 = FlipMatrix(Data=smaller_than_2.SmallerThan)
dispatch_6 = Dispatch(List=curve_3, DispatchPattern=smaller_than_2.SmallerThan)  # -> ListA, ListB
list_length_2 = ListLength(List=flatten_tree_2)
mass_addition_2 = MassAddition(Input=flip_matrix_2)  # -> flatten(Result), PartialResults
equality_6 = Equality(FirstNumber=list_length_2, SecondNumber="0")  # -> Equality, Inequality
gate_and = GateAnd(A=equality_3.Equality, B=equality_6.Equality)
dispatch_7 = Dispatch(List=curve_3, DispatchPattern=mass_addition_2.Result)  # -> ListA, ListB

# ----
# Group curves by shared intersection point and only keep the shortest curve in that group.
curve_5 = Curve(flatten(dispatch_7.ListA))
curve_closest_point_3 = CurveClosestPoint(Point=graft(flatten_tree_2), Curve=curve_5)  # -> Point, Parameter, Distance
tolerance_3 = Panel("0.001")
list_length_3 = ListLength(List=curve_5)
smaller_than_3 = SmallerThan(FirstNumber=curve_closest_point_3.Distance, SecondNumber=tolerance_3)  # -> SmallerThan, OrEqualTo
series = Series(Start=0, Step=1, Count=list_length_3)
dispatch_8 = Dispatch(List=curve_5, DispatchPattern=smaller_than_3.SmallerThan)  # -> ListA, ListB
dispatch_9 = Dispatch(List=series, DispatchPattern=smaller_than_3.SmallerThan)  # -> ListA, ListB
length = Length(Curve=dispatch_8.ListA)
sort_list = SortList(Keys=length, ValuesValuesA=dispatch_9.ListA)  # -> Keys, ValuesValuesA
cull_index = CullIndex(List=sort_list.ValuesValuesA, Indices="0", Wrap=True)  # -> flatten(List)
sort_list_2 = SortList(Keys=cull_index)  # -> Keys, ValuesValuesA
delete_consecutive = DeleteConsecutive(Set=sort_list_2.Keys, Wrap=False)  # -> Set, Count
cull_index_2 = CullIndex(List=series, Indices=delete_consecutive.Set, Wrap=True)
list_item_2 = ListItem(List=curve_5, Index=cull_index_2, Wrap=True)
curve_6 = Curve(flatten(list_item_2))

curve_7 = Curve(flatten(dispatch_7.ListB))
panel_4 = Panel(mass_addition_2.Result)
list_item_3 = ListItem(List=curve_5, Index=Slider(3, range=0..10), Wrap=True)
curve_8 = Curve([curve_6, curve_7])
entwine_3 = Entwine(Branch00=curve_8, Branch01=curve_3, FlattenInputs=True)  # -> simplify(Result)
tree_branch_3 = TreeBranch(Tree=entwine_3, Path=equality_6.Equality, MaintainPaths=True)
entwine_4 = Entwine(Branch00=tree_branch_3, Branch01=line, FlattenInputs=True)  # -> simplify(Result)
tree_branch_4 = TreeBranch(Tree=entwine_4, Path=gate_and, MaintainPaths=True)
end_points = EndPoints(Curve=tree_branch_4)  # -> Start, End
point_8 = Point(end_points.End)
branch = ClusterOutput(tree_branch_4)
point_9 = ClusterOutput(point_8)
point_10 = Point(end_points.End)
distance = Distance(PointA=graft(point_7), PointB=point_10)  # -> simplify(Distance)
sort_list_3 = SortList(Keys=distance)  # -> Keys, ValuesValuesA
list_item_4 = ListItem(List=sort_list_3.Keys, Index=0, Wrap=True)  # -> flatten(Item)
smaller_than_4 = SmallerThan(FirstNumber=list_item_4, SecondNumber="0.001")  # -> SmallerThan, OrEqualTo
dispatch_10 = Dispatch(List=point_7, DispatchPattern=smaller_than_4.SmallerThan)  # -> ListA, ListB
point_11 = Point(dispatch_10.ListB)
point_12 = ClusterOutput(point_11)
point_13 = Point(dispatch_10.ListB)

# ==== cluster ClusterV3
integer = ClusterInput()
fragment_b = ClusterInput()
y = ClusterInput()
integer_2 = Integer(integer)
list_length = ListLength(List=integer_2)  # -> flatten(Length)
concatenate = Concatenate(Fragment_A=integer_2, A=" ", Fragment_B=fragment_b)
list_item = ListItem(List=list_length, Index=0, Wrap=True)
panel = Panel(concatenate)
ghpython_script = GhPythonScript(x=flatten(concatenate), y=y, z=list_item)  # -> out, a, b; inputs x: list
# ---------- ghpython_script: Python ----------
__author__ = "lt4840"
__version__ = "2024.04.10"

import rhinoscriptsyntax as rs
import ghpythonlib.treehelpers as th

pointIndexList = []
distanceList = []
c = 0
for item in x:
    b = item.split()
    pointIndex = int(b[0])
    distance = float(b[1])
#if in indexList replace with new index+distance (if distance is smaller) or skip this index (if distance is larger)
    if pointIndex in pointIndexList: 
        i = pointIndexList.index(pointIndex)
        d = distanceList[i] #distance of point already in list
        r = i%4 #index of point within grafted list
        print r
        if (d < distance and r<2) or distance >= y: #keep original pointIndex and append "null"
            pointIndexList.append("")
            distanceList.append("")
        else: #replace original pointIndex with "null" and append this pointIndex
            pointIndexList[i] = ""
            distanceList[i] = ""
            pointIndexList.append(pointIndex)
            distanceList.append(distance)
    else:
        if distance < y:
            pointIndexList.append(pointIndex)
            distanceList.append(distance)
        else:
            pointIndexList.append("")
            distanceList.append("")
    c += 1
a = pointIndexList
b = distanceList
# ---------- end ghpython_script ----------
panel_2 = Panel(ghpython_script.a)
partition_list = PartitionList(List=ghpython_script.a, Size=list_length)
panel_3 = Panel(partition_list)
text_length = TextLength(Text=partition_list)
equality = Equality(FirstNumber=text_length, SecondNumber="0")  # -> Equality, Inequality
dispatch = Dispatch(List=partition_list, DispatchPattern=equality.Equality)  # -> ListA, ListB
panel_4 = Panel("""0
1""")
list_item_2 = ListItem(List=dispatch.ListB, Index=panel_4, Wrap=True)
delete_consecutive = DeleteConsecutive(Set=list_item_2, Wrap=False)  # -> Set, Count
panel_5 = Panel(delete_consecutive.Set)
set = ClusterOutput(delete_consecutive.Set)
