# Grasshopper definition NetworkGenerator_ToolpathAngle_v1_20240530.gh (Grasshopper 1.0.7)
# plug-ins: Pufferfish, Wombat

# ---- group: Surface
xz_plane = XZPlane(Origin=Point(0, 0, 0))
plane_surface = PlaneSurface(Plane=xz_plane, XSize="2.5 to 45.5", YSize="2.5 to 45.5")

xz_plane_2 = XZPlane(Origin=Point(0, 0, 0))
plane_surface_2 = PlaneSurface(Plane=xz_plane_2, XSize="2.5 to 45.5", YSize="2.5 to 45.5")

# ---- group: Points for the channel network to connect
populate_geometry = PopulateGeometry(Geometry=plane_surface_2, Count=Slider(100, range=0..200), Seed=1)

# ---- group: Volume
center_box = CenterBox(Base=PlaneXY(0, 0, 0), X="20", Y="20", Z="20")

# ----
# L. Tomholt, F. Meggers, and R. Moini (2024) 3D-Printing Channel Networks with Cement Paste. Fourth RILEM International Conference on Concrete and Digital Fabrication. Digital Concrete 2024. (Under review)
# 
# NetworkGenerator_ToolpathAngle_v1_20240530.gh, available at https://github.com/AM2Lab/NetworkGenerator_ToolpathOptimizer.git.
panel = Panel("0,0,0")
inlet_point = Point(panel)

# ---- group: Surface
xy_plane = XYPlane(Origin=Point(0, 0, 0))
plane_surface_3 = PlaneSurface(Plane=xy_plane, XSize="-100 to 30", YSize="-20 to 20")

# ----
inlet_point_2 = Point("0,0,0")

inlet_point_3 = Point("-10,-10,-10")

# ---- group: Points for the channel network to connect
point = Point([Point(47.13913486, 0, 43.53222609), Point(47.23314773, 0, 26.51546674), Point(21.19158328, 0, 14.4050336), Point(29.82047246, 0, 19.257601), Point(38.73194855, 0, 21.22952445), Point(32.09932967, 0, 29.60175842), Point(37.65586441, 0, 37.27515354), Point(9.572380095, 0, 10.50304307), Point(12.49067435, 0, 24.75061622), Point(16.99714712, 0, 34.34126232), Point(10.93622433, 0, 48.39138834), Point(25.84193229, 0, 46.7286636)])

# ----
# Example 5: sample C (Fig. 6C)
# Channel network type: Unconnected
point_2 = Point([Point(-54.20041916, 0, 0), Point(-91.15083639, 0, 0), Point(-35.72521054, 6.5, 0), Point(-72.67562777, 6.5, 0), Point(-35.72521054, -6.5, 0), Point(-72.67562777, -6.5, 0), Point(-54.20041916, -13, 0), Point(-54.20041916, 13, 0), Point(-17.25000193, 0, 0), Point(-19.70041723, 0, 0), Point(-56.65083446, 0, 0), Point(-1.225208614, 6.5, 0), Point(-38.17562584, 6.5, 0), Point(-1.225208614, -6.5, 0), Point(-38.17562584, -6.5, 0), Point(-19.70041723, -13, 0), Point(-19.70041723, 13, 0), Point(17.25, 0, 0)])
keep_empty_for_2d_network = Panel("")
entwine = Entwine(Branch01=point_2, Branch02=plane_surface_3, Branch03=keep_empty_for_2d_network, FlattenInputs=True)

# ----
# Example 1: 2D network (Fig. 5)
# Channel network type: 2D and 3D Branching with Proximity 3D
# Number of closest points = 3
# Channel radius: XX with Murray's Law
keep_empty_for_2d_network_2 = Panel("")
entwine_2 = Entwine(Branch00=inlet_point, Branch01=point, Branch02=plane_surface, Branch03=keep_empty_for_2d_network_2, FlattenInputs=True)

# ----
# Example 2: 2D network (more points)
keep_empty_for_2d_network_3 = Panel("")
entwine_3 = Entwine(
    Branch00=inlet_point_2,
    Branch01=populate_geometry,
    Branch02=plane_surface_2,
    Branch03=keep_empty_for_2d_network_3,
    FlattenInputs=True)

# ----
# Settings
# Note 1: Murray's law can only be applied to branching networks, i.e.,:
# - 2D and 3D Branching with Proximity 3D
# - Dichotomous Branching
# Note 2: uses the defined channel radius for the smallest daughter branches.
channel_network_type = ValueList({"2D and 3D Branching with Proximity 3D": 0, "2D and 3D Interconnected (no intersecting curves)": 1, "Dichotomous branching": 2, "2D Voronoi": 3, "3D Voronoi": 4, "2D and 3D Unconnected": 5}, selected="2D and 3D Branching with Proximity 3D")
explode_tree = ExplodeTree(Data=entwine_2)  # -> Branch0, Branch1, Branch2, Branch3
apply_murray_s_law = BooleanToggle(True)
filament_height = Slider(1, range=0..3)
extrusion_multiplier_em = Panel("3.67")
channel_inner_radius = Slider(1, range=0..10)
nozzle_diameter_mm = Slider(1.36, range=0..10)
overlap = Slider(10, range=0..100)
toolpath_angle_beta_degrees = Slider(0, range=0..180)
surface = Surface(explode_tree.Branch2)
inlet_point_4 = Point(explode_tree.Branch0)
point_3 = Point(explode_tree.Branch1)
box = Box(explode_tree.Branch3)
ghpython_script = GhPythonScript(nozzleDiameter=nozzle_diameter_mm, overlap=overlap, filamentHeight=filament_height, EM=extrusion_multiplier_em)  # -> out, filamentOffset, filamentWidth, EC; inputs overlap: Int32
# ---------- ghpython_script: Python ----------
__author__ = "Wyss User"
__version__ = "2022.11.08"

import rhinoscriptsyntax as rs
import math

d = nozzleDiameter
h = filamentHeight

y = 1.20 #constant
a = round(d*y,2) * ((100-overlap)/100)
b = a / 2
D = round(d*y,2)

u = 4*h * EM
v = math.pi * d * d
EC = u / v

filamentWidth = D
filamentOffset = a
# ---------- end ghpython_script ----------
effective_layer_width = Panel(ghpython_script.filamentOffset)
filament_width = Number(ghpython_script.filamentWidth)
extrusion_constant_ec = Panel(ghpython_script.EC)
filament_width_2 = Panel(filament_width)

# ----
# Settings
number_of_closest_points = Slider(3, range=0..10)
number_of_closest_points_2 = Slider(6, range=0..10)
remove_perimeter_curves = BooleanToggle(True)
remove_boundary_curves = BooleanToggle(False)
vector_direction_of_channels = Panel("1,0,0")

# ---- group: Smaller value creates shorter paths
max_curve_length = Slider(20, range=0..100)

# ---- group: Larger value reduces risk of points not being included
number_of_closest_points_3 = Slider(8, range=0..100)

# ----
# Channel network types
ghpython_script_2 = GhPythonScript(x=channel_network_type)  # -> out, a
# ---------- ghpython_script_2: Python ----------
__author__ = "lt4840"
__version__ = "2024.04.15"

import rhinoscriptsyntax as rs

executeList = [False, False, False, False, False, False]
executeList[x] = True
a = executeList
# ---------- end ghpython_script_2 ----------
explode_tree_2 = ExplodeTree(Data=graft(ghpython_script_2.a))  # -> Branch0, Branch1, Branch2, Branch3, Branch4, Branch5
_2d_and_3d_branching_with_proximity_3d = _2DAnd3DBranchingWithProximity3D(inlet_point=inlet_point_4, point=point_3, y=number_of_closest_points, x=explode_tree_2.Branch0)
_2d_and_3d_interconnected_no_intersectin = _2DAnd3DInterconnectedNoIntersectingCurves_2(points=inlet_point_4, points_2=point_3, y=number_of_closest_points_2, x=explode_tree_2.Branch1)  # "2D and 3D Interconnected (no intersecting curves)"
dichotomous_branching = DichotomousBranching(
    inlet_point=inlet_point_4,
    point=point_3,
    number=max_curve_length,
    number_2=number_of_closest_points_3,
    boolean=explode_tree_2.Branch2)
_3d_voronoi = _3DVoronoi(y=point_3, box=box, path=remove_boundary_curves, x=explode_tree_2.Branch4)
_2d_and_3d_unconnected = _2DAnd3DUnconnected(vector=vector_direction_of_channels, y=point_3, x=explode_tree_2.Branch5)
_2d_voronoi = _2DVoronoi(y=point_3, surface=surface, path=remove_perimeter_curves, x=explode_tree_2.Branch3)
entwine_4 = Entwine(
    Branch00=_2d_and_3d_branching_with_proximity_3d,
    Branch01=_2d_and_3d_interconnected_no_intersectin,
    Branch02=dichotomous_branching,
    Branch03=_2d_voronoi,
    Branch04=_3d_voronoi,
    Branch05=_2d_and_3d_unconnected,
    FlattenInputs=True)  # -> simplify(Result)
tree_branch = TreeBranch(Tree=entwine_4, Path=channel_network_type, MaintainPaths=True)
project_curves_if_surface_is_non_planar = ProjectCurvesIfSurfaceIsNonPlanar(network_curves_unique_lines=tree_branch, surface=surface)
network_curves_unique_lines = Curve(project_curves_if_surface_is_non_planar)

# ----
# Channel radii
apply_murray_s_law_branching_networks = ApplyMurraysLawBranchingNetworks(network_curves_unique_lines=network_curves_unique_lines, inlet_point=inlet_point_4, number=channel_inner_radius)
radii = Number(apply_murray_s_law_branching_networks)
entwine_5 = Entwine(Branch00=channel_inner_radius, Branch01=radii, FlattenInputs=True)
tree_branch_2 = TreeBranch(Tree=simplify(entwine_5), Path=apply_murray_s_law, MaintainPaths=True)

# ----
# Input
# Smaller value: greater chances of successful
# Sweep in "Generate filament geometry"
# Larger value: more precise toolpaths for the
# desired channel geometry
cluster = Cluster_2(vector_a=network_curves_unique_lines)
filament_offset_from_overlap = Number(ghpython_script.filamentOffset)
channel_radii = Number(tree_branch_2)
curve = Curve(network_curves_unique_lines)
filament_width_3 = Number(filament_width)
filament_height_2 = Number(filament_height)
toolpath_angle_beta_degrees_2 = Number(toolpath_angle_beta_degrees)
surface_2 = Surface(surface)
precision = Slider(0.5, range=0..2)

channel_radii_2 = Number(tree_branch_2)

# ----
# Geometry of channel inner cavity
# Note: the actual channel inner radius as
# measured by "Mesh network with Cocoon for
# toolpaths" may have a larger value if a
# branching geometry is present close to the
# curve.
# Note: generating the channel network
# geometry may take some time for larger
# networks. Set to "False" when changing the
# settings.
number_slider = Slider(500, range=0..500)
execute = BooleanToggle(False)
curve_2 = Curve(network_curves_unique_lines)
desired_channel_inner_radii = Panel(channel_radii_2)
mesh_network_with_cocoon = MeshNetworkWithCocoon(curve=curve_2, radius=desired_channel_inner_radii, charge_strengths=number_slider, execute=execute)  # -> mesh, flatten(a)
actual_channel_inner_radii = Panel(mesh_network_with_cocoon.a)
custom_preview = CustomPreview(Geometry=mesh_network_with_cocoon.mesh, Material=ColourSwatch(SwatchColor=RGB(204, 99, 0)))

# ----
# Note: the actual channel inner radius as
# measured by "Mesh network with Cocoon for
# toolpaths" may have a larger value if a
# branching geometry is present close to the
# curve.
# Generate toolpaths
# For 2D networks in the XZ plane only
# Note: generating the channel network
# geometry may take some time for larger
# networks. Set to "False" when changing the
# Settings.
cluster_2 = Cluster(A_2=filament_width_3, A=filament_height_2, angle_2=toolpath_angle_beta_degrees_2, angle=cluster)
execute_2 = BooleanToggle(False)
desired_channel_inner_radii_2 = Panel(channel_radii)
mesh_network_with_cocoon_for_toolpaths = MeshNetworkWithCocoonForToolpaths(curve=curve, A=desired_channel_inner_radii_2, charge_strengths=number_slider, B=cluster_2, execute=execute_2)  # -> mesh, flatten(a)
actual_channel_inner_radii_2 = Panel(mesh_network_with_cocoon_for_toolpaths.a)

sort_list = SortList(Keys=mesh_network_with_cocoon_for_toolpaths.a)  # -> Keys, ValuesValuesA
list_item = ListItem(List=sort_list.Keys, Index="-1", Wrap=True)

# ---- group: Slightly smaller surface to ensure proper Mesh Union
area = Area(Geometry=surface_2)  # -> Area, Centroid
scale = Scale(Geometry=surface_2, Center=area.Centroid, Factor="0.99")  # -> Geometry, Transform

# ----
multiplication = Multiplication(A=list_item, B="3")
negative = Negative(Value=multiplication)
division = Division(A=filament_offset_from_overlap, B="2")
offset_surface = OffsetSurface(Surface=scale.Geometry, Distance=multiplication, BothSides=negative, CreateSolid=True)
negative_2 = Negative(Value=division)
mesh_intersection = MeshIntersection(MeshesA=mesh_network_with_cocoon_for_toolpaths.mesh, MeshesB=offset_surface)
offset_surface_2 = OffsetSurface(Surface=surface_2, Distance=division, BothSides=negative_2, CreateSolid=True)
mesh_union = MeshUnion(Meshes=flatten([offset_surface_2, mesh_intersection]))

# ---- group: Notify and cancel mesh union if not successful
ghpython_script_3 = GhPythonScript(x=mesh_union)  # -> out, a; inputs x: list
# ---------- ghpython_script_3: Python ----------
__author__ = "lt4840"
__version__ = "2024.04.19"

import rhinoscriptsyntax as rs

if len(x)>1:
    a = ""
    print "Mesh Union did not succeed"
else:
    a = x
# ---------- end ghpython_script_3 ----------

# ----
error = Panel(ghpython_script_3.out)

# ---- group: Generate toolpaths using Contour component
generate_toolpaths = GenerateToolpaths(
    shape=ghpython_script_3.a,
    toolpath_angle_beta_degrees=toolpath_angle_beta_degrees_2,
    filament_height=filament_height_2,
    brep=scale.Geometry,
    number=multiplication)  # -> geometry, inside
toolpaths = Curve(generate_toolpaths.inside)

# ---- group: Select toolpaths of one side (lowest Y value)
select_toolpaths_on_one_side = SelectToolpathsOnOneSide(toolpathangle=toolpath_angle_beta_degrees_2, toolpaths=toolpaths)
toolpaths_of_one_side = Curve(select_toolpaths_on_one_side)

# ---- group: Rebuild toolpaths (reduce number of vertices to allow for fillet of curves)
rebuild_curves = RebuildCurves(toolpaths_of_one_side=toolpaths_of_one_side, A=precision)  # -> curve, points
rebuilt_toolpaths = Curve(rebuild_curves.curve)

# ----
# Input
rebuilt_toolpaths_2 = Curve(rebuilt_toolpaths)
toolpath_angle_beta_degrees_3 = Number(toolpath_angle_beta_degrees)
filament_width_4 = Number(filament_width)
filament_height_3 = Number(filament_height)
toolpath_points = Point(rebuild_curves.points)

# ----
# Example 3: 3D network
number_slider_2 = Slider(10, range=0..100)
populate_geometry_2 = PopulateGeometry(Geometry=center_box, Count=number_slider_2, Seed=1)
keep_empty_for_3d_network = Panel("")

# ---- group: Points for the channel network to connect
point_4 = Point(populate_geometry_2)

# ----
entwine_6 = Entwine(Branch00=inlet_point_3, Branch01=point_4, Branch02=keep_empty_for_3d_network, Branch03=center_box, FlattenInputs=True)

# ----
# Example 4: 3D network on a non-planar surface
number_slider_3 = Slider(15, range=0..100)
curve_3 = Curve([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])
loft = Loft(Curves=curve_3, Options={Adjust=False, Closed=False, LoftEnds=0, LoftSimp=0, LoftType=1, Rebuild=10, Refit=0.01})
end_points = EndPoints(Curve=curve_3)  # -> Start, End
populate_geometry_3 = PopulateGeometry(Geometry=loft, Count=number_slider_3, Seed=2)
list_item_2 = ListItem(List=end_points.Start, Index=0, Wrap=True)
inlet_point_5 = Point(list_item_2)
keep_empty_for_2d_network_4 = Panel("")

# ---- group: Points for the channel network to connect
point_5 = Point(populate_geometry_3)

# ----
entwine_7 = Entwine(Branch00=inlet_point_5, Branch01=point_5, Branch02=loft, Branch03=keep_empty_for_2d_network_4, FlattenInputs=True)

# ----
# Generate filament geometry
curve_closest_point = CurveClosestPoint(Point=toolpath_points, Curve=rebuilt_toolpaths_2)  # -> Point, Parameter, Distance
ghpython_script_4 = GhPythonScript(x=filament_width_4)  # -> out, neg, pos
# ---------- ghpython_script_4: Python ----------
__author__ = "lt4840"
__version__ = "2024.04.16"

import rhinoscriptsyntax as rs

neg = x/-2
pos = x/2
# ---------- end ghpython_script_4 ----------
ghpython_script_5 = GhPythonScript(x=filament_height_3)  # -> out, neg, pos; same code as ghpython_script_4
construct_domain = ConstructDomain(DomainStart=ghpython_script_4.neg, DomainEnd=ghpython_script_4.pos)
construct_domain_2 = ConstructDomain(DomainStart=ghpython_script_5.neg, DomainEnd=ghpython_script_5.pos)
perp_frame = PerpFrame(Curve=rebuilt_toolpaths_2, Parameter=curve_closest_point.Parameter)

# ---- group: Make sure plane orientations are correct if toolpath angle is 90 or 180
cluster_3 = Cluster_4(toolpath_angle_beta_degrees=toolpath_angle_beta_degrees_3, plane=perp_frame)

# ---- group: Filament profile
filament_width_5 = Panel(construct_domain)
filament_height_4 = Panel(construct_domain_2)
rectangle = Rectangle(Plane=cluster_3, XSize=filament_width_5, YSize=filament_height_4, Radius=0)  # -> Rectangle, Length
fillet = Fillet(Curve=rectangle.Rectangle, Radius="0.4")

# ----
sweep1 = Sweep1(Rail=rebuilt_toolpaths_2, Sections=fillet, Miter=1)

cap_holes = CapHoles(Brep=sweep1)

filament_geometry = Brep(simplify(cap_holes))

# ----
# Input
# Lower value: more accurate overhang
# geometries and volume calculation.
# Higher value: exclude small overhangs
# that are artifacts of model imperfection.
dimensions = Dimensions(Surface=surface_2)  # -> UDimension, VDimension
precision_2 = Slider(0.02, range=0..0.1)
sufficient_to_cover_widest_channel = Number(multiplication)
toolpath_angle_beta_degrees_4 = Number(toolpath_angle_beta_degrees)
filament_geometry_2 = Brep(simplify(filament_geometry))
rebuilt_toolpaths_3 = Curve(rebuilt_toolpaths)
filament_height_5 = Number(filament_height)
toolpath_plane = Plane(generate_toolpaths.geometry)
filament_width_6 = Number(filament_width)
sample_height = Number(dimensions.VDimension)

filament_geometry_3 = Brep(simplify(filament_geometry_2))

addition = Addition(A=filament_width_6, B=precision_2)
ghpython_script_6 = GhPythonScript(x=addition)  # -> out, neg, pos; same code as ghpython_script_4
offset_curve = OffsetCurve(
    Curve=rebuilt_toolpaths_3,
    Plane=toolpath_plane,
    Distance=ghpython_script_6.pos,
    BothSides=ghpython_script_6.neg,
    Kinks=0,
    CapType=0)  # -> simplify(Offset)
end_points_2 = EndPoints(Curve=offset_curve)  # -> Start, End
deconstruct = Deconstruct(Point=end_points_2.Start)  # -> XComponent, YComponent, ZComponent
sort_list_2 = SortList(Keys=deconstruct.YComponent, ValuesValuesA=offset_curve)  # -> Keys, reverse(ValuesValuesA)
list_item_3 = ListItem(List=sort_list_2.ValuesValuesA, Index=0, Wrap=True)
sufficient_length = Number(sufficient_to_cover_widest_channel)
unit_z = UnitZ(Factor=sample_height)

curve_4 = Curve(list_item_3)

end_points_3 = EndPoints(Curve=curve_4)  # -> Start, End
line_sdl = LineSDL(Start=end_points_3.Start, Direction="0,1,0", Length=sufficient_length)
line_sdl_2 = LineSDL(Start=end_points_3.End, Direction="0,1,0", Length=sufficient_length)
join_curves = JoinCurves(Curves=[line_sdl, line_sdl_2, curve_4], Preserve=False)
close_curve = CloseCurve(Curve=join_curves, CloseType=0, Bulge=0.5, Tolerance=0)  # -> Closed, ResultBoolean
boundary_surfaces = BoundarySurfaces(Edges=close_curve.Closed)
extrude = Extrude(Base=boundary_surfaces, Direction=unit_z)  # -> simplify(Extrusion)
geometry_of_channel_cavity = Brep(extrude)

# ----
# Model overhangs
# Note: in this version, overhangs are not modeled correctly for more vertical toolpaths (e.g., approaching 90 degrees)
ghpython_script_7 = GhPythonScript(filamentHeight=filament_height_5, toolpathAngle=toolpath_angle_beta_degrees_4)  # -> out, a
# ---------- ghpython_script_7: Python ----------
__author__ = "lt4840"
__version__ = "2024.04.16"

import rhinoscriptsyntax as rs

neg = filamentHeight/-2
pos = filamentHeight/2
if toolpathAngle > 90:
    a = neg
else:
    a = pos
# ---------- end ghpython_script_7 ----------
amplitude = Amplitude(Vector=toolpath_plane, Amplitude=ghpython_script_7.a)
move = Move(Geometry=geometry_of_channel_cavity, Motion=amplitude)  # -> Geometry, Transform
filament_geometry_4 = Brep(simplify(filament_geometry_2))
tree_statistics = TreeStatistics(Tree=filament_geometry_4)  # -> Paths, Length, Count
tree_statistics_2 = TreeStatistics(Tree=move.Geometry)  # -> Paths, Length, Count
cull_index = CullIndex(List=tree_statistics.Paths, Indices="0", Wrap=True)
cull_index_2 = CullIndex(List=tree_statistics_2.Paths, Indices="-1", Wrap=True)
tree_branch_3 = TreeBranch(Tree=filament_geometry_4, Path=cull_index, MaintainPaths=True)
tree_branch_4 = TreeBranch(Tree=move.Geometry, Path=cull_index_2, MaintainPaths=True)
match_tree = MatchTree(Tree=tree_branch_3, Guide=tree_branch_4)

# ----
# python script looks a bit messy: to clean up
max_movement = Slider(-0.01, range=-0.02..0)
toolpath_angle_beta_degrees_5 = Number(toolpath_angle_beta_degrees_4)
error_message = Panel("Overhang volume could not be generated")
cluster_4 = Cluster_5(angle=toolpath_angle_beta_degrees_5, A=max_movement, geometry=tree_branch_4)
tolerance = Panel("0.99")
ghpython_script_8 = GhPythonScript(filamentBrep=match_tree, unsupportedVolumeBrep=simplify(cluster_4), tolerance=tolerance, errorMessage=error_message)  # -> out, overhangBrep, overhangVolume, error, a; inputs filamentBrep: Brep, unsupportedVolumeBrep: list of Brep
# ---------- ghpython_script_8: Python ----------
__author__ = "lt4840"
__version__ = "2024.04.23"

import rhinoscriptsyntax as rs
import Rhino.Geometry as rg
import Rhino

tol = Rhino.RhinoDoc.ActiveDoc.ModelAbsoluteTolerance


overhangBrepList = []
volumeOverhangList = []
success = False

if (unsupportedVolumeBrep[0] is None) or (filamentBrep is None) or (solidUnionError=="Solid union could not be generated"): 
    error = errorMessage
else:
    volumeFilament = filamentBrep.GetVolume(tol,tol)
    volumeUnsupported = unsupportedVolumeBrep[0].GetVolume(tol,tol)
    volumeFilamentTol = volumeFilament * tolerance
    volumeUnsupportedTol = volumeUnsupported * tolerance
    for i in range(len(unsupportedVolumeBrep)):
        item = unsupportedVolumeBrep[i]
        overhangBrep = rg.Brep.CreateBooleanIntersection(filamentBrep,item,tol,True) #https://developer.rhino3d.com/api/rhinocommon/rhino.geometry.brep/createbooleanintersection?version=8.x
        print overhangBrep
        if overhangBrep is not None and len(overhangBrep)>0:
            for j in range(len(overhangBrep)):
                volumeOverhang = overhangBrep[j].GetVolume(tol,tol)
                if volumeOverhang < volumeUnsupportedTol or volumeOverhang <= volumeFilamentTol:
                    overhangBrepList.append(overhangBrep[j])
                    volumeOverhangList.append(volumeOverhang)
                    success = True
        if success:
            break
# ---------- end ghpython_script_8 ----------
overhang_geometry = Brep(ghpython_script_8.overhangBrep)
error_message_2 = Panel(ghpython_script_8.error)
filament_volume_overhang_mm3 = Number(ghpython_script_8.overhangVolume)

match_tree_2 = MatchTree(Tree=overhang_geometry, Guide=match_tree)

# ----
# Input
# Lower value: more precise span length.
# Higher value: faster computation
exclude_overhangs_smaller_than_mm3 = Slider(0.1, range=0.01..0.1)
material_density_g_cm3 = Panel("2.2")
span_length_precision = Slider(0.03, range=0.01..0.1)
overhang_geometry_2 = Brep(simplify(match_tree_2))
rebuilt_toolpaths_4 = Curve(rebuilt_toolpaths)

# ---- group: Add temporary item to ensure empty lists are not removed in the cluster
list_length = ListLength(List=overhang_geometry_2)
center_box_2 = CenterBox(Base=PlaneXY(0, 0, 0), X=1, Y=1, Z=1)
insert_items = InsertItems(List=overhang_geometry_2, Item=center_box_2, Indices=list_length, Wrap=False)  # -> simplify(List)

# ----
# Calculate moment M
obtain_span_curves_span_length_overhang = ObtainSpanCurvesSpanLengthOverhangVolume(
    rebuilt_toolpaths=rebuilt_toolpaths_4,
    list=insert_items,
    B=span_length_precision,
    second_number=exclude_overhangs_smaller_than_mm3)  # -> list_b_2, list_b, length_2, curve_2; "Obtain span curves, span length, overhang volume"
overhang_volume = Number(obtain_span_curves_span_length_overhang.list_b)
span_curves = Curve(obtain_span_curves_span_length_overhang.curve_2)
span_length = Number(obtain_span_curves_span_length_overhang.length_2)
calculate_m = CalculateM(overhang_volume_mm3=overhang_volume, span_length_mm=span_length, A=material_density_g_cm3)  # -> arithmetic_mean, number_2, result
number = Number(calculate_m.arithmetic_mean)
number_2 = Number(calculate_m.number_2)
m_avg_nmm = Panel(number)
m_max_nmm = Panel(number_2)

span_curves_2 = Curve(span_curves)
overhang_geometry_excluding_extremely_sm = Brep(obtain_span_curves_span_length_overhang.list_b_2)  # "Overhang geometry (excluding extremely small overhangs)"

# ----
# Find optimal toolpath angle beta
toolpath_angle_beta = Number(toolpath_angle_beta_degrees)
m_max = Number(number_2)
m_avg = Number(number)
ghpython_script_9 = GhPythonScript(Mavg=m_avg, Mmax=m_max)  # -> out, a
# ---------- ghpython_script_9: Python ----------
__author__ = "lt4840"
__version__ = "2024.04.18"

import rhinoscriptsyntax as rs

if Mavg == 0.125 or Mmax == 0.125:
    a = "Moment could not be obtained"
# ---------- end ghpython_script_9 ----------
error_2 = Text(ghpython_script_9.a)
file_name = Panel("sample_20240418.txt")
concatenate = Concatenate(Fragment_B=toolpath_angle_beta, E=";", A=m_avg, F=";", B=m_max, G=";", I=error_2)
folder = Panel("C:\Users\lt4840\OneDrive - Princeton University\Desktop\")
data_recorder = DataRecorder(concatenate, DataLimit=-10, RecordData=False)
panel_2 = Panel(data_recorder)
write_to_text_file = BooleanToggle(False)
concatenate_2 = Concatenate(FragmentA=folder, FragmentB=file_name)
write_to_text_file_2 = WriteToTextFile(Run=write_to_text_file, TextToWrite=flatten(data_recorder), FilePath=concatenate_2, Append=False, NewOnly=False)
panel_3 = Panel(write_to_text_file_2)

# ----
# Visualize filament, overhang, span curves
overhang_geometry_3 = Brep(simplify(overhang_geometry_excluding_extremely_sm))
toolpath_angle_beta_degrees_6 = Number(toolpath_angle_beta_degrees)
filament_geometry_5 = Brep(simplify(filament_geometry_3))
span_curves_3 = Curve(span_curves_2)
text_location = Panel("-15,-15,27")
xz_plane_3 = XZPlane(Origin=Point(0, 0, 0))
concatenate_3 = Concatenate(Fragment_A="Toolpath angle: ", Fragment_B=toolpath_angle_beta_degrees_6, A=" degrees")
gradient = Gradient(
    LowerLimit="0",
    UpperLimit=Slider(3e-05, range=0..0.0001),
    Parameter=calculate_m.result,
    stops=[0: RGB(0, 128, 0), 0.499: RGB(255, 255, 0), 1: RGB(255, 0, 0)])
mirror = Mirror(Geometry=filament_geometry_5, Plane=xz_plane_3)  # -> Geometry, Transform
mirror_2 = Mirror(Geometry=span_curves_3, Plane=xz_plane_3)  # -> Geometry, Transform
xz_plane_4 = XZPlane(Origin=text_location)
custom_preview_2 = CustomPreview(Geometry=[filament_geometry_5, mirror.Geometry], Material=ColourSwatch(SwatchColor=RGBA(255, 255, 255, 20)))
text_tag_3d = TextTag3D(Location=xz_plane_4, Text=concatenate_3, Size=1, Colour=ColourSwatch(SwatchColor=RGB(0, 0, 0)), Justification=1)
custom_preview_3 = CustomPreview(Geometry=[span_curves_3, mirror_2.Geometry], Material=ColourSwatch(SwatchColor=RGB(0, 0, 0)))

# ---- group: Ensure the data tree paths for Overhang geometry and M values are the same
prune_tree = PruneTree(Tree=overhang_geometry_3, Minimum="1", Maximum=0)

# ----
overhang_geometry_4 = Brep(simplify(prune_tree))
mirror_3 = Mirror(Geometry=overhang_geometry_4, Plane=xz_plane_3)  # -> Geometry, Transform
custom_preview_4 = CustomPreview(Geometry=[mirror_3.Geometry, overhang_geometry_4], Material=gradient)

file_name_2 = Panel("sample_20240418.txt")
concatenate_4 = Concatenate(FragmentA=folder, FragmentB=file_name_2)
read_file = ReadFile(File=concatenate_4, PerLineParse=True)
text_split = TextSplit(Text=read_file, Separators=";")  # -> simplify(Result)
index_toolpath_angle_beta = Panel("0")
index_m_avg = Panel("1")
index_m_max = Panel("2")

# ---- group: Remove erroneous results
index_error = Panel("3")
list_item_4 = ListItem(List=text_split, Index=index_error, Wrap=True)  # -> flatten(Item)
ghpython_script_10 = GhPythonScript(x=list_item_4)  # -> out, branches; inputs x: list
# ---------- ghpython_script_10: Python ----------
__author__ = "lt4840"
__version__ = "2024.04.18"

import rhinoscriptsyntax as rs

branches = []

for i in range(len(x)):
    print i
    print "x[i] is", x[i]
    if x[i] == "":
        print "hello"
        branches.append(i)
# ---------- end ghpython_script_10 ----------
tree_branch_5 = TreeBranch(Tree=text_split, Path=ghpython_script_10.branches, MaintainPaths=True)

# ----
list_item_5 = ListItem(List=tree_branch_5, Index=index_m_avg, Wrap=True)  # -> flatten(Item)
list_item_6 = ListItem(List=tree_branch_5, Index=index_toolpath_angle_beta, Wrap=True)  # -> flatten(Item)
list_item_7 = ListItem(List=tree_branch_5, Index=index_m_max, Wrap=True)  # -> flatten(Item)
sort_list_3 = SortList(Keys=list_item_5, ValuesValuesA=list_item_6)  # -> Keys, ValuesValuesA
sort_list_4 = SortList(Keys=list_item_7, ValuesValuesA=list_item_6)  # -> Keys, ValuesValuesA
list_item_8 = ListItem(List=sort_list_3.ValuesValuesA, Index=0, Wrap=True)
list_item_9 = ListItem(List=sort_list_4.ValuesValuesA, Index=0, Wrap=True)
quick_graph = QuickGraph(list_item_5, SortOrder=0)
toolpath_angle_beta_with_smallest_m_avg = Panel(list_item_8)
toolpath_angle_beta_with_smallest_m_max = Panel(list_item_9)
quick_graph_2 = QuickGraph(list_item_7, SortOrder=0)

# ----
# Complete toolpaths for printing
rebuilt_toolpaths_5 = Curve(rebuilt_toolpaths)
mirror_4 = Mirror(Geometry=rebuilt_toolpaths_5, Plane=xz_plane_3)  # -> Geometry, Transform
flip_curve = FlipCurve(Curve=rebuilt_toolpaths_5)  # -> Curve, Flag
toolpath_fillet_radius = Slider(0.7, range=0..2)
connect_curves = ConnectCurves(Curves=[mirror_4.Geometry, flip_curve.Curve], Continuity=0, Close=False, Bulge=1)
fillet_2 = Fillet(Curve=connect_curves, Radius=toolpath_fillet_radius)  # -> flatten(Curve)
null_item = NullItem(Item=fillet_2)  # -> NullFlags, InvalidFlags, Description
dispatch = Dispatch(List=fillet_2, DispatchPattern=null_item.NullFlags)  # -> ListA, ListB

# ---- group: Move onto built plate (z = 0)
end_points_4 = EndPoints(Curve=dispatch.ListB)  # -> Start, End
list_item_10 = ListItem(List=end_points_4.Start, Index=0, Wrap=True)
deconstruct_2 = Deconstruct(Point=list_item_10)  # -> XComponent, YComponent, ZComponent
negative_3 = Negative(Value=deconstruct_2.ZComponent)
unit_z_2 = UnitZ(Factor=negative_3)
move_2 = Move(Geometry=dispatch.ListB, Motion=unit_z_2)  # -> Geometry, Transform

# ----
custom_preview_5 = CustomPreview(Geometry=move_2.Geometry, Material=ColourSwatch(SwatchColor=RGB(0, 0, 0)))

# ----
# Input
area_2 = Area(Geometry=surface)  # -> Area, Centroid
project = Project(Geometry=area_2.Centroid, Plane=PlaneXY(0, 0, 0))  # -> Geometry, Transform
move_nozzle_out_of_the_way_before_move_t = Panel("0,30,0")  # "Move nozzle out of the way before move to origin"
angle_tolerance_curves = Slider(0.05, range=0..1)
model_on_bed_angle = Slider(0, range=-360..360)
print_coarseness = Slider(0.3, range=0..1)
skirt_radius_1 = Slider(45, range=0..100)
skirt_radius_2 = Slider(25, range=0..100)
filament_offset_from_overlap_2 = Number(ghpython_script.filamentOffset)
filament_curves_start_at_z_0 = Curve(move_2.Geometry)
extrusion_constant = Number(ghpython_script.EC)
high_speed = Panel(" F2000")
nozzle_diameter = Number(nozzle_diameter_mm)
speed = Panel("750")
model_center = Point(project.Geometry)
overlap_2 = Number(overlap)

# ----
# Generate Gcode
cluster_5 = Cluster_3(
    number_3=print_coarseness,
    integer=speed,
    text=high_speed,
    fragment_b=nozzle_diameter,
    fragment_b_2=overlap_2,
    number=extrusion_constant,
    number_2=model_on_bed_angle,
    tolerance_angle=angle_tolerance_curves,
    model_center=model_center,
    geometry=filament_curves_start_at_z_0,
    A=filament_offset_from_overlap_2,
    radius_1=skirt_radius_1,
    radius_2=skirt_radius_2,
    motion=move_nozzle_out_of_the_way_before_move_t)  # -> result, curves, rectangle

filament_path = Curve(cluster_5.curves)
print_bed = Curve(cluster_5.rectangle)
gcode = Text(cluster_5.result)

number_slider_4 = Slider(0.2503, range=0..1)
evaluate_length = EvaluateLength(Curve=filament_path, Length=number_slider_4, Normalized=True)  # -> Point, Tangent, Parameter
custom_preview_6 = CustomPreview(Geometry=evaluate_length.Point, Material=ColourSwatch(SwatchColor=RGB(0, 0, 0)))

mm3_ml_conversion_factor = Panel("0.001")
length = Length(Curve=filament_path)
multiplication_2 = Multiplication(A=channel_inner_radius, B=filament_width, C=length, D=mm3_ml_conversion_factor)
cement_volume_ml = Panel(multiplication_2)

complete_gcode = Panel(gcode)

# ==== cluster MeshNetworkWithCocoon
curve = ClusterInput()
radius = ClusterInput()
charge_strengths = ClusterInput()
execute = ClusterInput()
curve_2 = Curve(curve)
curve_charge = CurveCharge(Curve=curve, Radius=radius, ChargeStrengths=charge_strengths)
curve_middle = CurveMiddle(Curve=curve_2)
curve_closest_point = CurveClosestPoint(Point=curve_middle, Curve=curve_2)  # -> Point, Parameter, Distance
cocoon = Cocoon(Charges=curve_charge, Iso=Slider(0.15, range=0..10), CellSize=Slider(0.4, range=0..10), Execute=execute, Simple=False)  # -> Mesh, RefinementData
perp_frame = PerpFrame(Curve=curve_2, Parameter=curve_closest_point.Parameter)
quicksmooth = QuickSmooth(Mesh=cocoon.Mesh, Step=0.5, Iterations=Slider(10, range=0..10))
mesh_plane = MeshPlane(Mesh=quicksmooth, Plane=perp_frame)
mesh = ClusterOutput(quicksmooth)
area = Area(Geometry=mesh_plane)  # -> Area, Centroid
distance = Distance(PointA=simplify(area.Centroid), PointB=simplify(graft(curve_middle)))
sort_list = SortList(Keys=distance, ValuesValuesA=mesh_plane)  # -> Keys, ValuesValuesA
list_item = ListItem(List=sort_list.ValuesValuesA, Index=0, Wrap=True)
area_2 = Area(Geometry=list_item)  # -> Area, Centroid
pi = Pi(Factor=1)
division = Division(A=area_2.Area, B=pi)
square_root = SquareRoot(Value=division)
list_length = ListLength(List=quicksmooth)
ghpython_script = GhPythonScript(x=list_length, y=square_root)  # -> out, a
# ---------- ghpython_script: Python ----------
__author__ = "lt4840"
__version__ = "2024.04.12"

import rhinoscriptsyntax as rs

if x>0:
    a = y
else:
    a = []
# ---------- end ghpython_script ----------
a = ClusterOutput(ghpython_script.a)

# ==== cluster _2DAnd3DBranchingWithProximity3D
x = ClusterInput()
y = ClusterInput()
inlet_point = ClusterInput()
point = ClusterInput()
inlet_point_2 = Point(inlet_point)
point_2 = Point(point)
ghpython_script = GhPythonScript(x=x, y=y)  # -> out, a
# ---------- ghpython_script: Python ----------
__author__ = "lt4840"
__version__ = "2024.04.15"

import rhinoscriptsyntax as rs

if x:
    a = y
else:
    a = ""
# ---------- end ghpython_script ----------
closest_point = ClosestPoint(Point=inlet_point_2, Cloud=point_2)  # -> ClosestPoint, CPIndex, Distance
_2d_and_3d_interconnected_no_intersectin = _2DAnd3DInterconnectedNoIntersectingCurves(points_2=point_2, group=ghpython_script.a)  # "2D and 3D Interconnected (no intersecting curves)"
line = Line(StartPoint=inlet_point_2, EndPoint=point_2)
line_2 = Line(StartPoint=inlet_point_2, EndPoint=closest_point.ClosestPoint)
shortest_walk = ShortestWalk(Curves=flatten([_2d_and_3d_interconnected_no_intersectin, line_2]), WantedPath=line)  # -> flatten(ShortestWalk), Succession, Direction, Length
explode = Explode(Curve=shortest_walk.ShortestWalk, Recursive=True)  # -> flatten(Segments), Vertices
removeduplicatelines = RemoveDuplicateLines(Lines=explode.Segments, Tolerance=0.01)
unique_lines = ClusterOutput(removeduplicatelines)

# ==== cluster _2DVoronoi
surface = ClusterInput()
y = ClusterInput()
x = ClusterInput()
surface_2 = Surface(surface)
ghpython_script = GhPythonScript(x=x, y=y)  # -> out, a; same code as ghpython_script
voronoi = Voronoi(Points=ghpython_script.a, Boundary=surface_2, BruteForceOverride=False)
explode = Explode(Curve=voronoi, Recursive=True)  # -> flatten(Segments), Vertices
removeduplicatelines = RemoveDuplicateLines(Lines=explode.Segments, Tolerance=0.01)
brep_edges = BrepEdges(Brep=surface_2)  # -> Naked, Interior, NonManifold
curve_middle = CurveMiddle(Curve=removeduplicatelines)
join_curves = JoinCurves(Curves=brep_edges.Naked, Preserve=False)
curve_closest_point = CurveClosestPoint(Point=curve_middle, Curve=join_curves)  # -> Point, Parameter, Distance
tolerance = Panel("0.001")
smaller_than = SmallerThan(FirstNumber=curve_closest_point.Distance, SecondNumber=tolerance)  # -> SmallerThan, OrEqualTo
dispatch = Dispatch(List=removeduplicatelines, DispatchPattern=smaller_than.SmallerThan)  # -> ListA, ListB
entwine = Entwine(Branch00=removeduplicatelines, Branch01=dispatch.ListB, FlattenInputs=True)  # -> simplify(Result)
path = ClusterInput()
tree_branch = TreeBranch(Tree=entwine, Path=path, MaintainPaths=True)
branch = ClusterOutput(tree_branch)

# ==== cluster _3DVoronoi
box = ClusterInput()
y = ClusterInput()
x = ClusterInput()
ghpython_script = GhPythonScript(x=x, y=y)  # -> out, flatten(a)
# ---------- ghpython_script: Python ----------
__author__ = "lt4840"
__version__ = "2024.04.15"

import rhinoscriptsyntax as rs

if x:
    a = y
else:
    a = []
# ---------- end ghpython_script ----------
box_2 = Box(box)
voronoi_3d = Voronoi3D(Points=ghpython_script.a, Box=box_2)  # -> Cells, Boundary
brep_edges = BrepEdges(Brep=voronoi_3d.Cells)  # -> Naked, flatten(Interior), NonManifold
removeduplicatelines = RemoveDuplicateLines(Lines=brep_edges.Interior, Tolerance=0.01)
curve_middle = CurveMiddle(Curve=removeduplicatelines)
tolerance = Panel("0.001")
brep_closest_point = BrepClosestPoint(Point=curve_middle, Brep=box_2)  # -> Point, Normal, Distance
smaller_than = SmallerThan(FirstNumber=brep_closest_point.Distance, SecondNumber=tolerance)  # -> SmallerThan, OrEqualTo
dispatch = Dispatch(List=removeduplicatelines, DispatchPattern=smaller_than.SmallerThan)  # -> ListA, ListB
entwine = Entwine(Branch00=removeduplicatelines, Branch01=dispatch.ListB, FlattenInputs=True)  # -> simplify(Result)
path = ClusterInput()
tree_branch = TreeBranch(Tree=entwine, Path=path, MaintainPaths=True)
branch = ClusterOutput(tree_branch)

# ==== cluster _2DAnd3DInterconnectedNoIntersectingCurves_2
x = ClusterInput()
points = ClusterInput()
points_2 = ClusterInput()
y = ClusterInput()
ghpython_script = GhPythonScript(x=x, y=y)  # -> out, a; same code as ghpython_script
proximity_3d = Proximity3D(Points=flatten([points_2, points]), Group=ghpython_script.a)  # -> flatten(Links), Topology
removeduplicatelines = RemoveDuplicateLines(Lines=proximity_3d.Links, Tolerance=0.01)
cross_reference = CrossReference(ListListA=removeduplicatelines, ListListB=removeduplicatelines, CrossMode=5)  # -> ListListA, ListListB
curve_curve = CurveCurve(CurveA=cross_reference.ListListA, CurveB=cross_reference.ListListB)  # -> Points, ParamsA, ParamsB
graft_tree = GraftTree(Tree=removeduplicatelines, IncludeEmptyLists=True, IncludeNullItems=True)
equality = Equality(FirstNumber=curve_curve.ParamsA, SecondNumber="0")  # -> Equality, Inequality
equality_2 = Equality(FirstNumber=curve_curve.ParamsA, SecondNumber="1")  # -> Equality, Inequality
gate_or = GateOr(A=equality.Equality, B=equality_2.Equality)
dispatch = Dispatch(List=curve_curve.Points, DispatchPattern=gate_or)  # -> ListA, ListB
tolerance = Panel("0.001")
flatten_tree = FlattenTree(Tree=dispatch.ListB, Path="{0}")
curve_closest_point = CurveClosestPoint(Point=flatten_tree, Curve=graft_tree)  # -> Point, Parameter, Distance
smaller_than = SmallerThan(FirstNumber=curve_closest_point.Distance, SecondNumber=tolerance)  # -> SmallerThan, OrEqualTo
mass_addition = MassAddition(Input=smaller_than.SmallerThan)  # -> Result, PartialResults
dispatch_2 = Dispatch(List=graft_tree, DispatchPattern=mass_addition.Result)  # -> ListA, ListB

# ----
# Group curves by shared intersection point and only keep the shortest curve in that group.
curve = Curve(flatten(dispatch_2.ListA))
curve_closest_point_2 = CurveClosestPoint(Point=graft(flatten_tree), Curve=curve)  # -> Point, Parameter, Distance
tolerance_2 = Panel("0.001")
list_length = ListLength(List=curve)
smaller_than_2 = SmallerThan(FirstNumber=curve_closest_point_2.Distance, SecondNumber=tolerance_2)  # -> SmallerThan, OrEqualTo
series = Series(Start=0, Step=1, Count=list_length)
dispatch_3 = Dispatch(List=curve, DispatchPattern=smaller_than_2.SmallerThan)  # -> ListA, ListB
dispatch_4 = Dispatch(List=series, DispatchPattern=smaller_than_2.SmallerThan)  # -> ListA, ListB
length = Length(Curve=dispatch_3.ListA)
sort_list = SortList(Keys=length, ValuesValuesA=dispatch_4.ListA)  # -> Keys, ValuesValuesA
cull_index = CullIndex(List=sort_list.ValuesValuesA, Indices="0", Wrap=True)  # -> flatten(List)
sort_list_2 = SortList(Keys=cull_index)  # -> Keys, ValuesValuesA
delete_consecutive = DeleteConsecutive(Set=sort_list_2.Keys, Wrap=False)  # -> Set, Count
cull_index_2 = CullIndex(List=series, Indices=delete_consecutive.Set, Wrap=True)
list_item = ListItem(List=curve, Index=cull_index_2, Wrap=True)
curve_2 = Curve(flatten(list_item))

curve_3 = Curve(flatten(dispatch_2.ListB))
curve_4 = Curve([curve_2, curve_3])
curve_5 = ClusterOutput(curve_4)

# ==== cluster ApplyMurraysLawBranchingNetworks
network_curves_unique_lines = ClusterInput()
number = ClusterInput()
network_curves_unique_lines_2 = Curve(network_curves_unique_lines)
number_2 = Number(number)
end_points = EndPoints(Curve=network_curves_unique_lines_2)  # -> Start, End
list_length = ListLength(List=network_curves_unique_lines_2)
point = Point([end_points.Start, end_points.End])
series = Series(Start=0, Step=1, Count=list_length)
removeduplicatepts = RemoveDuplicatePts(Points=point, Tolerance=0.01)
member_index = MemberIndex(Set=point, Member=removeduplicatepts)  # -> Index, Count
equality = Equality(FirstNumber=member_index.Count, SecondNumber="1")  # -> Equality, Inequality
inlet_point = ClusterInput()
inlet_point_2 = Point(inlet_point)
dispatch = Dispatch(List=removeduplicatepts, DispatchPattern=equality.Equality)  # -> ListA, ListB
member_index_2 = MemberIndex(Set=removeduplicatepts, Member=inlet_point_2)  # -> Index, Count
member_index_3 = MemberIndex(Set=dispatch.ListA, Member=inlet_point_2)  # -> Index, Count
cull_index = CullIndex(List=dispatch.ListA, Indices=member_index_3.Index, Wrap=True)
cull_index_2 = CullIndex(List=removeduplicatepts, Indices=member_index_2.Index, Wrap=True)
line = Line(StartPoint=cull_index_2, EndPoint=inlet_point_2)
end_points_of_network = Point(cull_index)
line_2 = Line(StartPoint=end_points_of_network, EndPoint=inlet_point_2)
shortest_walk = ShortestWalk(Curves=network_curves_unique_lines_2, WantedPath=line)  # -> ShortestWalk, Succession, Direction, Length
text = Text(flatten(shortest_walk.Succession))
text_2 = Text(series)
member_index_4 = MemberIndex(Set=text, Member=graft(text_2))  # -> Index, flatten(Count)
sort_list = SortList(Keys=member_index_4.Count, ValuesCurves=network_curves_unique_lines_2)  # -> Walks, ValuesCurves
shortest_walk_2 = ShortestWalk(Curves=sort_list.ValuesCurves, WantedPath=line_2)  # -> ShortestWalk, simplify(Succession), Direction, Length
curves_sorted = Panel(sort_list.ValuesCurves)
walks_sorted = Panel(sort_list.Walks)
end_points_2 = EndPoints(Curve=sort_list.ValuesCurves)  # -> Start, End
entwine = Entwine(Branch00=end_points_2.Start, Branch01=end_points_2.End, FlattenInputs=True)
flip_matrix = FlipMatrix(Data=entwine)  # -> simplify(Data)

# ---- group: Node closest to the network end points
list_length_2 = ListLength(List=sort_list.Walks)
series_2 = Series(Start=0, Step=1, Count=list_length_2)
ghpython_script = GhPythonScript(x=shortest_walk_2.Succession, y=series_2)  # -> out, a; inputs x: tree, y: list
# ---------- ghpython_script: Python ----------
__author__ = "lt4840"
__version__ = "2024.04.12"

import rhinoscriptsyntax as rs

a = []

for i in range(len(y)):
    curveIndex = int(y[i])
    print curveIndex
    for i in range(x.BranchCount):
        branchList = x.Branch(i)
        branchPath = x.Path(i)
        if curveIndex in branchList:
            b = str(branchPath)
            c = b.replace("{","").replace("}","")
            d = int(c)
            a.append(d)
            break
# ---------- end ghpython_script ----------
list_item = ListItem(List=shortest_walk_2.ShortestWalk, Index=ghpython_script.a, Wrap=True)
sort_along_curve = SortAlongCurve(Points=flip_matrix, Curve=simplify(graft(list_item)))  # -> Points, Indices
list_item_2 = ListItem(List=sort_along_curve.Points, Index="0", Wrap=True)  # -> flatten(Item)

# ----
curves_node_points_sorted = Panel(list_item_2)
ghpython_script_2 = GhPythonScript(nodePerCurve=list_item_2, allNodes=flip_matrix, walkCount=sort_list.Walks)  # -> out, radiusCount; inputs nodePerCurve: list of Point3d, allNodes: tree of Point3d, walkCount: list
# ---------- ghpython_script_2: Python ----------
__author__ = "lt4840"
__version__ = "2024.04.12"

import rhinoscriptsyntax as rs
import ghpythonlib.treehelpers as th

#x = th.tree_to_list(walkCount)

radiusCount = []
for i in range(len(walkCount)):
    b = walkCount[i]
    if b==1:
        radiusCount.append(b)
    else:
        radiusCount.append("")

#while there are empty ("") items in the list, go through the list:
while "" in radiusCount:
    for i in range(len(walkCount)):
        r = radiusCount[i]
        if r == "": #if empty, obtain node and find branches with the same node
            node = nodePerCurve[i]
            branches = []
            radiusCountFori = 0
            for j in range(allNodes.BranchCount):
                branchList = allNodes.Branch(j)
                branchPath = allNodes.Path(j)
                b = str(branchPath)
                c = b.replace("{","").replace("}","")
                d = int(c)
                if d != i:
                    if node in branchList:
                        if radiusCount[d] != "":
                            radiusCountFori = radiusCountFori + radiusCount[d]
                        else: # if one of the branches doesnt have a value (i.e., is "") then skip and return back to this node later through the while loop.
                            print "empty"
                            radiusCount[i] = ""
                            continue
                radiusCount[i] = radiusCountFori


#for i in range(len(y)):
#    curveIndex = int(y[i])
#    print curveIndex
#    for i in range(x.BranchCount):
#        branchList = x.Branch(i)
#        branchPath = x.Path(i)
#        if curveIndex in branchList:
#            b = str(branchPath)
#            c = b.replace("{","").replace("}","")
#            d = int(c)
#            a.append(d)
#            break
# ---------- end ghpython_script_2 ----------
cube = Cube(Value=number_2)
node_points_for_each_curve_sorted = Panel(flip_matrix)
multiplication = Multiplication(A=ghpython_script_2.radiusCount, B=cube)
cube_root = CubeRoot(Value=multiplication)

# ---- group: Put in same order as input curve list
curve_middle = CurveMiddle(Curve=network_curves_unique_lines_2)
curve_middle_2 = CurveMiddle(Curve=sort_list.ValuesCurves)
member_index_5 = MemberIndex(Set=curve_middle_2, Member=curve_middle)  # -> flatten(Index), Count
list_item_3 = ListItem(List=cube_root, Index=member_index_5.Index, Wrap=True)

# ----
radiuscount_for_each_node_point = Panel(ghpython_script_2.radiusCount)
radii = Panel(cube_root)
radii_2 = Number(list_item_3)
radii_3 = ClusterOutput(radii_2)

# ==== cluster _2DAnd3DUnconnected
x = ClusterInput()
y = ClusterInput()
vector = ClusterInput()
ghpython_script = GhPythonScript(x=x, y=y)  # -> out, a; same code as ghpython_script
very_large_value_to_ensure_all_points_ar = Panel("1000")  # "Very large value to ensure all points are included"
vector_2 = Vector(vector)
point = Point(ghpython_script.a)
list_item = ListItem(List=point, Index=0, Wrap=True)
line_sdl = LineSDL(Start=list_item, Direction=vector_2, Length=very_large_value_to_ensure_all_points_ar)
extend_curve = ExtendCurve(Curve=line_sdl, Type=0, Start=very_large_value_to_ensure_all_points_ar, End=very_large_value_to_ensure_all_points_ar)
curve_closest_point = CurveClosestPoint(Point=point, Curve=extend_curve)  # -> simplify(Point), Parameter, simplify(Distance)
end_points = EndPoints(Curve=extend_curve)  # -> Start, End
distance = Distance(PointA=end_points.Start, PointB=curve_closest_point.Point)
sort_list = SortList(Keys=distance, ValuesValuesA=point)  # -> Keys, ValuesValuesA
line_sdl_2 = LineSDL(Start=sort_list.ValuesValuesA, Direction=vector_2, Length=very_large_value_to_ensure_all_points_ar)  # -> graft(Line)
curve_closest_point_2 = CurveClosestPoint(Point=sort_list.ValuesValuesA, Curve=line_sdl_2)  # -> simplify(Point), Parameter, simplify(Distance)
tolerance = Panel("0.001")
point_sorted_along_vector = Point(sort_list.ValuesValuesA)
smaller_than = SmallerThan(FirstNumber=curve_closest_point_2.Distance, SecondNumber=tolerance)  # -> SmallerThan, OrEqualTo
dispatch = Dispatch(List=curve_closest_point_2.Point, DispatchPattern=smaller_than.SmallerThan)  # -> ListA, ListB
sort_along_curve = SortAlongCurve(Points=dispatch.ListA, Curve=simplify(line_sdl_2))  # -> simplify(Points), Indices
list_item_2 = ListItem(List=sort_along_curve.Points, Index="1", Wrap=True)  # -> flatten(Item)
ghpython_script_2 = GhPythonScript(startPt=point_sorted_along_vector, endPt=list_item_2)  # -> out, a; inputs startPt: list of Point3d, endPt: list of Point3d
# ---------- ghpython_script_2: Python ----------
__author__ = "lt4840"
__version__ = "2024.04.15"

import rhinoscriptsyntax as rs

usedPt = []
lines = []
tolerance = 0.001
for i in range(len(startPt)):
    pt1 = startPt[i]
    pt2 = endPt[i]
    distance = 10000000000000000000000000
    for item in usedPt:
        d = pt1.DistanceTo(item)
        if d < distance:
            distance = d
        d = pt2.DistanceTo(item)
        if d < distance:
            distance = d
    if distance > tolerance:
#    If-statement below produced some erroneous results: sometimes it did not recognize a point in the list even if it was present. Replaced by if-statement above. 
#    if (pt1 not in usedPt) and (pt2 not in usedPt) and (pt1 != pt2):
        line = rs.AddLine(pt1,pt2)
        lines.append(line)
        usedPt.append(pt1)
        usedPt.append(pt2)
a = lines
# ---------- end ghpython_script_2 ----------
a = ClusterOutput(ghpython_script_2.a)

# ==== cluster MeshNetworkWithCocoonForToolpaths
B = ClusterInput()
curve = ClusterInput()
A = ClusterInput()
charge_strengths = ClusterInput()
execute = ClusterInput()
addition = Addition(A=graft(A), B=graft(B))  # -> flatten(Result)
curve_2 = Curve(curve)
curve_charge = CurveCharge(Curve=curve, Radius=addition, ChargeStrengths=charge_strengths)
number_slider = Slider(0.15, range=0..10)
number_slider_2 = Slider(0.4, range=0..10)
curve_middle = CurveMiddle(Curve=curve_2)
curve_closest_point = CurveClosestPoint(Point=curve_middle, Curve=curve_2)  # -> Point, Parameter, Distance
cocoon = Cocoon(Charges=curve_charge, Iso=number_slider, CellSize=number_slider_2, Execute=execute, Simple=False)  # -> Mesh, RefinementData
perp_frame = PerpFrame(Curve=curve_2, Parameter=curve_closest_point.Parameter)
pi = Pi(Factor=1)

# ---- group: Adjust cell size slightly if Cocoon fails
list_length = ListLength(List=cocoon.Mesh)
equality = Equality(FirstNumber=list_length, SecondNumber="0")  # -> Equality, Inequality
addition_2 = Addition(A=number_slider_2, B="0.01")
cocoon_2 = Cocoon(Charges=curve_charge, Iso=number_slider, CellSize=addition_2, Execute=equality.Equality, Simple=False)  # -> Mesh, RefinementData

list_length_2 = ListLength(List=cocoon_2.Mesh)
equality_2 = Equality(FirstNumber=list_length_2, SecondNumber="0")  # -> Equality, Inequality
addition_3 = Addition(A=addition_2, B="0.01")
cocoon_3 = Cocoon(Charges=curve_charge, Iso=number_slider, CellSize=addition_3, Execute=equality_2.Equality, Simple=False)  # -> Mesh, RefinementData

entwine = Entwine(Branch00=cocoon.Mesh, Branch01=flatten([cocoon_2.Mesh, cocoon_3.Mesh]), FlattenInputs=True)  # -> simplify(Result)
tree_item = TreeItem(Tree=entwine, Path=equality.Equality, Index=0, Wrap=True)

# ----
quicksmooth = QuickSmooth(Mesh=tree_item, Step=0.5, Iterations=Slider(10, range=0..10))
mesh_plane = MeshPlane(Mesh=quicksmooth, Plane=perp_frame)  # -> simplify(Curves)
mesh = ClusterOutput(quicksmooth)
area = Area(Geometry=mesh_plane)  # -> Area, Centroid
distance = Distance(PointA=simplify(area.Centroid), PointB=simplify(graft(curve_middle)))
sort_list = SortList(Keys=distance, ValuesValuesA=simplify(mesh_plane))  # -> Keys, ValuesValuesA
list_item = ListItem(List=sort_list.ValuesValuesA, Index=0, Wrap=True)
area_2 = Area(Geometry=list_item)  # -> Area, Centroid
division = Division(A=area_2.Area, B=pi)
square_root = SquareRoot(Value=division)
subtraction = Subtraction(A=simplify(square_root), B=simplify(graft(B)))
list_length_3 = ListLength(List=quicksmooth)
ghpython_script = GhPythonScript(x=list_length_3, y=subtraction)  # -> out, a; same code as ghpython_script
a = ClusterOutput(ghpython_script.a)

# ==== cluster Cluster
A = ClusterInput()
A_2 = ClusterInput()
panel = Panel("""-2
2""")
panel_2 = Panel("""-2
2""")
division = Division(A=A, B=panel)
division_2 = Division(A=A_2, B=panel_2)
list_item = ListItem(List=division, Index=0, Wrap=True)  # -> Item, Item1
list_item_2 = ListItem(List=division_2, Index=0, Wrap=True)  # -> Item, Item1
construct_domain = ConstructDomain(DomainStart=list_item.Item, DomainEnd=list_item.Item1)
construct_domain_2 = ConstructDomain(DomainStart=list_item_2.Item, DomainEnd=list_item_2.Item1)
xy_plane = XYPlane(Origin=Point(0, 0, 0))
angle = ClusterInput()
rectangle = Rectangle(Plane=PlaneXY(0, 0, 0), XSize=construct_domain_2, YSize=construct_domain, Radius=0)  # -> Rectangle, Length
rotate = Rotate(Geometry=xy_plane, Angle=degrees(angle), Plane=PlaneXY(0, 0, 0))  # -> Geometry, Transform
angle_2 = ClusterInput()
rotate_2 = Rotate(Geometry=rectangle.Rectangle, Angle=degrees(angle_2), Plane=PlaneXY(0, 0, 0))  # -> Geometry, Transform
bounding_rectangle = BoundingRectangle(Geometry=rotate_2.Geometry, Plane=graft(rotate.Geometry), Axis=0, Slide=0, Union=True)  # -> Bounding, DimensionX, flatten(DimensionY)
division_3 = Division(A=bounding_rectangle.DimensionY, B="2")
distance_between_filament_center_and_cha = Number(division_3)  # "Distance between filament center and channel perimeter"
distance_between_filament_center_and_cha_2 = ClusterOutput(distance_between_filament_center_and_cha)  # "Distance between filament center and channel perimeter"

# ==== cluster Cluster_2
unit_x = UnitX(Factor=1)
line_sdl = LineSDL(Start="0,0,0", Direction=unit_x, Length=1)
vector_a = ClusterInput()
angle = Angle(VectorA=vector_a, VectorB=line_sdl)  # -> Angle, Reflex
degrees = Degrees(Radians=angle.Angle)
degrees_2 = ClusterOutput(degrees)

# ==== cluster CalculateM
A = ClusterInput()
division = Division(A=A, B="1000")
overhang_volume_mm3 = ClusterInput()
span_length_mm = ClusterInput()

density_g_mm3 = Panel(division)
gravitational_acceleration_m_s2 = Panel("9.81")
overhang_volume_mm3_2 = Number(overhang_volume_mm3)
span_length_mm_2 = Number(span_length_mm)

# ---- group: Remove empty branches
list_length = ListLength(List=overhang_volume_mm3_2)
list_length_2 = ListLength(List=overhang_volume_mm3_2)
smaller_than = SmallerThan(FirstNumber=list_length, SecondNumber="1")  # -> SmallerThan, OrEqualTo
smaller_than_2 = SmallerThan(FirstNumber=list_length_2, SecondNumber="1")  # -> SmallerThan, OrEqualTo
tree_statistics = TreeStatistics(Tree=overhang_volume_mm3_2)  # -> flatten(Paths), Length, Count
gate_or = GateOr(A=smaller_than.SmallerThan, B=smaller_than_2.SmallerThan)  # -> flatten(Result)
dispatch = Dispatch(List=tree_statistics.Paths, DispatchPattern=gate_or)  # -> ListA, ListB
tree_branch = TreeBranch(Tree=overhang_volume_mm3_2, Path=dispatch.ListB, MaintainPaths=True)
tree_branch_2 = TreeBranch(Tree=span_length_mm_2, Path=dispatch.ListB, MaintainPaths=True)

# ----
multiplication = Multiplication(A=tree_branch, B=density_g_mm3)
total_weight_g = Panel(multiplication)
division_2 = Division(A=multiplication, B="1000")
multiplication_2 = Multiplication(A=division_2, B=gravitational_acceleration_m_s2)
total_weight_kg = Panel(division_2)
division_3 = Division(A=multiplication_2, B=tree_branch_2)
N = Panel(multiplication_2)
square = Square(Value=tree_branch_2)
panel = Panel("0.125")
w_n_mm = Panel(division_3)
multiplication_3 = Multiplication(A=panel, B=division_3, C=square)
average = Average(Input=flatten(multiplication_3))
m_nmm = Panel(multiplication_3)
sort_list = SortList(Keys=flatten(multiplication_3))  # -> Keys, ValuesValuesA
list_item = ListItem(List=sort_list.Keys, Index="-1", Wrap=True)
arithmetic_mean = ClusterOutput(average)
number = Number(list_item)
number_2 = ClusterOutput(number)
result = ClusterOutput(multiplication_3)

# ==== cluster ObtainSpanCurvesSpanLengthOverhangVolume
second_number = ClusterInput()
list = ClusterInput()
rebuilt_toolpaths = ClusterInput()

# ---- group: Remove empty item from list
cull_index = CullIndex(List=list, Indices="-1", Wrap=True)

# ----
rebuilt_toolpaths_2 = Curve(rebuilt_toolpaths)
overhang_geometry = Brep(simplify(cull_index))
tree_statistics = TreeStatistics(Tree=rebuilt_toolpaths_2)  # -> Paths, Length, Count
cull_index_2 = CullIndex(List=tree_statistics.Paths, Indices="0", Wrap=True)
area = Area(Geometry=overhang_geometry)  # -> Area, Centroid
tree_branch = TreeBranch(Tree=rebuilt_toolpaths_2, Path=cull_index_2, MaintainPaths=True)
B = ClusterInput()
graft_tree = GraftTree(Tree=overhang_geometry, IncludeEmptyLists=True, IncludeNullItems=True)
division = Division(A=area.Area, B=B)
list_length = ListLength(List=overhang_geometry)
match_tree = MatchTree(Tree=tree_branch, Guide=overhang_geometry)
populate_geometry = PopulateGeometry(Geometry=graft_tree, Count=graft(division), Seed=1)  # -> simplify(Population)
duplicate_data = DuplicateData(Data=match_tree, Number=list_length, Order=True)  # -> simplify(Data)
graft_tree_2 = GraftTree(Tree=duplicate_data, IncludeEmptyLists=True, IncludeNullItems=True)
list_length_2 = ListLength(List=populate_geometry)
smaller_than = SmallerThan(FirstNumber=list_length_2, SecondNumber="2")  # -> SmallerThan, OrEqualTo
dispatch = Dispatch(List=graft_tree, DispatchPattern=smaller_than.SmallerThan)  # -> ListA, ListB
dispatch_2 = Dispatch(List=graft_tree_2, DispatchPattern=smaller_than.SmallerThan)  # -> ListA, ListB
dispatch_3 = Dispatch(List=populate_geometry, DispatchPattern=smaller_than.SmallerThan)  # -> ListA, ListB
curve_closest_point = CurveClosestPoint(Point=dispatch_3.ListB, Curve=dispatch_2.ListB)  # -> Point, Parameter, Distance
sort_along_curve = SortAlongCurve(Points=curve_closest_point.Point, Curve=dispatch_2.ListB)  # -> simplify(Points), Indices
panel = Panel("""0
-1""")
list_item = ListItem(List=sort_along_curve.Indices, Index=panel, Wrap=True)
list_item_2 = ListItem(List=curve_closest_point.Parameter, Index=list_item, Wrap=True)
shatter = Shatter(Curve=dispatch_2.ListB, Parameters=list_item_2)  # -> simplify(Segments)

# ---- group: Select correct segments
volume = Volume(Geometry=graft_tree)  # -> Volume, Centroid
curve_middle = CurveMiddle(Curve=shatter)
closest_point = ClosestPoint(Point=volume.Centroid, Cloud=curve_middle)  # -> ClosestPoint, CPIndex, Distance
list_item_3 = ListItem(List=shatter, Index=closest_point.CPIndex, Wrap=True)

# ----
dispatch_4 = Dispatch(List=volume.Volume, DispatchPattern=smaller_than.SmallerThan)  # -> ListA, ListB
dispatch_5 = Dispatch(List=list_item_3, DispatchPattern=smaller_than.SmallerThan)  # -> ListA, ListB

# ---- group: Remove smallest overhangs
smaller_than_2 = SmallerThan(FirstNumber=dispatch_4.ListB, SecondNumber=second_number)  # -> SmallerThan, OrEqualTo
dispatch_6 = Dispatch(List=dispatch.ListB, DispatchPattern=smaller_than_2.SmallerThan)  # -> ListA, ListB
dispatch_7 = Dispatch(List=dispatch_4.ListB, DispatchPattern=smaller_than_2.SmallerThan)  # -> ListA, ListB
dispatch_8 = Dispatch(List=dispatch_5.ListB, DispatchPattern=smaller_than_2.SmallerThan)  # -> ListA, ListB

# ----
curve = Curve(dispatch_8.ListB)
length = Length(Curve=curve)
list_b = ClusterOutput(dispatch_7.ListB)
list_b_2 = ClusterOutput(dispatch_6.ListB)
length_2 = ClusterOutput(length)
curve_2 = ClusterOutput(curve)

# ==== cluster RebuildCurves
toolpaths_of_one_side = ClusterInput()
toolpaths_of_one_side_2 = Curve(toolpaths_of_one_side)
length = Length(Curve=toolpaths_of_one_side_2)
A = ClusterInput()
multiplication = Multiplication(A=A, B=length)
round = Round(Number=multiplication)  # -> Nearest, Floor, Ceiling
addition = Addition(A=round.Ceiling, B="1")
divide_curve = DivideCurve(Curve=toolpaths_of_one_side_2, Count=addition, Kinks=False)  # -> Points, Tangents, Parameters
interpolate = Interpolate(Vertices=divide_curve.Points, Degree=3, Periodic=False, KnotStyle=1)  # -> simplify(Curve), Length, Domain
curve = ClusterOutput(interpolate.Curve)
points = ClusterOutput(divide_curve.Points)

# ==== cluster SelectToolpathsOnOneSide
toolpathangle = ClusterInput()
toolpaths = ClusterInput()
toolpaths_2 = Curve(toolpaths)
curve_middle = CurveMiddle(Curve=toolpaths_2)
deconstruct = Deconstruct(Point=curve_middle)  # -> XComponent, YComponent, ZComponent
sort_list = SortList(Keys=deconstruct.YComponent, ValuesValuesA=toolpaths_2)  # -> Keys, ValuesValuesA
list_item = ListItem(List=sort_list.ValuesValuesA, Index=0, Wrap=True)

# ---- group: Reverse list if toolpath angle > 90
flatten_tree = FlattenTree(Tree=list_item, Path="{0}")
reverse_list = ReverseList(List=flatten_tree)
ghpython_script = GhPythonScript(x=flatten(flatten_tree), y=reverse_list, toolpathAngle=toolpathangle)  # -> out, simplify(graft(a))
# ---------- ghpython_script: Python ----------
__author__ = "lt4840"
__version__ = "2024.04.16"

import rhinoscriptsyntax as rs

if toolpathAngle > 90:
    a = y
else:
    a = x
# ---------- end ghpython_script ----------

# ----
a = ClusterOutput(ghpython_script.a)

# ==== cluster ProjectCurvesIfSurfaceIsNonPlanar
network_curves_unique_lines = ClusterInput()
surface = ClusterInput()
network_curves_unique_lines_2 = Curve(network_curves_unique_lines)
surface_2 = Surface(surface)
is_planar = IsPlanar(Surface=surface_2, Interior=True)  # -> Planar, Plane
project = Project(Curve=network_curves_unique_lines_2, Brep=surface_2, Direction=is_planar.Plane)  # -> flatten(Curve)
ghpython_script = GhPythonScript(x=is_planar.Planar)  # -> out, a
# ---------- ghpython_script: Python ----------
__author__ = "lt4840"
__version__ = "2024.04.15"

import rhinoscriptsyntax as rs

if x: # if surface is planar
    a = True
elif x==False: # if surface is non-planar
    a = False
else: #if no surface
    a = True
# ---------- end ghpython_script ----------
entwine = Entwine(Branch00=project, Branch01=network_curves_unique_lines_2, FlattenInputs=True)  # -> simplify(Result)
tree_branch = TreeBranch(Tree=entwine, Path=ghpython_script.a, MaintainPaths=True)
branch = ClusterOutput(tree_branch)

# ==== cluster GenerateToolpaths
toolpath_angle_beta_degrees = ClusterInput()
filament_height = ClusterInput()
brep = ClusterInput()
toolpath_angle_beta_degrees_2 = Number(toolpath_angle_beta_degrees)
brep_2 = Brep(brep)
filament_height_2 = Number(filament_height)
area = Area(Geometry=brep_2)  # -> Area, Centroid
xy_plane = XYPlane(Origin=Point(0, 0, 0))
xz_plane = XZPlane(Origin=Point(0, 0, 0))
number = ClusterInput()
number_2 = Number(number)
rotate = Rotate(Geometry=xy_plane, Angle=degrees(toolpath_angle_beta_degrees_2), Plane=xz_plane)  # -> Geometry, Transform
scale = Scale(Geometry=brep_2, Center=area.Centroid, Factor="0.99")  # -> Geometry, Transform
negative = Negative(Value=number_2)
shape = ClusterInput()
contour = Contour(Shape=shape, Point=Point(0, 0, 0), Direction=rotate.Geometry, Distance=filament_height_2)  # -> simplify(Contours)
offset_surface = OffsetSurface(Surface=scale.Geometry, Distance=number_2, BothSides=negative, CreateSolid=True)
trim_with_brep = TrimWithBrep(Curve=contour, Brep=offset_surface)  # -> simplify(Inside), Outside
geometry = ClusterOutput(rotate.Geometry)
inside = ClusterOutput(trim_with_brep.Inside)

# ==== cluster Cluster_3
A = ClusterInput()
integer = ClusterInput()
number = ClusterInput()
number_2 = ClusterInput()
number_3 = ClusterInput()
text = ClusterInput()
fragment_b = ClusterInput()
fragment_b_2 = ClusterInput()
tolerance_angle = ClusterInput()
model_center = ClusterInput()
geometry = ClusterInput()
radius_1 = ClusterInput()
radius_2 = ClusterInput()
motion = ClusterInput()
list_item = ListItem(List=geometry, Index=0, Wrap=True)
division = Division(A=A, B="2")
end_points = EndPoints(Curve=list_item)  # -> Start, End
deconstruct = Deconstruct(Point=end_points.Start)  # -> XComponent, YComponent, ZComponent

# ---- group: Build plate
point = Point("0,50,1")
rectangle_2pt = Rectangle2Pt(Plane="0,50,1", PointA=point, PointB="216,204,1", Radius=0)  # -> Rectangle, Length
rectangle_2pt_2 = Rectangle2Pt(Plane=PlaneXY(0, 0, 0), PointA=point, PointB="216,266,0", Radius=0)  # -> Rectangle, Length
area = Area(Geometry=rectangle_2pt.Rectangle)  # -> Area, Centroid

# ----
model_center_2 = Point(model_center)
number_4 = Number(division)

# ----
# Skirt Model
panel = Panel("1")
unit_z = UnitZ(Factor=deconstruct.ZComponent)
move = Move(Geometry=model_center_2, Motion=unit_z)  # -> Geometry, Transform
ellipse = Ellipse(Plane=model_center_2, Radius1=radius_1, Radius2=radius_2)  # -> Ellipse, Focus1, Focus2
offset_curve = OffsetCurve(Curve=ellipse.Ellipse, Distance=number_4, Plane=PlaneXY(0, 0, 0), BothSides=True, Kinks=0, CapType=1)
length = Length(Curve=offset_curve)
sort_list = SortList(Keys=length, ValuesValuesA=offset_curve)  # -> reverse(Keys), reverse(ValuesValuesA)

number_5 = Number(number_2)

# ----
# Position print on bed
rotate = Rotate(Geometry=geometry, Angle=degrees(number_5), Plane=model_center_2)  # -> Geometry, Transform
rotate_2 = Rotate(Geometry=sort_list.ValuesValuesA, Angle=degrees(number_5), Plane=model_center_2)  # -> Geometry, Transform
move_2pt = Move2Pt(Geometry=rotate.Geometry, PointA=model_center_2, PointB=area.Centroid)  # -> Moved, Vector, Transform
move_2pt_2 = Move2Pt(Geometry=rotate_2.Geometry, PointA=model_center_2, PointB=area.Centroid)  # -> Moved, Vector, Transform

list_item_2 = ListItem(List=move_2pt_2.Moved, Index="-1", Wrap=True)
number_6 = Number(number_3)
number_7 = Number(number)
integer_2 = Integer(integer)
concatenate = Concatenate(FragmentA=" F", FragmentB=integer_2)
text_2 = Text(text)
round_to_decimal_place = RoundToDecimalPlace(NumberX=number_7, DecimalPlace="2", RoundType=0)  # -> Rounded, Difference

# ----
# End GCode
deconstruct_vector = DeconstructVector(Vector=motion)  # -> XComponent, YComponent, ZComponent
panel_2 = Panel("""G28 X0 Y0 ; move X/Y to min endstops so the head is out of the way
M84 ; disable motors
G90 ; absolute positioning
; -- end of END GCODE --""")
panel_3 = Panel("""; -- END GCODE --
G91 ; relative positioning
G1 E-1 F300 ; retract the filament a bit before lifting the nozzle to release some of the pressure""")
concatenate_2 = Concatenate(
    Fragment_A="G1 Z+5 E-5 X",
    Fragment_B=deconstruct_vector.XComponent,
    A=" Y",
    B=deconstruct_vector.YComponent,
    C=" F9000 ; move Z up a bit and retract filament even more")
merge = Merge(Data1=panel_3, Data2=concatenate_2, Data3=panel_2)

concatenate_3 = Concatenate(FragmentA="; extrusion constant ", FragmentB=round_to_decimal_place.Rounded)

# ----
# Start GCode
panel_4 = Panel("""G90
M82
M106 S0
M104 S0 T0
M107 ; start with the fan off
M302 ; allow cold extrusion
G28 ; home axis
G92 E0.0000 ; reset extruder
M117 Printing... ; Put printing msg on LCD screen
; -- end of START GCODE --""")
panel_5 = Panel("""; -- START GCODE --
; Settings Summary""")
concatenate_4 = Concatenate(FragmentA="; overlap (%)  ", FragmentB=fragment_b_2)
concatenate_5 = Concatenate(FragmentA="; nozzle diameter (mm) ", FragmentB=fragment_b)
merge_2 = Merge(Data1=panel_5, Data2=concatenate_4, Data3=concatenate_5, Data4=concatenate_3, Data5=panel_4)

rectangle = ClusterOutput(rectangle_2pt.Rectangle)

explode = Explode(Curve=move_2pt.Moved, Recursive=True)  # -> simplify(graft(Segments)), Vertices
curve_to_polyline = CurveToPolyline(Curve=explode.Segments, ToleranceDistance=0, ToleranceAngle=number_6)  # -> Polyline, Segments
trim_tree = TrimTree(Tree=curve_to_polyline.Polyline, Depth=1)
join_curves = JoinCurves(Curves=trim_tree, Preserve=False)  # -> simplify(Curves)
explode_2 = Explode(Curve=join_curves, Recursive=False)  # -> simplify(Segments), simplify(Vertices)
length_2 = Length(Curve=explode_2.Segments)  # -> simplify(Length)

# ----
# Skirt GCode
list_item_3 = ListItem(List=flatten(explode_2.Vertices), Index=0, Wrap=True)
panel_6 = Panel("G92 E0.0000 ; reset extruder")
skirt = Panel("""; -- start of SKIRT GCODE --
T1
; feature skirt
G1 Z1.000 F2000""")

curve_closest_point = CurveClosestPoint(Point=list_item_3, Curve=list_item_2)  # -> Point, Parameter, Distance
vector_2pt = Vector2Pt(PointA=list_item_3, PointB=curve_closest_point.Point, Unitize=False)  # -> Vector, Length

line_sdl = LineSDL(Start=list_item_3, Direction=vector_2pt.Vector, Length="200")
curve_curve = CurveCurve(CurveA=line_sdl, CurveB=move_2pt_2.Moved)  # -> Points, ParamsA, flatten(ParamsB)
seam = Seam(Curve=move_2pt_2.Moved, Seam=curve_curve.ParamsB)
curve_to_polyline_2 = CurveToPolyline(Curve=seam, ToleranceDistance=number_6, ToleranceAngle=tolerance_angle, MinEdge=number_4)  # -> Polyline, Segments
explode_3 = Explode(Curve=curve_to_polyline_2.Polyline, Recursive=True)  # -> Segments, Vertices
cull_index = CullIndex(List=explode_3.Segments, Indices="-1", Wrap=True)
cull_index_2 = CullIndex(List=explode_3.Vertices, Indices="-1", Wrap=True)
length_3 = Length(Curve=cull_index)  # -> simplify(Length)
insert_items = InsertItems(List=length_3, Item="0", Indices="0", Wrap=True)
mass_addition = MassAddition(Input=insert_items)  # -> Result, PartialResults

multiplication = Multiplication(A=mass_addition.PartialResults, B=number_7)

# ----
# Path Visualization
merge_3 = Merge(Data1=flatten(cull_index_2), Data2=flatten(explode_2.Vertices))
polyline = PolyLine(Vertices=flatten(merge_3), Closed=False)
end_points_2 = EndPoints(Curve=polyline)  # -> Start, End
move_2 = Move(Geometry=end_points_2.End, Motion=motion)  # -> Geometry, Transform
printer_not_model_origin = Panel("0,216,0")
polyline_2 = PolyLine(Vertices=[end_points_2.End, move_2.Geometry, printer_not_model_origin], Closed=False)
join_curves_2 = JoinCurves(Curves=[polyline, polyline_2], Preserve=False)

curves = ClusterOutput(join_curves_2)

insert_items_2 = InsertItems(List=length_2, Item="0", Indices="0", Wrap=True)
mass_addition_2 = MassAddition(Input=insert_items_2)  # -> Result, PartialResults

multiplication_2 = Multiplication(A=mass_addition_2.PartialResults, B=number_7)

ghpython_script = GhPythonScript(f=integer_2, e=multiplication_2, Vertices=explode_2.Vertices)  # -> out, a; inputs Vertices: Point3d
# ---------- ghpython_script: Python ----------
__author__ = "Wyss User"
__version__ = "2022.11.19"

import rhinoscriptsyntax as rs

x = Vertices.X
y = Vertices.Y
z = Vertices.Z
a = "G1 F" + str(f) + " X" + str(round(x,2)) + " Y" + str(round(y,2)) + " Z" + str(round(z,2)) + " E" + str(round(e,2))
# ---------- end ghpython_script ----------

ghpython_script_2 = GhPythonScript(f=integer_2, e=multiplication, Vertices=cull_index_2)  # -> out, a; inputs Vertices: Point3d; same code as ghpython_script
list_item_4 = ListItem(List=ghpython_script_2.a, Index=0, Wrap=True)
replace_text = ReplaceText(Text=list_item_4, Find=concatenate, Replace=text_2, RecursiveReplace=False)

replace_text_2 = ReplaceText(Text=replace_text, Find=" E0.0", RecursiveReplace=False)

replace_items = ReplaceItems(List=simplify(ghpython_script_2.a), Item=simplify(replace_text_2), Indices="0", Wrap=False)
insert_items_3 = InsertItems(List=replace_items, Item=panel_6, Indices="1", Wrap=True)  # -> flatten(List)
merge_4 = Merge(Data1=skirt, Data2=insert_items_3, Data3="; -- end of SKIRT GCODE --")

# ----
# Print GCode
list_item_5 = ListItem(List=ghpython_script.a, Index=0, Wrap=True)
replace_text_3 = ReplaceText(Text=list_item_5, Find=concatenate, Replace=text_2, RecursiveReplace=False)

replace_text_4 = ReplaceText(Text=replace_text_3, Find=" E0.0", RecursiveReplace=False)

replace_items_2 = ReplaceItems(List=simplify(ghpython_script.a), Item=simplify(replace_text_4), Indices="0", Wrap=False)
insert_items_4 = InsertItems(List=replace_items_2, Item=panel_6, Indices="1", Wrap=True)  # -> flatten(List)

merge_5 = Merge(Data1=merge_2, Data2=merge_4, Data3=insert_items_4, Data4=merge)
result = ClusterOutput(merge_5)

# ==== cluster Cluster_4
plane = ClusterInput()
toolpath_angle_beta_degrees = ClusterInput()
plane_2 = Plane(plane)
toolpath_angle_beta_degrees_2 = Number(toolpath_angle_beta_degrees)
deconstruct_plane = DeconstructPlane(Plane=plane_2)  # -> Origin, XAxis, YAxis, ZAxis
construct_plane = ConstructPlane(Origin=plane_2, XAxis="1,0,0", YAxis="0,0,1")
construct_plane_2 = ConstructPlane(Origin=plane_2, XAxis="0,1,0", YAxis="1,0,0")
adjust_plane = AdjustPlane(Plane=construct_plane, Normal=deconstruct_plane.ZAxis)
adjust_plane_2 = AdjustPlane(Plane=construct_plane_2, Normal=deconstruct_plane.ZAxis)
ghpython_script = GhPythonScript(x=toolpath_angle_beta_degrees_2, planeOriginal=plane_2, planeNinety=adjust_plane_2, planeOneEighty=adjust_plane)  # -> out, a; inputs planeOriginal: tree, planeNinety: tree, planeOneEighty: tree
# ---------- ghpython_script: Python ----------
__author__ = "lt4840"
__version__ = "2024.04.30"

import rhinoscriptsyntax as rs

if x == 90:
    a = planeNinety
elif x == 180:
    a = planeOneEighty
else:
    a = planeOriginal
# ---------- end ghpython_script ----------
a = ClusterOutput(ghpython_script.a)

# ==== cluster Cluster_5
angle = ClusterInput()
xy_plane = XYPlane(Origin=Point(0, 0, 0))
xz_plane = XZPlane(Origin=Point(0, 0, 0))
A = ClusterInput()
rotate = Rotate(Geometry=xy_plane, Angle=degrees(angle), Plane=xz_plane)  # -> Geometry, Transform
division = Division(A=A, B="-0.001")
addition = Addition(A=division, B="1")
series = Series(Start=0, Step="-0.001", Count=addition)
deconstruct_plane = DeconstructPlane(Plane=rotate.Geometry)  # -> Origin, XAxis, YAxis, ZAxis
amplitude = Amplitude(Vector=deconstruct_plane.ZAxis, Amplitude=series)
geometry = ClusterInput()
move = Move(Geometry=geometry, Motion=amplitude)  # -> Geometry, Transform
geometry_2 = ClusterOutput(move.Geometry)

# ==== cluster DichotomousBranching
number = ClusterInput()
number_2 = ClusterInput()
boolean = ClusterInput()
inlet_point = ClusterInput()
point = ClusterInput()
number_3 = Number(number_2)
number_4 = Number(number)
inlet_point_2 = Point(inlet_point)
point_2 = Point(point)
boolean_2 = Boolean(boolean)
closest_point = ClosestPoint(Point=inlet_point_2, Cloud=point_2)  # -> ClosestPoint, CPIndex, Distance
ghpython_script = GhPythonScript(x=boolean_2, y=number_3)  # -> out, a
# ---------- ghpython_script: Python ----------
__author__ = "lt4840"
__version__ = "2024.05.29"

import rhinoscriptsyntax as rs

if x:
    a = y
else:
    a = 0
# ---------- end ghpython_script ----------
panel = Panel(ghpython_script.a)
line = Line(StartPoint=inlet_point_2, EndPoint=closest_point.ClosestPoint)
cluster = Cluster_6(point_2=point_2, point=closest_point.ClosestPoint, count=panel, max_length=number_4, curve=line)  # -> branch, point_10, point_9
curve = Curve(flatten([line, cluster.branch]))
cluster_2 = Cluster_6(point_2=cluster.point_10, point=cluster.point_9, count=panel, max_length=number_4, curve=curve)  # -> branch, point_10, point_9
curve_2 = Curve(flatten([curve, cluster_2.branch]))
cluster_3 = Cluster_6(point_2=cluster_2.point_10, point=cluster_2.point_9, count=panel, max_length=number_4, curve=curve_2)  # -> branch, point_10, point_9
curve_3 = Curve(flatten([curve_2, cluster_3.branch]))
cluster_4 = Cluster_6(point_2=cluster_3.point_10, point=cluster_3.point_9, count=panel, max_length=number_4, curve=curve_3)  # -> branch, point_10, point_9
curve_4 = Curve(flatten([cluster_4.branch, curve_3]))
cluster_5 = Cluster_6(point_2=cluster_4.point_10, point=cluster_4.point_9, count=panel, max_length=number_4, curve=curve_4)  # -> branch, point_10, point_9
curve_5 = Curve(flatten([cluster_5.branch, curve_4]))
cluster_6 = Cluster_6(point_2=cluster_5.point_10, point=cluster_5.point_9, count=panel, max_length=number_4, curve=curve_5)  # -> branch, point_10, point_9
curve_6 = Curve(flatten([cluster_6.branch, curve_5]))
cluster_7 = Cluster_6(point_2=cluster_6.point_10, point=cluster_6.point_9, count=panel, max_length=number_4, curve=curve_6)  # -> branch, point_10, point_9
curve_7 = Curve(flatten([cluster_7.branch, curve_6]))
cluster_8 = Cluster_6(point_2=cluster_7.point_10, point=cluster_7.point_9, count=panel, max_length=number_4, curve=curve_7)  # -> branch, point_10, point_9
curve_8 = Curve(flatten([cluster_8.branch, curve_7]))
cluster_9 = Cluster_6(point_2=cluster_8.point_10, point=cluster_8.point_9, count=panel, max_length=number_4, curve=curve_8)  # -> branch, point_10, point_9
curve_9 = Curve(flatten([cluster_9.branch, curve_8]))
cluster_10 = Cluster_6(point_2=cluster_9.point_10, point=cluster_9.point_9, count=panel, max_length=number_4, curve=curve_9)  # -> branch, point_10, point_9
curve_10 = Curve(flatten([cluster_10.branch, curve_9]))
cluster_11 = Cluster_6(point_2=cluster_10.point_10, point=cluster_10.point_9, count=panel, max_length=number_4, curve=curve_10)  # -> branch, point_10, point_9
curve_11 = Curve(flatten([curve_10, cluster_11.branch]))
cluster_12 = Cluster_6(point_2=cluster_11.point_10, point=cluster_11.point_9, count=panel, max_length=number_4, curve=curve_11)  # -> branch, point_10, point_9
curve_12 = Curve(flatten([curve_11, cluster_12.branch]))
cluster_13 = Cluster_6(point_2=cluster_12.point_10, point=cluster_12.point_9, count=panel, max_length=number_4, curve=curve_12)  # -> branch, point_10, point_9
curve_13 = Curve(flatten([cluster_13.branch, curve_12]))
cluster_14 = Cluster_6(point_2=cluster_13.point_10, point=cluster_13.point_9, count=panel, max_length=number_4, curve=curve_13)  # -> branch, point_10, point_9
curve_14 = Curve(flatten([cluster_14.branch, curve_13]))
cluster_15 = Cluster_6(point_2=cluster_14.point_10, point=cluster_14.point_9, count=panel, max_length=number_4, curve=curve_14)  # -> branch, point_10, point_9
curve_15 = Curve(flatten([cluster_15.branch, curve_14]))
cluster_16 = Cluster_6(point_2=cluster_15.point_10, point=cluster_15.point_9, count=panel, max_length=number_4, curve=curve_15)  # -> branch, point_10, point_9
curve_16 = Curve(flatten([cluster_16.branch, curve_15]))
cluster_17 = Cluster_6(point_2=cluster_16.point_10, point=cluster_16.point_9, count=panel, max_length=number_4, curve=curve_16)  # -> branch, point_10, point_9
curve_17 = Curve(flatten([cluster_17.branch, curve_16]))
cluster_18 = Cluster_6(point_2=cluster_17.point_10, point=cluster_17.point_9, count=panel, max_length=number_4, curve=curve_17)  # -> branch, point_10, point_9
curve_18 = Curve(flatten([cluster_18.branch, curve_17]))
cluster_19 = Cluster_6(point_2=cluster_18.point_10, point=cluster_18.point_9, count=panel, max_length=number_4, curve=curve_18)  # -> branch, point_10, point_9
curve_19 = Curve(flatten([cluster_19.branch, curve_18]))
cluster_20 = Cluster_6(point_2=cluster_19.point_10, point=cluster_19.point_9, count=panel, max_length=number_4, curve=curve_19)  # -> branch, point_10, point_9
curve_20 = Curve(flatten([curve_19, cluster_20.branch]))
cluster_21 = Cluster_6(point_2=cluster_20.point_10, point=cluster_20.point_9, count=panel, max_length=number_4, curve=curve_20)  # -> branch, point_10, point_9
curve_21 = Curve(flatten([curve_20, cluster_21.branch]))
cluster_22 = Cluster_6(point_2=cluster_21.point_10, point=cluster_21.point_9, count=panel, max_length=number_4, curve=curve_21)  # -> branch, point_10, point_9
curve_22 = Curve(flatten([cluster_22.branch, curve_21]))
cluster_23 = Cluster_6(point_2=cluster_22.point_10, point=cluster_22.point_9, count=panel, max_length=number_4, curve=curve_22)  # -> branch, point_10, point_9
curve_23 = Curve(flatten([cluster_23.branch, curve_22]))
cluster_24 = Cluster_6(point_2=cluster_23.point_10, point=cluster_23.point_9, count=panel, max_length=number_4, curve=curve_23)  # -> branch, point_10, point_9
curve_24 = Curve(flatten([cluster_24.branch, curve_23]))
cluster_25 = Cluster_6(point_2=cluster_24.point_10, point=cluster_24.point_9, count=panel, max_length=number_4, curve=curve_24)  # -> branch, point_10, point_9
curve_25 = Curve(flatten([cluster_25.branch, curve_24]))
cluster_26 = Cluster_6(point_2=cluster_25.point_10, point=cluster_25.point_9, count=panel, max_length=number_4, curve=curve_25)  # -> branch, point_10, point_9
curve_26 = Curve(flatten([cluster_26.branch, curve_25]))
cluster_27 = Cluster_6(point_2=cluster_26.point_10, point=cluster_26.point_9, count=panel, max_length=number_4, curve=curve_26)  # -> branch, point_10, point_9
curve_27 = Curve(flatten([cluster_27.branch, curve_26]))
cluster_28 = Cluster_6(point_2=cluster_27.point_10, point=cluster_27.point_9, count=panel, max_length=number_4, curve=curve_27)  # -> branch, point_10, point_9
curve_28 = Curve(flatten([cluster_28.branch, curve_27]))
cluster_29 = Cluster_6(point_2=cluster_28.point_10, point=cluster_28.point_9, count=panel, max_length=number_4, curve=curve_28)  # -> branch, point_10, point_9
curve_29 = Curve(flatten([curve_28, cluster_29.branch]))
cluster_30 = Cluster_6(point_2=cluster_29.point_10, point=cluster_29.point_9, count=panel, max_length=number_4, curve=curve_29)  # -> branch, point_10, point_9
curve_30 = Curve(flatten([curve_29, cluster_30.branch]))
cluster_31 = Cluster_6(point_2=cluster_30.point_10, point=cluster_30.point_9, count=panel, max_length=number_4, curve=curve_30)  # -> branch, point_10, point_9
curve_31 = Curve(flatten([cluster_31.branch, curve_30]))
cluster_32 = Cluster_6(point_2=cluster_31.point_10, point=cluster_31.point_9, count=panel, max_length=number_4, curve=curve_31)  # -> branch, point_10, point_9
curve_32 = Curve(flatten([cluster_32.branch, curve_31]))
cluster_33 = Cluster_6(point_2=cluster_32.point_10, point=cluster_32.point_9, count=panel, max_length=number_4, curve=curve_32)  # -> branch, point_10, point_9
curve_33 = Curve(flatten([cluster_33.branch, curve_32]))
cluster_34 = Cluster_6(point_2=cluster_33.point_10, point=cluster_33.point_9, count=panel, max_length=number_4, curve=curve_33)  # -> branch, point_10, point_9
curve_34 = Curve(flatten([cluster_34.branch, curve_33]))
cluster_35 = Cluster_6(point_2=cluster_34.point_10, point=cluster_34.point_9, count=panel, max_length=number_4, curve=curve_34)  # -> branch, point_10, point_9
curve_35 = Curve(flatten([cluster_35.branch, curve_34]))
cluster_36 = Cluster_6(point_2=cluster_35.point_10, point=cluster_35.point_9, count=panel, max_length=number_4, curve=curve_35)  # -> branch, point_10, point_9
curve_36 = Curve(flatten([cluster_36.branch, curve_35]))
cluster_37 = Cluster_6(point_2=cluster_36.point_10, point=cluster_36.point_9, count=panel, max_length=number_4, curve=curve_36)  # -> branch, point_10, point_9
curve_37 = Curve(flatten([cluster_37.branch, curve_36, line]))
curve_38 = ClusterOutput(curve_37)

# ==== cluster _2DAnd3DInterconnectedNoIntersectingCurves
points = ClusterInput()
points_2 = ClusterInput()
group = ClusterInput()
proximity_3d = Proximity3D(Points=flatten([points_2, points]), Group=group)  # -> flatten(Links), Topology
removeduplicatelines = RemoveDuplicateLines(Lines=proximity_3d.Links, Tolerance=0.01)
cross_reference = CrossReference(ListListA=removeduplicatelines, ListListB=removeduplicatelines, CrossMode=5)  # -> ListListA, ListListB
curve_curve = CurveCurve(CurveA=cross_reference.ListListA, CurveB=cross_reference.ListListB)  # -> Points, ParamsA, ParamsB
graft_tree = GraftTree(Tree=removeduplicatelines, IncludeEmptyLists=True, IncludeNullItems=True)
equality = Equality(FirstNumber=curve_curve.ParamsA, SecondNumber="0")  # -> Equality, Inequality
equality_2 = Equality(FirstNumber=curve_curve.ParamsA, SecondNumber="1")  # -> Equality, Inequality
gate_or = GateOr(A=equality.Equality, B=equality_2.Equality)
dispatch = Dispatch(List=curve_curve.Points, DispatchPattern=gate_or)  # -> ListA, ListB
tolerance = Panel("0.001")
flatten_tree = FlattenTree(Tree=dispatch.ListB, Path="{0}")
curve_closest_point = CurveClosestPoint(Point=flatten_tree, Curve=graft_tree)  # -> Point, Parameter, Distance
smaller_than = SmallerThan(FirstNumber=curve_closest_point.Distance, SecondNumber=tolerance)  # -> SmallerThan, OrEqualTo
mass_addition = MassAddition(Input=smaller_than.SmallerThan)  # -> Result, PartialResults
dispatch_2 = Dispatch(List=graft_tree, DispatchPattern=mass_addition.Result)  # -> ListA, ListB

# ----
# Group curves by shared intersection point and only keep the shortest curve in that group.
curve = Curve(flatten(dispatch_2.ListA))
curve_closest_point_2 = CurveClosestPoint(Point=graft(flatten_tree), Curve=curve)  # -> Point, Parameter, Distance
tolerance_2 = Panel("0.001")
list_length = ListLength(List=curve)
smaller_than_2 = SmallerThan(FirstNumber=curve_closest_point_2.Distance, SecondNumber=tolerance_2)  # -> SmallerThan, OrEqualTo
series = Series(Start=0, Step=1, Count=list_length)
dispatch_3 = Dispatch(List=curve, DispatchPattern=smaller_than_2.SmallerThan)  # -> ListA, ListB
dispatch_4 = Dispatch(List=series, DispatchPattern=smaller_than_2.SmallerThan)  # -> ListA, ListB
length = Length(Curve=dispatch_3.ListA)
sort_list = SortList(Keys=length, ValuesValuesA=dispatch_4.ListA)  # -> Keys, ValuesValuesA
cull_index = CullIndex(List=sort_list.ValuesValuesA, Indices="0", Wrap=True)  # -> flatten(List)
sort_list_2 = SortList(Keys=cull_index)  # -> Keys, ValuesValuesA
delete_consecutive = DeleteConsecutive(Set=sort_list_2.Keys, Wrap=False)  # -> Set, Count
cull_index_2 = CullIndex(List=series, Indices=delete_consecutive.Set, Wrap=True)
list_item = ListItem(List=curve, Index=cull_index_2, Wrap=True)
curve_2 = Curve(flatten(list_item))

curve_3 = Curve(flatten(dispatch_2.ListB))
curve_4 = Curve([curve_2, curve_3])
curve_5 = ClusterOutput(curve_4)

# ==== cluster Cluster_6
point = ClusterInput()
count = ClusterInput()
point_2 = ClusterInput()
curve = ClusterInput()
point_3 = Point(point_2)

# ----
# original
point_4 = Point(point)
curve_2 = Curve(curve)

closest_points = ClosestPoints(Point=simplify(point_4), Cloud=point_3, Count=count)  # -> ClosestPoint, simplify(CPIndex), simplify(Distance)
max_length = ClusterInput()
cluster_v_3 = ClusterV3(integer=closest_points.CPIndex, fragment_b=closest_points.Distance, y=max_length)
list_item = ListItem(List=point_3, Index=cluster_v_3, Wrap=True)
line = Line(StartPoint=simplify(graft(point_4)), EndPoint=simplify(list_item))  # -> flatten(Line)
curve_curve = CurveCurve(CurveA=simplify(graft(curve_2)), CurveB=line)  # -> Points, ParamsA, ParamsB
equality = Equality(FirstNumber=curve_curve.ParamsB, SecondNumber="0")  # -> Equality, Inequality
equality_2 = Equality(FirstNumber=curve_curve.ParamsB, SecondNumber="1")  # -> Equality, Inequality
gate_or = GateOr(A=equality.Equality, B=equality_2.Equality)
dispatch = Dispatch(List=curve_curve.Points, DispatchPattern=gate_or)  # -> ListA, ListB
point_5 = Point(dispatch.ListB)
flatten_tree = FlattenTree(Tree=point_5, Path="{0}")
curve_closest_point = CurveClosestPoint(Point=graft(flatten_tree), Curve=line)  # -> Point, Parameter, Distance
tolerance = Panel("0.001")
list_length = ListLength(List=flatten_tree)
equality_3 = Equality(FirstNumber=list_length, SecondNumber="0")  # -> Equality, Inequality
smaller_than = SmallerThan(FirstNumber=curve_closest_point.Distance, SecondNumber=tolerance)  # -> SmallerThan, OrEqualTo
flip_matrix = FlipMatrix(Data=smaller_than.SmallerThan)
mass_addition = MassAddition(Input=flip_matrix)  # -> flatten(Result), PartialResults
dispatch_2 = Dispatch(List=line, DispatchPattern=mass_addition.Result)  # -> ListA, ListB
ghpython_script = GhPythonScript(x=equality_3.Equality, y=dispatch_2.ListB, z=line)  # -> out, a
# ---------- ghpython_script: Python ----------
__author__ = "lt4840"
__version__ = "2024.04.15"

import rhinoscriptsyntax as rs

if x:
    a = z
else:
    a = y
# ---------- end ghpython_script ----------

# ----
# Curves drawn in this iteration that may or may not intersect with one another
curve_3 = Curve(flatten(ghpython_script.a))

cross_reference = CrossReference(ListListA=curve_3, ListListB=curve_3, CrossMode=5)  # -> ListListA, ListListB
curve_curve_2 = CurveCurve(CurveA=cross_reference.ListListA, CurveB=cross_reference.ListListB)  # -> Points, ParamsA, ParamsB
tolerance_2 = Panel("0.001")
equality_4 = Equality(FirstNumber=curve_curve_2.ParamsB, SecondNumber="0")  # -> Equality, Inequality
equality_5 = Equality(FirstNumber=curve_curve_2.ParamsB, SecondNumber="1")  # -> Equality, Inequality
gate_or_2 = GateOr(A=equality_4.Equality, B=equality_5.Equality)
dispatch_3 = Dispatch(List=curve_curve_2.Points, DispatchPattern=gate_or_2)  # -> ListA, ListB
flatten_tree_2 = FlattenTree(Tree=dispatch_3.ListB, Path="{0}")
curve_closest_point_2 = CurveClosestPoint(Point=graft(flatten_tree_2), Curve=curve_3)  # -> Point, Parameter, Distance
smaller_than_2 = SmallerThan(FirstNumber=curve_closest_point_2.Distance, SecondNumber=tolerance_2)  # -> SmallerThan, OrEqualTo
flip_matrix_2 = FlipMatrix(Data=smaller_than_2.SmallerThan)
mass_addition_2 = MassAddition(Input=flip_matrix_2)  # -> flatten(Result), PartialResults
dispatch_4 = Dispatch(List=curve_3, DispatchPattern=mass_addition_2.Result)  # -> ListA, ListB

# ----
# Group curves by shared intersection point and only keep the shortest curve in that group.
curve_4 = Curve(flatten(dispatch_4.ListA))
curve_closest_point_3 = CurveClosestPoint(Point=graft(flatten_tree_2), Curve=curve_4)  # -> Point, Parameter, Distance
tolerance_3 = Panel("0.001")
list_length_2 = ListLength(List=curve_4)
smaller_than_3 = SmallerThan(FirstNumber=curve_closest_point_3.Distance, SecondNumber=tolerance_3)  # -> SmallerThan, OrEqualTo
series = Series(Start=0, Step=1, Count=list_length_2)
dispatch_5 = Dispatch(List=curve_4, DispatchPattern=smaller_than_3.SmallerThan)  # -> ListA, ListB
dispatch_6 = Dispatch(List=series, DispatchPattern=smaller_than_3.SmallerThan)  # -> ListA, ListB
length = Length(Curve=dispatch_5.ListA)
sort_list = SortList(Keys=length, ValuesValuesA=dispatch_6.ListA)  # -> Keys, ValuesValuesA
cull_index = CullIndex(List=sort_list.ValuesValuesA, Indices="0", Wrap=True)  # -> flatten(List)
sort_list_2 = SortList(Keys=cull_index)  # -> Keys, ValuesValuesA
delete_consecutive = DeleteConsecutive(Set=sort_list_2.Keys, Wrap=False)  # -> Set, Count
cull_index_2 = CullIndex(List=series, Indices=delete_consecutive.Set, Wrap=True)
list_item_2 = ListItem(List=curve_4, Index=cull_index_2, Wrap=True)
curve_5 = Curve(flatten(list_item_2))

curve_6 = Curve(flatten(dispatch_4.ListB))
list_length_3 = ListLength(List=flatten_tree_2)
curve_7 = Curve([curve_5, curve_6])
equality_6 = Equality(FirstNumber=list_length_3, SecondNumber="0")  # -> Equality, Inequality
entwine = Entwine(Branch00=curve_7, Branch01=curve_3, FlattenInputs=True)  # -> simplify(Result)
tree_branch = TreeBranch(Tree=entwine, Path=equality_6.Equality, MaintainPaths=True)
entwine_2 = Entwine(Branch00=tree_branch, Branch01=line, FlattenInputs=True)  # -> simplify(Result)
gate_and = GateAnd(A=equality_3.Equality, B=equality_6.Equality)
tree_branch_2 = TreeBranch(Tree=entwine_2, Path=gate_and, MaintainPaths=True)
end_points = EndPoints(Curve=tree_branch_2)  # -> Start, End
point_6 = Point(point_3)
distance = Distance(PointA=graft(point_6), PointB=end_points.End)  # -> simplify(Distance)
sort_list_3 = SortList(Keys=distance)  # -> Keys, ValuesValuesA
list_item_3 = ListItem(List=sort_list_3.Keys, Index=0, Wrap=True)  # -> flatten(Item)
smaller_than_4 = SmallerThan(FirstNumber=list_item_3, SecondNumber="0.001")  # -> SmallerThan, OrEqualTo
dispatch_7 = Dispatch(List=point_6, DispatchPattern=smaller_than_4.SmallerThan)  # -> ListA, ListB
point_7 = Point(end_points.End)
branch = ClusterOutput(tree_branch_2)
point_8 = Point(dispatch_7.ListB)
point_9 = ClusterOutput(point_7)
point_10 = ClusterOutput(point_8)

# ==== cluster ClusterV3
integer = ClusterInput()
fragment_b = ClusterInput()
y = ClusterInput()
integer_2 = Integer(integer)
list_length = ListLength(List=integer_2)  # -> flatten(Length)
concatenate = Concatenate(Fragment_A=integer_2, A=" ", Fragment_B=fragment_b)
list_item = ListItem(List=list_length, Index=0, Wrap=True)
panel = Panel(concatenate)
ghpython_script = GhPythonScript(x=flatten(concatenate), y=y, z=list_item)  # -> out, a, b; inputs x: list
# ---------- ghpython_script: Python ----------
__author__ = "lt4840"
__version__ = "2024.04.10"

import rhinoscriptsyntax as rs
import ghpythonlib.treehelpers as th

pointIndexList = []
distanceList = []
c = 0
for item in x:
    b = item.split()
    pointIndex = int(b[0])
    distance = float(b[1])
#if in indexList replace with new index+distance (if distance is smaller) or skip this index (if distance is larger)
    if pointIndex in pointIndexList: 
        i = pointIndexList.index(pointIndex)
        d = distanceList[i] #distance of point already in list
        r = i%4 #index of point within grafted list
        print r
        if (d < distance and r<2) or distance >= y: #keep original pointIndex and append "null"
            pointIndexList.append("")
            distanceList.append("")
        else: #replace original pointIndex with "null" and append this pointIndex
            pointIndexList[i] = ""
            distanceList[i] = ""
            pointIndexList.append(pointIndex)
            distanceList.append(distance)
    else:
        if distance < y:
            pointIndexList.append(pointIndex)
            distanceList.append(distance)
        else:
            pointIndexList.append("")
            distanceList.append("")
    c += 1
a = pointIndexList
b = distanceList
# ---------- end ghpython_script ----------
panel_2 = Panel(ghpython_script.a)
partition_list = PartitionList(List=ghpython_script.a, Size=list_length)
panel_3 = Panel(partition_list)
text_length = TextLength(Text=partition_list)
equality = Equality(FirstNumber=text_length, SecondNumber="0")  # -> Equality, Inequality
dispatch = Dispatch(List=partition_list, DispatchPattern=equality.Equality)  # -> ListA, ListB
panel_4 = Panel("""0
1""")
list_item_2 = ListItem(List=dispatch.ListB, Index=panel_4, Wrap=True)
delete_consecutive = DeleteConsecutive(Set=list_item_2, Wrap=False)  # -> Set, Count
panel_5 = Panel(delete_consecutive.Set)
set = ClusterOutput(delete_consecutive.Set)
