# Grasshopper definition SingleChannel_ToolpathAngle_v1_20240530.gh (Grasshopper 1.0.7)
# plug-ins: Wombat, Pufferfish

# ---- group: Channels
start_inclination = Panel("0")
end_inclination = Panel("70")
subtraction = Subtraction(A=end_inclination, B=start_inclination)
step_size = Panel("2")
division = Division(A=subtraction, B=step_size)
addition = Addition(A=division, B="1")
series = Series(Start=start_inclination, Step=step_size, Count=addition)

# ---- group: Toolpaths
start_angle = Panel("100")
end_angle = Panel("180")
subtraction_2 = Subtraction(A=end_angle, B=start_angle)
step_size_2 = Panel("2")
division_2 = Division(A=subtraction_2, B=step_size_2)
addition_2 = Addition(A=division_2, B="1")
series_2 = Series(Start=start_angle, Step=step_size_2, Count=addition_2)

# ----
# L. Tomholt, F. Meggers, and R. Moini (2024) 3D-Printing Channel Networks with Cement Paste. Fourth RILEM International Conference on Concrete and Digital Fabrication. Digital Concrete 2024. (Under review)
# 
# SingleChannel_ToolpathAngle_v1_20240530.gh, available at https://github.com/AM2Lab/NetworkGenerator_ToolpathOptimizer.git.
# Settings
# Increase the channel length if the "initial toolpath" could not be created
channel_length_mm = Slider(500, range=0..500)
number_of_filament_layers_dispayed = Slider(20, range=0..100)
channel_ir_mm = Slider(3, range=0..10)
nozzle_diameter = Slider(1.36, range=0..10)
overlap = Panel("0")
filament_height = Slider(1, range=0..10)
extrusion_multiplier_em = Panel("3.67")
ghpython_script = GhPythonScript(nozzleDiameter=nozzle_diameter, overlap=overlap, filamentHeight=filament_height, EM=extrusion_multiplier_em)  # -> out, filamentOffset, filamentWidth, EC; inputs overlap: Int32
# ---------- ghpython_script: Python ----------
__author__ = "Wyss User"
__version__ = "2022.11.08"

import rhinoscriptsyntax as rs
import math

d = nozzleDiameter
h = filamentHeight

y = 1.20 #constant
a = round(d*y,2) * ((100-overlap)/100)
b = a / 2
D = round(d*y,2)

u = 4*h * EM
v = math.pi * d * d
EC = u / v

filamentWidth = D
filamentOffset = a
# ---------- end ghpython_script ----------
filament_width = Number(ghpython_script.filamentWidth)

value_list = ValueList({"Single channel": 0, "Multiple channels for heat map": 1}, selected="Multiple channels for heat map")

# ----
# Single channel
toolpath_angle_degrees = Slider(160, range=100..180)
channel_inclination_degrees = Slider(0, range=0..70)

channel_inclination_degrees_2 = Integer(channel_inclination_degrees)
toolpath_angle_degrees_2 = Integer(toolpath_angle_degrees)
filament_height_2 = Number(filament_height)

nmm = Panel("0.0003")
domain_end = Number(nmm)

# ---- group: Legend
construct_domain = ConstructDomain(DomainStart="0", DomainEnd=domain_end)
number_slider = Slider(10, range=0..10)
range = Range(Domain=Domain(0, 1), Steps=number_slider)  # -> reverse(Range)
range_2 = Range(Domain=construct_domain, Steps=number_slider)  # -> reverse(Range)
expression = Expression(x=range_2, Expression="Format(\"{0:0.0000}\", x)")
gradient = Gradient(LowerLimit=0, UpperLimit=1, Parameter=range, stops=[0: RGB(0, 128, 0), 0.5: RGB(255, 255, 0), 1: RGB(255, 0, 0)])
curve = Curve(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)
legend = Legend(Colour=gradient, Tags=expression, Rectangle=curve, LegendType=1)

# ----
toolpath_angles_degrees = Panel(series_2)
channel_inclinations_degrees = Panel(series)
cross_reference = CrossReference(ListListA=channel_inclinations_degrees, ListListB=toolpath_angles_degrees, CrossMode=1)  # -> ListListA, ListListB

# ----
# Multiple channels for heat map
list_length = ListLength(List=cross_reference.ListListB)

number_slider_2 = Slider(1476, range=0..1476)
frame_count_for_slider_animation = Panel(list_length)

list_item = ListItem(List=cross_reference.ListListA, Index=number_slider_2, Wrap=True)
list_item_2 = ListItem(List=cross_reference.ListListB, Index=number_slider_2, Wrap=True)

channel_inclination_degrees_3 = Integer(list_item)
toolpath_angle_degrees_3 = Integer(list_item_2)
entwine = Entwine(Branch00=channel_inclination_degrees_2, Branch01=channel_inclination_degrees_3, FlattenInputs=True)  # -> simplify(Result)
entwine_2 = Entwine(Branch00=toolpath_angle_degrees_2, Branch01=toolpath_angle_degrees_3, FlattenInputs=True)  # -> simplify(Result)
tree_branch = TreeBranch(Tree=entwine, Path=value_list, MaintainPaths=True)
tree_branch_2 = TreeBranch(Tree=entwine_2, Path=value_list, MaintainPaths=True)
channel_inclination_degrees_4 = Number(tree_branch)
toolpath_angle_degrees_4 = Number(tree_branch_2)

line_sdl = LineSDL(Start="0,0,0", Direction="1,0,0", Length=channel_length_mm)
xz_plane = XZPlane(Origin="0,0,0")
rotate = Rotate(Geometry=line_sdl, Angle=degrees(channel_inclination_degrees_4), Plane=xz_plane)  # -> Geometry, Transform
channel_axis = Curve(rotate.Geometry)

# ---- group: To ensure proper contours
extend_curve = ExtendCurve(Curve=channel_axis, Type=0, Start="0.001", End="0.001")

# ----
pipe = Pipe(Curve=extend_curve, Radius=channel_ir_mm, Caps=1)
desired_channel_geometry = Brep(pipe)
custom_preview = CustomPreview(Geometry=desired_channel_geometry, Material=ColourSwatch(SwatchColor=RGB(204, 99, 0)))

ghpython_script_2 = GhPythonScript(toolpathAngle=toolpath_angle_degrees_4)  # -> out, a
# ---------- ghpython_script_2: Python ----------
__author__ = "lt4840"
__version__ = "2024.04.22"

import rhinoscriptsyntax as rs

if toolpathAngle >= 90:
    #flip plane
    a = (180-toolpathAngle)*-1
else:
    #original plane
    a = toolpathAngle
# ---------- end ghpython_script_2 ----------
xy_plane = XYPlane(Origin="0,0,0")
rotate_2 = Rotate(Geometry=xy_plane, Angle=degrees(ghpython_script_2.a), Plane=xz_plane)  # -> Geometry, Transform
contour = Contour(Shape=desired_channel_geometry, Point="0,0,0", Direction=rotate_2.Geometry, Distance=filament_height)  # -> flatten(Contours)

# ---- group: Keep complete perimeter curves only
channel_ir = Number(channel_ir_mm)
ghpython_script_3 = GhPythonScript(alpha=channel_inclination_degrees_4, beta=toolpath_angle_degrees_4, IR=channel_ir)  # -> out, a
# ---------- ghpython_script_3: Python ----------
__author__ = "lt4840"
__version__ = "2024.04.19"

import rhinoscriptsyntax as rs
import math

d = 2*IR
a_b = alpha-beta
b_a = beta-alpha
if alpha > beta:
    t = math.tan(a_b*math.pi/180)
    a = d / t * 2 #multiply by 2 for some extra buffer
elif beta > alpha:
    if b_a > 90:
        b_a = b_a-90
        t = math.tan(b_a*math.pi/180)
        a = d / t #multiply by 2 for some extra buffer
    else:
        b_a = 90 - b_a
        t = math.tan(b_a*math.pi/180)
        a = d * t #multiply by 2 for some extra buffer
else:
    a = 0
# ---------- end ghpython_script_3 ----------
tolerance = Panel("0.01")
extend_curve_2 = ExtendCurve(Curve=channel_axis, Type=0, Start=ghpython_script_3.a, End=ghpython_script_3.a)
subtraction_3 = Subtraction(A=channel_ir, B=tolerance)
pipe_2 = Pipe(Curve=extend_curve_2, Radius=subtraction_3, Caps=1)
brep_curve = BrepCurve(Brep=pipe_2, Curve=contour)  # -> Curves, Points
list_length_2 = ListLength(List=brep_curve.Points)  # -> flatten(Length)
larger_than = LargerThan(FirstNumber=list_length_2, SecondNumber="0")  # -> LargerThan, OrEqualTo
dispatch = Dispatch(List=contour, DispatchPattern=larger_than.LargerThan)  # -> ListA, ListB
panel = Panel("0")
list_item_3 = ListItem(List=flatten(dispatch.ListB), Index=panel, Wrap=True)
initial_toolpaths = Curve(list_item_3)
custom_preview_2 = CustomPreview(Geometry=initial_toolpaths, Material=ColourSwatch(SwatchColor=RGB(0, 0, 0)))

# ----
area = Area(Geometry=dispatch.ListB)  # -> Area, Centroid
toolpath_center_points = Point(area.Centroid)
list_item_4 = ListItem(List=toolpath_center_points, Index=panel, Wrap=True)

toolpath_center_points_2 = Point(toolpath_center_points)
filament_height_3 = Number(filament_height)
cluster = Cluster_9(second_number=filament_height_3, list=toolpath_center_points_2)  # -> larger_than_2, distance_2, vector

toolpath_center_point = Point(list_item_4)
toolpath_angle_plane = Plane(rotate_2.Geometry)
channel_inclination = Number(channel_inclination_degrees_4)
initial_toolpaths_2 = Curve(initial_toolpaths)
filament_height_4 = Number(filament_height)
toolpath_angle = Number(toolpath_angle_degrees_4)
filament_width_2 = Number(ghpython_script.filamentWidth)
channel_ir_2 = Number(channel_ir_mm)
move_and_rotate_filament = MoveAndRotateFilament(
    distance=cluster.distance_2,
    filament_height=filament_height_4,
    filament_width=filament_width_2,
    toolpath_angle=toolpath_angle)  # -> a, b
cluster_2 = Cluster_3(
    filament_width=filament_width_2,
    filament_height=filament_height_4,
    toolpath_angle_beta_degrees=toolpath_angle,
    channel_inclination_alpha_degrees=channel_inclination,
    base=toolpath_angle_plane,
    geometry=initial_toolpaths_2,
    boolean=move_and_rotate_filament.b,
    origin=toolpath_center_point,
    channel_ir=channel_ir_2)

# ---- group: Ensures the seam is always along the x plane for each channel
adjust_seam = AdjustSeam(curve=cluster_2)

# ----
adjusted_toolpaths_based_on_filament_siz = Curve(adjust_seam)  # "Adjusted toolpaths based on filament size and orientation"

toolpath_center_point_2 = Point(list_item_4)
panel_2 = Panel("""0
0.25
0.5
0.75""")
list_length_3 = ListLength(List=panel_2)
evaluate_length = EvaluateLength(Curve=adjusted_toolpaths_based_on_filament_siz, Length=panel_2, Normalized=True)  # -> Point, Tangent, Parameter
cluster_3 = Cluster_5(data=toolpath_center_point_2, number=list_length_3, list=evaluate_length.Point, indices=move_and_rotate_filament.a)
cluster_4 = Cluster_4(point=evaluate_length.Point, end_point=cluster_3, vector=evaluate_length.Tangent)
flip_plane = FlipPlane(Plane=cluster_4, FlipX=Toggle(True), FlipY=Toggle(False), FlipZ=Toggle(False))  # -> Flipped, ResultBoolean
planes_for_filament_profiles = Plane(flip_plane.Flipped)

planes_for_filament_profiles_2 = Plane(planes_for_filament_profiles)
filament_height_5 = Number(filament_height)
filament_width_3 = Number(filament_width)
toolpaths = Curve(adjusted_toolpaths_based_on_filament_siz)
ghpython_script_4 = GhPythonScript(x=filament_width_3)  # -> out, neg, pos
# ---------- ghpython_script_4: Python ----------
__author__ = "lt4840"
__version__ = "2024.04.16"

import rhinoscriptsyntax as rs

neg = x/-2
pos = x/2
# ---------- end ghpython_script_4 ----------
ghpython_script_5 = GhPythonScript(x=filament_height_5)  # -> out, neg, pos; same code as ghpython_script_4
construct_domain_2 = ConstructDomain(DomainStart=ghpython_script_4.neg, DomainEnd=ghpython_script_4.pos)
construct_domain_3 = ConstructDomain(DomainStart=ghpython_script_5.neg, DomainEnd=ghpython_script_5.pos)

# ---- group: Filament profile
filament_width_4 = Panel(construct_domain_2)
filament_height_6 = Panel(construct_domain_3)
rectangle = Rectangle(Plane=planes_for_filament_profiles_2, XSize=filament_width_4, YSize=filament_height_6, Radius=0)  # -> Rectangle, Length
fillet = Fillet(Curve=rectangle.Rectangle, Radius="0.4")  # -> simplify(Curve)

# ---- group: More robust than GH Sweep1 component
ghpython_sweep1 = GhPythonScript(toolpath=toolpaths, sections=fillet)  # -> out, a; inputs toolpath: Curve, sections: list
# ---------- ghpython_sweep1: Python ----------
__author__ = "lt4840"
__version__ = "2024.04.24"

import rhinoscriptsyntax as rs
import copy

toolpathOriginal = toolpath

#a = toolpath
#maxP = int(maxParameter)
#print maxP
#
#for i in range(maxP):
#    print i
#    toolpathWorking = copy.deepcopy(toolpathOriginal)
#    toolpathWorking.ChangeClosedCurveSeam(i) #https://developer.rhino3d.com/api/rhinocommon/rhino.geometry.curve/changeclosedcurveseam
#    sweep = rs.AddSweep1(toolpathWorking,sections,closed=True)
#a = sweep

a = rs.AddSweep1(toolpathOriginal,sections,closed=True)
sweep = a
# ---------- end ghpython_sweep1 ----------

# ----
filament_breps = Brep(ghpython_sweep1.a)

custom_preview_3 = CustomPreview(Geometry=filament_breps, Material=ColourSwatch(SwatchColor=RGB(194, 194, 194)))

toolpaths_2 = Curve(toolpaths)
filaments = Brep(filament_breps)

nr_of_layers = Panel(number_of_filament_layers_dispayed)
series_3 = Series(Start=0, Step=cluster.distance_2, Count=nr_of_layers)
division_3 = Division(A=nr_of_layers, B="2")
round = Round(Number=division_3)  # -> Nearest, Floor, Ceiling
amplitude = Amplitude(Vector=cluster.vector, Amplitude=series_3)
area_2 = Area(Geometry=toolpaths_2)  # -> Area, Centroid
list_item_5 = ListItem(List=amplitude, Index=round.Nearest, Wrap=True)
move = Move(Geometry=area_2.Centroid, Motion=list_item_5)  # -> Geometry, Transform

channel_length = Number(channel_length_mm)
filament_width_5 = Number(filament_width)
toolpath_angle_plane_2 = Plane(rotate_2.Geometry)
boolean_rotate_filament = Boolean(move_and_rotate_filament.b)
brep_edges = BrepEdges(Brep=filaments)  # -> Naked, simplify(Interior), NonManifold
division_4 = Division(A=filament_height_2, B="2")
list_item_6 = ListItem(List=brep_edges.Interior, Index=0, Wrap=True)
divide_curve = DivideCurve(Curve=list_item_6, Count=10, Kinks=False)  # -> Points, Tangents, Parameters
ghpython_script_6 = GhPythonScript(boolean=boolean_rotate_filament, a=division_4)  # -> out, amplitude
# ---------- ghpython_script_6: Python ----------
__author__ = "lt4840"
__version__ = "2024.04.26"

import rhinoscriptsyntax as rs

if boolean: #if true
    amplitude = 0
else:
    amplitude = a
# ---------- end ghpython_script_6 ----------
plane_fit = PlaneFit(Points=divide_curve.Points)  # -> Plane, Deviation
project = Project(Geometry=simplify(list_item_6), Plane=simplify(plane_fit.Plane))  # -> Geometry, Transform
gate_and = GateAnd(A=boolean_rotate_filament, B=cluster.larger_than_2)
multiplication = Multiplication(A=cluster.vector, B="2")
multiplication_2 = Multiplication(A=filament_width_5, B="-5")
amplitude_2 = Amplitude(Vector=cluster.vector, Amplitude=multiplication)
unit_x = UnitX(Factor=multiplication_2)
multiplication_3 = Multiplication(A=multiplication_2, B="-2")
unit_x_2 = UnitX(Factor=multiplication_3)
unit_z = UnitZ(Factor=channel_length)

amplitude_3 = Amplitude(Vector=toolpath_angle_plane_2, Amplitude=ghpython_script_6.amplitude)
move_2 = Move(Geometry=project.Geometry, Motion=amplitude_3)  # -> Geometry, Transform

boundary_surfaces = BoundarySurfaces(Edges=move_2.Geometry)

# ---- group: Select largest surface if edges intersect
area_3 = Area(Geometry=boundary_surfaces)  # -> Area, Centroid
sort_list = SortList(Keys=area_3.Area, ValuesValuesA=boundary_surfaces)  # -> Keys, ValuesValuesA
list_item_7 = ListItem(List=sort_list.ValuesValuesA, Index="-1", Wrap=True)

# ----
ghpython_script_7 = GhPythonScript(boolean=gate_and, surface=list_item_7)  # -> out, a
# ---------- ghpython_script_7: Python ----------
__author__ = "lt4840"
__version__ = "2024.04.22"

import rhinoscriptsyntax as rs

if boolean: #if true, generate volume
    a = surface
else: #if false, do not generate volume
    a = ""
# ---------- end ghpython_script_7 ----------

move_3 = Move(Geometry=ghpython_script_7.a, Motion=amplitude_2)  # -> Geometry, Transform
extrude = Extrude(Base=list_item_7, Direction=unit_z)

move_4 = Move(Geometry=move_3.Geometry, Motion=unit_x)  # -> Geometry, Transform

extrude_2 = Extrude(Base=move_4.Geometry, Direction=unit_x_2)

max_movement = Slider(-1, range=-1..0)
cluster_5 = Cluster_7(A=max_movement, geometry=extrude)

# ---- group: Solid union
ghpython_script_8 = GhPythonScript(brep1=cluster_5, brep2=extrude_2)  # -> out, solidUnion, error; inputs brep1: list of Brep, brep2: Brep
# ---------- ghpython_script_8: Python ----------
__author__ = "lt4840"
__version__ = "2024.04.23"

import rhinoscriptsyntax as rs
import Rhino.Geometry as rg
import Rhino

tol = Rhino.RhinoDoc.ActiveDoc.ModelAbsoluteTolerance

if brep2 is None:
    solidUnion = brep1[0]
else:
    for i in range(len(brep1)):
        item = brep1[i]
        breps = [item, brep2]
        union = rg.Brep.CreateBooleanUnion(breps,tol) #https://developer.rhino3d.com/api/rhinocommon/rhino.geometry.brep/createbooleanunion
        if union is not None:
            error = ""
            solidUnion = union
            break
        if i is (len(brep1)-1):
            error = "Solid union could not be generated"
# ---------- end ghpython_script_8 ----------

# ----
error_message = Panel(ghpython_script_8.error)
brep = Brep(ghpython_script_8.solidUnion)

# ---- group: Create series of slightly shifted geometries, to increase the chances of at least one resulting in a proper Solid Intersection
max_movement_2 = Slider(-0.02, range=-0.02..0)
toolpath_angle_plane_3 = Plane(rotate_2.Geometry)
cluster_6 = Cluster_6(plane=toolpath_angle_plane_3, A=max_movement_2, geometry=brep)

# ----
amplitude_4 = Amplitude(Vector=cluster.vector, Amplitude=cluster.distance_2)
move_5 = Move(Geometry=filaments, Motion=amplitude_4)  # -> Geometry, Transform
error_message_2 = Panel("Overhang volume could not be generated")
tolerance_2 = Panel("0.99")
custom_preview_4 = CustomPreview(Geometry=move_5.Geometry, Material=ColourSwatch(SwatchColor=RGB(194, 194, 194)))

# ---- group: Solid Intersection
ghpython_script_9 = GhPythonScript(
    filamentBrep=move_5.Geometry,
    unsupportedVolumeBrep=cluster_6,
    tolerance=tolerance_2,
    errorMessage=error_message_2,
    solidUnionError=ghpython_script_8.error)  # -> out, overhangBrep, overhangVolume, error, a; inputs filamentBrep: Brep, unsupportedVolumeBrep: list of Brep
# ---------- ghpython_script_9: Python ----------
__author__ = "lt4840"
__version__ = "2024.04.23"

import rhinoscriptsyntax as rs
import Rhino.Geometry as rg
import Rhino

tol = Rhino.RhinoDoc.ActiveDoc.ModelAbsoluteTolerance

if (unsupportedVolumeBrep[0] is None) or (filamentBrep is None) or (solidUnionError=="Solid union could not be generated"): 
    error = errorMessage
else:
    volumeFilament = filamentBrep.GetVolume(tol,tol)
    volumeUnsupported = unsupportedVolumeBrep[0].GetVolume(tol,tol)
    volumeFilamentTol = volumeFilament * tolerance
    volumeUnsupportedTol = volumeUnsupported * tolerance
    for i in range(len(unsupportedVolumeBrep)):
        item = unsupportedVolumeBrep[i]
        overhangBrep = rg.Brep.CreateBooleanIntersection(filamentBrep,item,tol,True) #https://developer.rhino3d.com/api/rhinocommon/rhino.geometry.brep/createbooleanintersection?version=8.x
        if overhangBrep is not None and len(overhangBrep)>0:
            volumeOverhang = overhangBrep[0].GetVolume(tol,tol)
            solution = "tested"
            if volumeOverhang > volumeUnsupportedTol or volumeOverhang > volumeFilamentTol:
                error = errorMessage
                overhangBrep = ""
                overhangVolume = ""
                #continue for-loop
            else:
                error = ""
                overhangBrep = overhangBrep[0]
                overhangVolume = volumeOverhang
                break
    if solution == "not tested": #if overhang was not generated in the for-loop
        error = errorMessage
# ---------- end ghpython_script_9 ----------

# ----
# Lower value: more precise span length.
# Higher value: faster computation
amplitude_5 = Amplitude(Vector=cluster.vector, Amplitude=cluster.distance_2)
move_6 = Move(Geometry=toolpaths_2, Motion=amplitude_5)  # -> Geometry, Transform
span_length_precision = Slider(0.03, range=0.01..0.1)
obtain_span_curves_and_span_length = ObtainSpanCurvesAndSpanLength(
    toolpath=move_6.Geometry,
    plane=toolpath_angle_plane_3,
    overhang_geometry=ghpython_script_9.overhangBrep,
    B=span_length_precision)  # -> length_2, curve_2
span_length = Number(obtain_span_curves_and_span_length.length_2)
curve_2 = Curve(obtain_span_curves_and_span_length.curve_2)
custom_preview_5 = CustomPreview(Geometry=curve_2, Material=ColourSwatch(SwatchColor=RGB(0, 0, 0)))

overhang_geometry = Brep(ghpython_script_9.overhangBrep)
filament_volume_overhang_mm3 = Number(ghpython_script_9.overhangVolume)
error_message_3 = Panel(ghpython_script_9.error)
custom_preview_6 = CustomPreview(Geometry=overhang_geometry, Material=ColourSwatch(SwatchColor=RGB(230, 85, 85)))

material_density_g_cm3 = Panel("2.2")
calculate_m = CalculateM(overhang_volume_mm3=filament_volume_overhang_mm3, span_length_mm=span_length, A=material_density_g_cm3)
m_value_nmm = Number(calculate_m)

filament_volume_overhang_mm3_2 = Number(filament_volume_overhang_mm3)
channel_inclination_degrees_5 = Number(channel_inclination_degrees_4)
toolpath_angle_degrees_5 = Number(toolpath_angle_degrees_4)
span_length_mm = Number(span_length)
m_value_nmm_2 = Number(m_value_nmm)
error = Text(ghpython_script_9.error)
concatenate = Concatenate(
    Fragment_A=channel_inclination_degrees_5,
    D=";",
    Fragment_B=toolpath_angle_degrees_5,
    E=";",
    A=filament_volume_overhang_mm3_2,
    F=";",
    C=span_length_mm,
    H=";",
    B=m_value_nmm_2,
    G=";",
    I=error)
concatenate_2 = Concatenate(FragmentA=channel_inclinations_degrees, FragmentB=";")
concatenate_3 = Concatenate(FragmentA=toolpath_angles_degrees, FragmentB=";")
file_name = Panel("inclinationStepSize_2_IR_3_c0-70_t100-180.txt")
text_join = TextJoin(Text=concatenate_2)
text_join_2 = TextJoin(Text=concatenate_3)
data_recorder = DataRecorder(concatenate, DataLimit=-10, RecordData=False)
folder = Panel("D:\Leaf_inspired_facade\08_Papers\DigitalConcrete2024\GH scripts\singleChannel_toolpathAngle\")
channel_ir_3 = Panel(channel_ir_mm)
channel_inclination_2 = Panel(text_join)
filament_inclination = Panel(text_join_2)
flatten_tree = FlattenTree(Tree=data_recorder, Path="{0}")
concatenate_4 = Concatenate(FragmentA=folder, FragmentB=file_name)
panel_3 = Panel(flatten_tree)
entwine_3 = Entwine(
    Branch00=channel_ir_3,
    Branch01=channel_inclination_2,
    Branch02=filament_inclination,
    Branch03=flatten_tree,
    FlattenInputs=True)  # -> flatten(Result)
write_to_text_file = WriteToTextFile(Run=Toggle(False), TextToWrite=entwine_3, FilePath=concatenate_4, Append=False, NewOnly=False)
panel_4 = Panel(write_to_text_file)

file_name_2 = Panel("inclinationStepSize_1_IR_3_c0-70_t100-180.txt")
concatenate_5 = Concatenate(FragmentA=folder, FragmentB=file_name_2)
read_file = ReadFile(File=concatenate_5, PerLineParse=True)
panel_5 = Panel("""0
1
2""")
list_item_8 = ListItem(List=read_file, Index="1", Wrap=True)  # -> Item, Item1
cull_index = CullIndex(List=read_file, Indices=panel_5, Wrap=True)
text_split = TextSplit(Text=graft([list_item_8.Item, list_item_8.Item1]), Separators=";")
cull_index_2 = CullIndex(List=simplify(text_split), Indices="-1", Wrap=True)
explode_tree = ExplodeTree(Data=cull_index_2)  # -> Branch0, Branch1
list_length_4 = ListLength(List=cull_index_2)
explode_tree_2 = ExplodeTree(Data=list_length_4)  # -> Branch0, Branch1
channel_inclinations = Number(explode_tree.Branch0)
toolpath_angles = Number(explode_tree.Branch1)
cluster_7 = Cluster(text_2=cull_index, list_a=channel_inclinations, list_b=toolpath_angles, text=";")

# ----
# Generate heat map of M values
text_split_2 = TextSplit(Text=cluster_7, Separators=";")  # -> simplify(Result)
text = Text(text_split_2)
number_of_channel_inclinations = Number(explode_tree_2.Branch0)

# ----
# Visualize filament, overhang, span curves
panel_6 = Panel("-1")
filament_geometry = Brep(simplify(filaments))
overhang_geometry_2 = Brep(simplify(overhang_geometry))
cull_index_3 = CullIndex(List=amplitude, Indices=panel_6, Wrap=True)
span_curves = Curve(curve_2)
unit_z_2 = UnitZ(Factor="-7")
move_7 = Move(Geometry=filament_geometry, Motion=amplitude)  # -> Geometry, Transform
move_8 = Move(Geometry=span_curves, Motion=cull_index_3)  # -> Geometry, Transform
move_9 = Move(Geometry=overhang_geometry_2, Motion=cull_index_3)  # -> Geometry, Transform
move_10 = Move(Geometry="0,0,0", Motion=unit_z_2)  # -> Geometry, Transform
concatenate_6 = Concatenate(
    Fragment_A="Channel inclination (degrees): ",
    Channel_inclination=channel_inclination_degrees_4,
    A="; Toolpath angle (degrees): ",
    Toolpath_angle=toolpath_angle_degrees_4)
xz_plane_2 = XZPlane(Origin=move_10.Geometry)
text_tag_3d = TextTag3D(Location=xz_plane_2, Text=concatenate_6, Size=1, Colour=ColourSwatch(SwatchColor=RGB(0, 0, 0)), Justification=5)

# ---- group: Move to origin
cluster_8 = Cluster_8(point_a=move.Geometry, geometry=move_7.Geometry)

cluster_9 = Cluster_8(point_a=move.Geometry, geometry=move_8.Geometry)

cluster_10 = Cluster_8(point_a=move.Geometry, geometry=move_9.Geometry)

# ----
custom_preview_7 = CustomPreview(Geometry=cluster_9, Material=ColourSwatch(SwatchColor=RGB(0, 0, 0)))
custom_preview_8 = CustomPreview(Geometry=cluster_10, Material=ColourSwatch(SwatchColor=RGB(230, 85, 85)))
custom_preview_9 = CustomPreview(Geometry=cluster_8, Material=ColourSwatch(SwatchColor=RGBA(255, 255, 255, 150)))

curve_3 = Curve(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)
number_of_toolpath_angles = Number(explode_tree_2.Branch1)
boundary_surfaces_2 = BoundarySurfaces(Edges=curve_3)
divide_domain² = DivideDomain²(Domain=boundary_surfaces_2, UCount=number_of_channel_inclinations, VCount=number_of_toolpath_angles)

# ---- group: Flip matrix for "channel inclination" to be on the horizontal axis
partition_list = PartitionList(List=divide_domain², Size=number_of_toolpath_angles)  # -> simplify(Chunks)
flip_matrix = FlipMatrix(Data=partition_list)  # -> flatten(Data)

# ----
isotrim = Isotrim(Surface=boundary_surfaces_2, Domain=flip_matrix)

# ---- group: Error: data unreliable or data missing
error_2 = Panel("5")
error_message_4 = Panel(error_message_2)
list_item_9 = ListItem(List=text, Index=error_2, Wrap=True)  # -> flatten(Item)
null_item = NullItem(Item=list_item_9)  # -> NullFlags, InvalidFlags, Description
ghpython_script_10 = GhPythonScript(x=list_item_9, y=error_message_4)  # -> out, a
# ---------- ghpython_script_10: Python ----------
__author__ = "lt4840"
__version__ = "2024.02.15"

import rhinoscriptsyntax as rs

if x!="":
    a = True
else:
    a = False
# ---------- end ghpython_script_10 ----------
gate_or = GateOr(A=null_item.NullFlags, B=ghpython_script_10.a)
dispatch_2 = Dispatch(List=isotrim, DispatchPattern=gate_or)  # -> ListA, ListB
mesh = Mesh(dispatch_2.ListA)
custom_preview_10 = CustomPreview(Geometry=mesh, Material=ColourSwatch(SwatchColor=RGB(255, 255, 255)))

# ---- group: Calculate M values
index_m_value = Panel("4")
list_item_10 = ListItem(List=text, Index=index_m_value, Wrap=True)  # -> flatten(Item)
ghpython_script_11 = GhPythonScript(x=list_item_10)  # -> out, a
# ---------- ghpython_script_11: Python ----------
__author__ = "lt4840"
__version__ = "2024.03.28"

import rhinoscriptsyntax as rs

a = float(x)
# ---------- end ghpython_script_11 ----------

# ----
estimate_m_values_for_missing_data = EstimateMValuesForMissingData(list=isotrim, m_value=ghpython_script_11.a, boolean=gate_or)

# ---- group: Calculate M values (continued)
m_value = Number(estimate_m_values_for_missing_data)
m_nmm = Panel(m_value)

# ----
gradient_2 = Gradient(
    LowerLimit="0",
    UpperLimit=domain_end,
    Parameter=m_value,
    stops=[0: RGB(0, 128, 0), 0.5: RGB(255, 255, 0), 1: RGB(255, 0, 0)])
mesh_2 = Mesh(isotrim)
custom_preview_11 = CustomPreview(Geometry=mesh_2, Material=gradient_2)

# ==== cluster Cluster
text = ClusterInput()
text_2 = ClusterInput()
text_3 = Text(text)
text_4 = Text(text_2)
text_split = TextSplit(Text=text_4, Separators=text_3)  # -> simplify(Result)
list_a = ClusterInput()
list_b = ClusterInput()
panel = Panel("""2
3
4""")
cross_reference = CrossReference(ListListA=list_a, ListListB=list_b, CrossMode=1)  # -> ListListA, ListListB
cull_index = CullIndex(List=text_split, Indices=panel, Wrap=True)  # -> simplify(List)
concatenate = Concatenate(FragmentA=cross_reference.ListListA, FragmentB=text_3)
list_item = ListItem(List=cull_index, Index=0, Wrap=True)  # -> Item, Item1
concatenate_2 = Concatenate(Fragment_A=list_item.Item, A=text_3, Fragment_B=list_item.Item1)  # -> flatten(Result)
concatenate_3 = Concatenate(FragmentA=concatenate, FragmentB=cross_reference.ListListB)
member_index = MemberIndex(Set=concatenate_2, Member=concatenate_3)  # -> Index, Count
list_item_2 = ListItem(List=member_index.Index, Index=0, Wrap=True)  # -> flatten(Item)
list_item_3 = ListItem(List=text_4, Index=list_item_2, Wrap=True)
sorted_list = Text(list_item_3)
sorted_list_2 = ClusterOutput(sorted_list)

# ==== cluster Cluster_3
filament_width = ClusterInput()
filament_height = ClusterInput()
toolpath_angle_beta_degrees = ClusterInput()
channel_inclination_alpha_degrees = ClusterInput()
boolean = ClusterInput()

# ---- group: Calculate offset in x-direction
cluster = Cluster_2(
    A_2=filament_width,
    A=filament_height,
    angle_2=toolpath_angle_beta_degrees,
    angle=channel_inclination_alpha_degrees,
    path=boolean)

# ----
division = Division(A=filament_width, B="2")
channel_ir = ClusterInput()
channel_ir_2 = Number(channel_ir)

# ---- group: Offset in y-direction
number = Number(division)

# ----
addition = Addition(A=cluster, B=channel_ir_2)
addition_2 = Addition(A=number, B=channel_ir_2)
division_2 = Division(A=addition_2, B=channel_ir_2)
division_3 = Division(A=addition, B=channel_ir_2)
base = ClusterInput()
origin = ClusterInput()
scale_factor_in_y_direction = Number(division_2)
scale_factor_in_x_direction = Number(division_3)
plane_origin = PlaneOrigin(Base=base, Origin=origin)
geometry = ClusterInput()
scale_nu = ScaleNU(Geometry=geometry, Plane=plane_origin, ScaleX=scale_factor_in_x_direction, ScaleY=scale_factor_in_y_direction, ScaleZ=1)  # -> Geometry, Transform
geometry_2 = ClusterOutput(scale_nu.Geometry)

# ==== cluster Cluster_4
point = ClusterInput()
end_point = ClusterInput()
vector = ClusterInput()
point_2 = Point(point)
vector_2 = Vector(vector)
line = Line(StartPoint=point_2, EndPoint=simplify(end_point))
rotate_axis = RotateAxis(Geometry=vector_2, Angle=1.570796327, Axis=line)  # -> Geometry, Transform
line_sdl = LineSDL(Start=point_2, Direction=vector_2, Length=1)
construct_plane = ConstructPlane(Origin=point_2, XAxis=line, YAxis=line_sdl)
adjust_plane = AdjustPlane(Plane=construct_plane, Normal=vector_2)  # -> simplify(Plane)
plane = ClusterOutput(adjust_plane)

# ==== cluster MoveAndRotateFilament
distance = ClusterInput()
toolpath_angle = ClusterInput()
filament_height = ClusterInput()
filament_width = ClusterInput()
toolpath_angle_2 = Number(toolpath_angle)
pythagoras = Pythagoras(filament_height=filament_height, filament_width=filament_width)
panel = Panel("""0
2""")
ghpython_script = GhPythonScript(distance=distance, maxDistance=pythagoras, x=panel, toolpathAngle=toolpath_angle_2)  # -> out, a, b; inputs x: list
# ---------- ghpython_script: Python ----------
__author__ = "lt4840"
__version__ = "2024.04.20"

import rhinoscriptsyntax as rs

if distance > maxDistance and toolpathAngle != 180:
    a = x
    b = True
else:
    a = []
    b = False
# ---------- end ghpython_script ----------
a = ClusterOutput(ghpython_script.a)
b = ClusterOutput(ghpython_script.b)

# ==== cluster Cluster_5
list = ClusterInput()
data = ClusterInput()
number = ClusterInput()
indices = ClusterInput()

panel = Panel("""0
2""")
panel_2 = Panel("""1,0,0
-1,0,0""")
list_item = ListItem(List=list, Index=panel, Wrap=True)
move = Move(Geometry=list_item, Motion=panel_2)  # -> simplify(Geometry), Transform
duplicate_data = DuplicateData(Data=graft(data), Number=number, Order=True)  # -> simplify(Data)
replace_items = ReplaceItems(List=duplicate_data, Item=move.Geometry, Indices=indices, Wrap=False)  # -> simplify(List)

panel_3 = Panel(move.Geometry)
panel_4 = Panel(duplicate_data)
list_2 = ClusterOutput(replace_items)
panel_5 = Panel(replace_items)

# ==== cluster AdjustSeam
curve = ClusterInput()
curve_2 = Curve(curve)
xz_plane = XZPlane(Origin=Point(0, 0, 0))
list_item = ListItem(List=curve_2, Index=0, Wrap=True)
curve_plane = CurvePlane(Curve=list_item, Plane=xz_plane)  # -> Points, ParamsC, ParamsP
deconstruct = Deconstruct(Point=curve_plane.Points)  # -> XComponent, YComponent, ZComponent
sort_list = SortList(Keys=deconstruct.ZComponent, ValuesValuesA=curve_plane.ParamsC)  # -> Keys, reverse(ValuesValuesA)
list_item_2 = ListItem(List=sort_list.ValuesValuesA, Index=0, Wrap=True)
seam = Seam(Curve=curve_2, Seam=list_item_2)
curve_3 = ClusterOutput(seam)

# ==== cluster Cluster_6
plane = ClusterInput()
A = ClusterInput()
plane_2 = Plane(plane)
division = Division(A=A, B="-0.001")
addition = Addition(A=division, B="1")
series = Series(Start=0, Step="-0.001", Count=addition)
deconstruct_plane = DeconstructPlane(Plane=plane_2)  # -> Origin, XAxis, YAxis, ZAxis
amplitude = Amplitude(Vector=deconstruct_plane.XAxis, Amplitude=series)
geometry = ClusterInput()
move = Move(Geometry=geometry, Motion=amplitude)  # -> Geometry, Transform
geometry_2 = ClusterOutput(move.Geometry)

# ==== cluster ObtainSpanCurvesAndSpanLength
overhang_geometry = ClusterInput()
plane = ClusterInput()
toolpath = ClusterInput()
B = ClusterInput()
overhang_geometry_2 = Brep(simplify(overhang_geometry))
toolpath_2 = Curve(toolpath)
area = Area(Geometry=overhang_geometry_2)  # -> Area, Centroid
end_points = EndPoints(Curve=toolpath_2)  # -> Start, End
graft_tree = GraftTree(Tree=overhang_geometry_2, IncludeEmptyLists=True, IncludeNullItems=True)
division = Division(A=area.Area, B=B)
panel = Panel("0.001")  # disabled
panel_2 = Panel("2")  # disabled
populate_geometry = PopulateGeometry(Geometry=graft_tree, Count=division, Seed=1)
list_length = ListLength(List=populate_geometry)
smaller_than = SmallerThan(FirstNumber=list_length, SecondNumber="2")  # -> SmallerThan, OrEqualTo
dispatch = Dispatch(List=populate_geometry, DispatchPattern=smaller_than.SmallerThan)  # -> ListA, ListB
panel_3 = Panel("""0
-1""")
tolerance = Panel("0.001")

# ---- group: Adjust seam
plane_2 = Plane(plane)
deconstruct_plane = DeconstructPlane(Plane=plane_2)  # -> Origin, XAxis, YAxis, ZAxis
line_sdl = LineSDL(Start=deconstruct_plane.Origin, Direction=deconstruct_plane.XAxis, Length=1)
line_sdl_2 = LineSDL(Start=deconstruct_plane.Origin, Direction=deconstruct_plane.ZAxis, Length=1)
line_line = LineLine(LineA=line_sdl, LineB=line_sdl_2)
curve_plane = CurvePlane(Curve=toolpath_2, Plane=line_line)  # -> Points, ParamsC, ParamsP
deconstruct = Deconstruct(Point=curve_plane.ParamsP)  # -> XComponent, YComponent, ZComponent
sort_list = SortList(Keys=deconstruct.XComponent, ValuesValuesA=curve_plane.ParamsC)  # -> Keys, reverse(ValuesValuesA)

# ----
list_length_2 = ListLength(List=sort_list.ValuesValuesA)  # disabled
smaller_than_2 = SmallerThan(FirstNumber=sort_list.ValuesValuesA, SecondNumber=panel)  # -> SmallerThan, OrEqualTo; disabled
larger_than = LargerThan(FirstNumber=list_length_2, SecondNumber=panel_2)  # -> LargerThan, OrEqualTo; disabled
gate_and = GateAnd(A=smaller_than_2.SmallerThan, B=larger_than.LargerThan)  # disabled
dispatch_2 = Dispatch(List=sort_list.ValuesValuesA, DispatchPattern=gate_and)  # -> ListA, ListB; disabled

# ---- group: Adjust seam / Point on the positive axis of the plane
list_item = ListItem(List=sort_list.ValuesValuesA, Index=0, Wrap=True)

# ---- group: Adjust seam (continued)
seam = Seam(Curve=toolpath_2, Seam=list_item)

# ----
curve_closest_point = CurveClosestPoint(Point=dispatch.ListB, Curve=seam)  # -> Point, Parameter, Distance
sort_along_curve = SortAlongCurve(Points=curve_closest_point.Point, Curve=seam)  # -> simplify(Points), Indices
list_item_2 = ListItem(List=sort_along_curve.Points, Index=panel_3, Wrap=True)
list_item_3 = ListItem(List=sort_along_curve.Indices, Index=panel_3, Wrap=True)
list_item_4 = ListItem(List=curve_closest_point.Parameter, Index=list_item_3, Wrap=True)
shatter = Shatter(Curve=seam, Parameters=list_item_4)  # -> simplify(Segments)

# ---- group: Select correct segments
curve_middle = CurveMiddle(Curve=shatter)
deconstruct_2 = Deconstruct(Point=curve_middle)  # -> XComponent, YComponent, ZComponent
sort_list_2 = SortList(Keys=deconstruct_2.ZComponent, ValuesValuesA=shatter)  # -> Keys, reverse(ValuesValuesA)

# ----
list_item_5 = ListItem(List=deconstruct_2.ZComponent, Index=0, Wrap=True)  # -> Item, Item1
subtraction = Subtraction(A=list_item_5.Item, B=list_item_5.Item1)
sort_list_3 = SortList(Keys=deconstruct_2.XComponent, ValuesValuesA=shatter)  # -> Keys, ValuesValuesA
absolute = Absolute(Value=subtraction)
entwine = Entwine(Branch00=sort_list_2.ValuesValuesA, Branch01=sort_list_3.ValuesValuesA, FlattenInputs=True)  # -> simplify(Result)
smaller_than_3 = SmallerThan(FirstNumber=absolute, SecondNumber=tolerance)  # -> SmallerThan, OrEqualTo
tree_branch = TreeBranch(Tree=entwine, Path=smaller_than_3.SmallerThan, MaintainPaths=True)

# ---- group: Select correct segments (continued)
list_item_6 = ListItem(List=tree_branch, Index=0, Wrap=True)

# ----
curve = Curve(list_item_6)
length = Length(Curve=curve)
length_2 = ClusterOutput(length)
curve_2 = ClusterOutput(curve)

# ==== cluster Cluster_7
A = ClusterInput()
division = Division(A=A, B="-0.1")
addition = Addition(A=division, B="1")
series = Series(Start=0, Step="-0.1", Count=addition)
unit_z = UnitZ(Factor=series)
geometry = ClusterInput()
move = Move(Geometry=geometry, Motion=unit_z)  # -> Geometry, Transform
geometry_2 = ClusterOutput(move.Geometry)

# ==== cluster CalculateM
A = ClusterInput()
overhang_volume_mm3 = ClusterInput()
span_length_mm = ClusterInput()
division = Division(A=A, B="1000")

density_g_mm3 = Panel(division)
gravitational_acceleration_m_s2 = Panel("9.81")
overhang_volume_mm3_2 = Number(overhang_volume_mm3)
span_length_mm_2 = Number(span_length_mm)

multiplication = Multiplication(A=overhang_volume_mm3_2, B=density_g_mm3)
total_weight_g = Panel(multiplication)
division_2 = Division(A=multiplication, B="1000")
multiplication_2 = Multiplication(A=division_2, B=gravitational_acceleration_m_s2)
total_weight_kg = Panel(division_2)
division_3 = Division(A=multiplication_2, B=span_length_mm_2)
N = Panel(multiplication_2)
square = Square(Value=span_length_mm_2)
panel = Panel("0.125")
w_n_mm = Panel(division_3)
multiplication_3 = Multiplication(A=panel, B=division_3, C=square)
result = ClusterOutput(multiplication_3)
m_nmm = Panel(multiplication_3)

# ==== cluster Cluster_8
point_a = ClusterInput()
vector_2pt = Vector2Pt(PointA=point_a, PointB="0,0,0", Unitize=False)  # -> Vector, Length
geometry = ClusterInput()
move = Move(Geometry=geometry, Motion=vector_2pt.Vector)  # -> Geometry, Transform
geometry_2 = ClusterOutput(move.Geometry)

# ==== cluster Cluster_9
list = ClusterInput()
list_item = ListItem(List=list, Index=0, Wrap=True)  # -> Item, Item1
deconstruct = Deconstruct(Point=list_item.Item)  # -> XComponent, YComponent, ZComponent
deconstruct_2 = Deconstruct(Point=list_item.Item1)  # -> XComponent, YComponent, ZComponent
distance = Distance(PointA=list_item.Item, PointB=list_item.Item1)
vector_2pt = Vector2Pt(PointA=list_item.Item, PointB=list_item.Item1, Unitize=False)  # -> Vector, Length
subtraction = Subtraction(A=deconstruct_2.ZComponent, B=deconstruct.ZComponent)
second_number = ClusterInput()
vector = ClusterOutput(vector_2pt.Vector)
distance_2 = ClusterOutput(distance)
larger_than = LargerThan(FirstNumber=subtraction, SecondNumber=second_number)  # -> LargerThan, OrEqualTo
larger_than_2 = ClusterOutput(larger_than.LargerThan)

# ==== cluster EstimateMValuesForMissingData
m_value = ClusterInput()
boolean = ClusterInput()
list = ClusterInput()
dispatch = Dispatch(List=list, DispatchPattern=boolean)  # -> ListA, ListB
m_value_2 = Number(m_value)
boolean_2 = Boolean(boolean)
list_length = ListLength(List=m_value_2)
area = Area(Geometry=dispatch.ListA)  # -> Area, Centroid
area_2 = Area(Geometry=dispatch.ListB)  # -> Area, Centroid
series = Series(Start=0, Step=1, Count=list_length)
closest_points = ClosestPoints(Point=graft(area.Centroid), Cloud=area_2.Centroid, Count="4")  # -> ClosestPoint, CPIndex, Distance
dispatch_2 = Dispatch(List=m_value_2, DispatchPattern=boolean_2)  # -> ListA, ListB
dispatch_3 = Dispatch(List=series, DispatchPattern=boolean_2)  # -> ListA, ListB
list_item = ListItem(List=dispatch_2.ListB, Index=closest_points.CPIndex, Wrap=True)
average = Average(Input=list_item)  # -> flatten(ArithmeticMean)
replace_items = ReplaceItems(List=m_value_2, Item=average, Indices=dispatch_3.ListA, Wrap=False)
list_2 = ClusterOutput(replace_items)

# ==== cluster Cluster_2
A = ClusterInput()
A_2 = ClusterInput()
panel = Panel("""-2
2""")
panel_2 = Panel("""-2
2""")
division = Division(A=A, B=panel)
division_2 = Division(A=A_2, B=panel_2)
list_item = ListItem(List=division, Index=0, Wrap=True)  # -> Item, Item1
list_item_2 = ListItem(List=division_2, Index=0, Wrap=True)  # -> Item, Item1
construct_domain = ConstructDomain(DomainStart=list_item.Item, DomainEnd=list_item.Item1)
construct_domain_2 = ConstructDomain(DomainStart=list_item_2.Item, DomainEnd=list_item_2.Item1)
xy_plane = XYPlane(Origin=Point(0, 0, 0))
angle = ClusterInput()
rectangle = Rectangle(Plane=PlaneXY(0, 0, 0), XSize=construct_domain_2, YSize=construct_domain, Radius=0)  # -> Rectangle, Length
rotate = Rotate(Geometry=xy_plane, Angle=degrees(angle), Plane=PlaneXY(0, 0, 0))  # -> Geometry, Transform
angle_2 = ClusterInput()
rectangle_2 = Rectangle(Plane=PlaneXY(0, 0, 0), XSize=construct_domain_2, YSize=construct_domain, Radius=0)  # -> Rectangle, Length
rotate_2 = Rotate(Geometry=rectangle.Rectangle, Angle=degrees(angle_2), Plane=PlaneXY(0, 0, 0))  # -> Geometry, Transform
bounding_rectangle = BoundingRectangle(Geometry=rectangle_2.Rectangle, Plane=graft(rotate.Geometry), Axis=0, Slide=0, Union=True)  # -> Bounding, DimensionX, flatten(DimensionY)
bounding_rectangle_2 = BoundingRectangle(Geometry=rotate_2.Geometry, Plane=graft(rotate.Geometry), Axis=0, Slide=0, Union=True)  # -> Bounding, DimensionX, flatten(DimensionY)
division_3 = Division(A=bounding_rectangle.DimensionY, B="2")
division_4 = Division(A=bounding_rectangle_2.DimensionY, B="2")
entwine = Entwine(Branch00=division_4, Branch01=division_3, FlattenInputs=True)  # -> simplify(Result)
path = ClusterInput()
number = Number(path)
tree_branch = TreeBranch(Tree=entwine, Path=path, MaintainPaths=True)
distance_between_filament_center_and_cha = Number(tree_branch)  # "Distance between filament center and channel perimeter"
distance_between_filament_center_and_cha_2 = ClusterOutput(distance_between_filament_center_and_cha)  # "Distance between filament center and channel perimeter"

# ==== cluster Pythagoras
filament_width = ClusterInput()
filament_height = ClusterInput()
filament_width_2 = Number(filament_width)
filament_height_2 = Number(filament_height)
square = Square(Value=filament_height_2)
square_2 = Square(Value=filament_width_2)
addition = Addition(A=square, B=square_2)
square_root = SquareRoot(Value=addition)
result = ClusterOutput(square_root)
